# Grasshopper definition shotglass-definition.gh (Grasshopper 1.0.7)

# ---- group: Create Top Center Point of Cup
height = Slider(7.5, range=0..10)
construct_point = ConstructPoint(XCoordinate=0, YCoordinate=0, ZCoordinate=height)

# ---- group: Draw Bottom Circle
bottom_radius = Slider(3.2, range=0..10)
circle = Circle(Plane=PlaneXY(0, 0, 0), Radius=bottom_radius)

# ---- group: Draw Top Circle
top_radius = Slider(4, range=0..10)
circle_2 = Circle(Plane=construct_point, Radius=top_radius)

# ---- group: Create Outside Bottom Surface
boundary_surfaces = BoundarySurfaces(Edges=circle)

# ---- group: Create Outside Side Surface
ruled_surface = RuledSurface(CurveA=circle, CurveB=circle_2)

# ---- group: Join Outside Bottom and Side Surface
brep_join = BrepJoin(Breps=[boundary_surfaces, ruled_surface])  # -> Breps, Closed

# ---- group: Scale down outside to make inside
scale = Scale(Geometry=brep_join.Breps, Center=construct_point, Factor=Slider(0.93, range=0..1))  # -> Geometry, Transform

# ---- group: Extract Naked Edges from Inside and Outside
brep_edges = BrepEdges(Brep=scale.Geometry)  # -> Naked, Interior, NonManifold
brep_edges_2 = BrepEdges(Brep=brep_join.Breps)  # -> Naked, Interior, NonManifold

# ---- group: Connect Inside to Outside SUrface
ruled_surface_2 = RuledSurface(CurveA=brep_edges_2.Naked, CurveB=brep_edges.Naked)

# ---- group: Join and Merge Everything into One Solid Surface
brep_join_2 = BrepJoin(Breps=flatten([brep_join.Breps, scale.Geometry, ruled_surface_2]))  # -> Breps, Closed

# ---- group: Preview in Color
colour_picker = ColourPicker(PickedColour=RGB(140, 190, 209))
custom_preview = CustomPreview(Geometry=brep_join_2.Breps, Material=colour_picker)
