# Grasshopper definition projection-pattern-definition.gh (Grasshopper 1.0.7)
# plug-ins: Kangaroo2 Components

# ---- group: Rect Grid Settings
rect_grid_overall_height = Slider(2.4, range=0..10)
rect_grid_overall_width = Slider(4.1, range=0..10)
x_count = Slider(10, range=0..10)
y_count = Slider(10, range=0..10)

# ---- group: Hex Grid Alternative
hex_radius = Slider(0.19, range=0..1)
x_count_2 = Slider(10, range=0..10)
y_count_2 = Slider(10, range=0..10)
hexagonal = Hexagonal(Plane=PlaneXY(0, 0, 0), Size=hex_radius, ExtentX=x_count_2, ExtentY=y_count_2)  # -> Cells, Points
# Connect Discontinuity *Points* to Flatten Tree *Tree*
discontinuity = Discontinuity(Curve=hexagonal.Cells, Level=1)  # -> Points, Parameters

# ---- group: Create Rect Grid
division = Division(A=rect_grid_overall_width, B=x_count)
division_2 = Division(A=rect_grid_overall_height, B=y_count)
rectangular = Rectangular(Plane=PlaneXY(0, 0, 0), SizeX=division, SizeY=division_2, ExtentX=x_count, ExtentY=y_count)  # -> Cells, Points

# ---- group: Remove Native Grid Structure and Any Duplicate Points
flatten_tree = FlattenTree(Tree=rectangular.Points, Path="{0}")
removeduplicatepts = RemoveDuplicatePts(Points=flatten_tree, Tolerance=0.01)

# ----
max_projection_height = Slider(0.9, range=0..5)
random_seed = Slider(100, range=0..100)

# ---- group: Generate Random Projection Amplitudes
list_length = ListLength(List=removeduplicatepts)
random = Random(Range=max_projection_height, Number=list_length, Seed=random_seed)

# ---- group: Move Points
unit_z = UnitZ(Factor=random)
move = Move(Geometry=removeduplicatepts, Motion=unit_z)  # -> Geometry, Transform

# ----
number_of_closest_points = Slider(3, range=0..10)

# ---- group: Find the Closest Points to *Each* Point
graft_tree = GraftTree(Tree=move.Geometry, IncludeEmptyLists=True, IncludeNullItems=True)
panel = Panel("x+1")
closest_points = ClosestPoints(Point=graft_tree, Cloud=move.Geometry, Count=expr("x+1", number_of_closest_points))  # -> ClosestPoint, CPIndex, Distance

# ---- group: Remove the First Closest Point (which is always the starting point)
cull_index = CullIndex(List=closest_points.ClosestPoint, Indices="0", Wrap=True)

# ---- group: Draw Lines
line = Line(StartPoint=graft_tree, EndPoint=cull_index)

# ----
pipe_radius = Slider(0.026, range=0..1)

# ---- group: Determine how long each line is, and compare each length against that domain
length = Length(Curve=line)
flatten_tree_2 = FlattenTree(Tree=length, Path="{0}")
bounds = Bounds(Numbers=flatten_tree_2)
remap_numbers = RemapNumbers(Value=flatten_tree_2, Source=bounds, Target=Domain(0, 1))  # -> Mapped, Clipped

# ---- group: Draw Pipes
pipe = Pipe(Curve=line, Radius=pipe_radius, Caps=0)
flatten_tree_3 = FlattenTree(Tree=pipe, Path="{0}")

# ---- group: Generate Color
colour_rgb_f = ColourRGBF(Alpha=1, Red=0, Green=remap_numbers.Mapped, Blue=remap_numbers.Mapped)

# ----
custom_preview = CustomPreview(Geometry=flatten_tree_3, Material=colour_rgb_f)
