# Grasshopper definition data-pots-definition.gh (Grasshopper 1.0.7)

# ^
# Make sure that these panels are not 'Multiline Data' by right-clicking and deseleecting the option.
percentage_of_forested_area_in_each_coun = Panel(""""Country",1990,1995,2000,2005,2010,2015
"Brazil",65.4,63.9,62.4,60.6,59.6,59.0
"China",16.7,17.8,18.9,20.6,21.4,22.2
"India",21.5,21.7,22.0,22.8,23.5,23.8
"Russia",49.4,49.4,49.4,49.4,49.8,49.8
"USA",33.0,33.1,33.1,33.0,33.7,33.0""")  # "Percentage of Forested Area in Each Country Over Time"
# Both datasets have rows for…
# 
# Brazil
# China
# India
# Russia
# USA
# 
# The second dataset has columns for…
# 
# 1990,1995,2000,2005,2010,2015
# 
# All data from…
# 
# https://data.worldbank.org
size_of_countries_in_square_kilometers = Panel(""""Country","Area"
"Brazil",8.516
"China",9.597
"India",3.287
"Russia",17.1
"USA",9.834""")

# ---- group: Get one country’s data at a time
# ^
# This is a Value List component. If you double click on it, you can associate a word with a number like this…
# 
# Header = 0
# Brazil = 1
# China  = 2
# India  = 3
# Russia = 4
# USA    = 5
value_list = ValueList({"Header": 0, "Brazil": 1, "China": 2, "India": 3, "Russia": 4, "USA": 5}, selected="Brazil")
list_item = ListItem(List=size_of_countries_in_square_kilometers, Index=value_list, Wrap=True)
list_item_2 = ListItem(List=percentage_of_forested_area_in_each_coun, Index=value_list, Wrap=True)

# ---- group: Slice up the text at commas
text_split = TextSplit(Text=list_item_2, Separators=",")

text_split_2 = TextSplit(Text=list_item, Separators=",")

# ---- group: Split off country name from the row
split_list = SplitList(List=text_split_2, Index="1")  # -> ListA, ListB

split_list_2 = SplitList(List=text_split, Index="1")  # -> ListA, ListB

# ---- group: Convert percentages into decimal equivalents
division = Division(A=split_list_2.ListB, B="100")

# ---- group: Determine how big the pot should be for each years’ data
multiplication = Multiplication(A=split_list.ListB, B=division)

# ----
height_of_inside_of_pot = Slider(10, range=0..10)

# ---- group: How many years of data do we have?
list_length = ListLength(List=multiplication)

# ----
panel = Panel("Expression: x - 1")

# ---- group: Make ascending points for each year
range = Range(Domain=height_of_inside_of_pot, Steps=expr("x-1", list_length))
construct_point = ConstructPoint(XCoordinate=0, YCoordinate=0, ZCoordinate=range)

# ---- group: Make a circle at the top for the top edge based on country overall size
construct_point_2 = ConstructPoint(XCoordinate=0, YCoordinate=0, ZCoordinate=height_of_inside_of_pot)
circle_cnr = CircleCNR(Center=construct_point_2, Normal=Vector(0, 0, 1), Radius=split_list.ListB)

# ---- group: Make a copy of the top edge, and move it a bit lower
lip_thickness = Slider(2.5, range=0..10)
negative = Negative(Value=lip_thickness)
unit_z = UnitZ(Factor=negative)
move = Move(Geometry=circle_cnr, Motion=unit_z)  # -> Geometry, Transform

# ---- group: Make a circle for each year
circle_cnr_2 = CircleCNR(Center=construct_point, Normal=Vector(0, 0, 1), Radius=multiplication)

# ---- group: Get the most recent data point, and make a circle to serve as the bottom of the pot
# "list item" at index "-1" is always the final item in the list.
bottom_padding_thickness_of_pot = Slider(3.2, range=0..10)
list_item_3 = ListItem(List=multiplication, Index="-1", Wrap=True)
negative_2 = Negative(Value=bottom_padding_thickness_of_pot)
construct_point_3 = ConstructPoint(XCoordinate=0, YCoordinate=0, ZCoordinate=negative_2)
circle_cnr_3 = CircleCNR(Center=construct_point_3, Normal=Vector(0, 0, 1), Radius=list_item_3)

# ---- group: Connect the circles into a surface
# ^
# Try different numbers here for different loft styles!
number_slider = Slider(3, range=0..10)
loft_options = LoftOptions(Closed=False, Adjust=False, Rebuild=0, Refit=0, Type=number_slider)
loft = Loft(Curves=circle_cnr_2, Options=loft_options)

# ---- group: Make the top face
# "list item" at index "-1" is always the final item in the list.
panel_2 = Panel("-1")
list_item_4 = ListItem(List=circle_cnr_2, Index=panel_2, Wrap=True)
ruled_surface = RuledSurface(CurveA=list_item_4, CurveB=circle_cnr)

# ---- group: Make the outside wall of the pot
ruled_surface_2 = RuledSurface(CurveA=circle_cnr_3, CurveB=move.Geometry)

# ---- group: Make the top outside cylindrical section
ruled_surface_3 = RuledSurface(CurveA=circle_cnr, CurveB=move.Geometry)

# ---- group: Remove any data structure that might exist
flatten_tree = FlattenTree(Tree=[ruled_surface, ruled_surface_3, ruled_surface_2, loft], Path="{0}")

# ---- group: Make a translucent material
material_opacity = Slider(0.3, range=0..1)
create_material = CreateMaterial(
    Diffuse=ColourSwatch(SwatchColor=RGB(186, 91, 43)),
    Specular=RGB(255, 255, 255),
    Emission=RGB(0, 0, 0),
    Transparency=material_opacity,
    Shine=0)

# ---- group: Join surfaces together and cap the holes
brep_join = BrepJoin(Breps=flatten_tree)  # -> Breps, Closed
cap_holes = CapHoles(Brep=brep_join.Breps)

# ----
custom_preview = CustomPreview(Geometry=cap_holes, Shader=create_material)
