# Grasshopper definition motion-definition.gh (Grasshopper 1.0.7)

# ---- group: This script loads a file into Grasshopper on Macs and Windows alike
# Script: """Provides a scripting component.
#     Inputs:
#         x: The x script variable
#         y: The y script variable
#     Output:
#         a: The a output variable"""
# 
# __author__ = "zap"
# 
# import rhinoscriptsyntax as rs
# 
# #ask Rhino to open a file
# filename = rs.OpenFileName("Open Point File")
# 
# #open file for 'r'eading
# file = open(filename, "r")
# 
# #read all of the lines of the file
# contents = file.readlines()
# 
# #close the file
# file.close()
# 
# #output all data
# a = contents
ghpython_script = GhPythonScript()  # -> out, a
# ---------- ghpython_script: Python ----------
__author__ = "zap"

import rhinoscriptsyntax as rs

#ask Rhino to open a file
filename = rs.OpenFileName("Open Point File")

#open file for 'r'eading
file = open(filename, "r")

#read all of the lines of the file
contents = file.readlines()

#close the file
file.close()

#output all data
a = contents
# ---------- end ghpython_script ----------

# ---- group: Break Off Header Row from Actual Data
split_list = SplitList(List=ghpython_script.a, Index="2")  # -> ListA, ListB

# ----
header_row = Panel(split_list.ListA)

# ---- group: Simplify data by only keeping certain rows
# Make sure the panel to the right has "multiline data" turned off ->
# 
# "1" sends to "List A"
# "0" sends to "List B"
panel = Panel("""0
1
1""")
dispatch = Dispatch(List=split_list.ListB, DispatchPattern=panel)  # -> ListA, ListB

# ---- group: Construct the domain for which frames to show
total_frames_to_show = Slider(30, range=0..100)
starting_frame = Slider(620, range=0..620)

# ----
subtraction = Subtraction(A=starting_frame, B=total_frames_to_show)

# ---- group: Construct the domain for which frames to show (continued)
construct_domain = ConstructDomain(DomainStart=starting_frame, DomainEnd=subtraction)

# ---- group: Cut out subset of frames to show
sub_list = SubList(List=dispatch.ListB, Domain=construct_domain, Wrap="0")  # -> List, Index

# ---- group: Give each row in the dataset its own branch
graft_tree = GraftTree(Tree=sub_list.List, IncludeEmptyLists=True, IncludeNullItems=True)

# ---- group: Split up the data with the "tab" character
# This panel to the right looks blank ->
# 
# But, it isn’t! It has a tab character inside. To do this, make sure you turn off "multiline data" on a panel. Then, you can type a tab into it.
panel_2 = Panel("\t")
text_split = TextSplit(Text=graft_tree, Separators=panel_2)

# ---- group: Remove the first column, which is the frame number.
cull_index = CullIndex(List=text_split, Indices="0", Wrap=True)

# ---- group: Every fourth column is blank, so let’s remove it.
cull_nth = CullNth(List=cull_index, CullFrequency="4")

# ---- group: Slice the list into 3 item size chunks (x,y,z)
partition_list = PartitionList(List=cull_nth, Size="3")

# ---- group: Make a point for each branch!
# ^
# |
# 
# Note the criss-crossed patches.
# 
# In this dataset, the Y dimension is up-down and the Z dimension is forward back. In Rhino, it is the other way around. So we quickly fix this discrepancy by changing axes here.
list_item = ListItem(List=partition_list, Index=0, Wrap=True)  # -> Item, Item1, Item2
construct_point = ConstructPoint(XCoordinate=list_item.Item, YCoordinate=list_item.Item2, ZCoordinate=list_item.Item1)

# ---- group: The tree has grown lots of unnecessary complexity, so we should remove redundant structure.
simplify_tree = SimplifyTree(Tree=construct_point, Front=False)

# ---- group: Remove the last tree branches
trim_tree = TrimTree(Tree=simplify_tree, Depth=1)

# ----
# Before this "trim tree" node, each motion frame was a single branch, and in that branch, each point was its own branch.
# 
# After the "trim tree" node, all the sub=branch structure is removed. Each motion frame is a single branch, which contains all of the points of that frame.
# 
# Compare and contrast the param viewers here to see the simplified structure.
param_viewer = ParamViewer(simplify_tree)
param_viewer_2 = ParamViewer(trim_tree)

point = Point(trim_tree)

# ---- group: Extract Points
list_item_2 = ListItem(List=point, Index=0, Wrap=True)  # -> Item, Item1, Item2, Item3, Item4, Item5, Item6, Item7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

# ---- group: Torso
merge = Merge(Data1=list_item_2.Item10, Data2=list_item_2.Item20, Data3=list_item_2.Item32, Data4=list_item_2.Item29)
interpolate = Interpolate(Vertices=merge, Degree="1", Periodic="1", KnotStyle=1)  # -> Curve, Length, Domain

# ---- group: Head
interpolate_2 = Interpolate(
    Vertices=[list_item_2.Item, list_item_2.Item1, list_item_2.Item2, list_item_2.Item5, list_item_2.Item4, list_item_2.Item3],
    Degree=3,
    Periodic="1",
    KnotStyle=1)  # -> Curve, Length, Domain

# ---- group: Left Leg
interpolate_3 = Interpolate(
    Vertices=[list_item_2.Item32, list_item_2.Item45, list_item_2.Item47, list_item_2.Item48, list_item_2.Item50],
    Degree=3,
    Periodic=False,
    KnotStyle=1)  # -> Curve, Length, Domain

# ---- group: Right Leg
interpolate_4 = Interpolate(
    Vertices=[list_item_2.Item29, list_item_2.Item36, list_item_2.Item38, list_item_2.Item39, list_item_2.Item41],
    Degree=3,
    Periodic=False,
    KnotStyle=1)  # -> Curve, Length, Domain

# ---- group: Right Arm
interpolate_5 = Interpolate(
    Vertices=[list_item_2.Item10, list_item_2.Item11, list_item_2.Item12, list_item_2.Item16, list_item_2.Item18],
    Degree=3,
    Periodic=False,
    KnotStyle=1)  # -> Curve, Length, Domain

# ---- group: Left Arm
interpolate_6 = Interpolate(
    Vertices=[list_item_2.Item20, list_item_2.Item21, list_item_2.Item22, list_item_2.Item26, list_item_2.Item25, list_item_2.Item28],
    Degree=3,
    Periodic=False,
    KnotStyle=1)  # -> Curve, Length, Domain

# ---- group: Logically organize our bodyparts into single groups per motion frame.
group = Group(Objects=[interpolate_2.Curve, interpolate_5.Curve, interpolate_6.Curve, interpolate_4.Curve, interpolate.Curve, interpolate_3.Curve])  # -> flatten(Group)

# ---- group: Generate a color for each motion frame.
list_length = ListLength(List=group)
range = Range(Domain=Domain(0, 1), Steps=list_length)
gradient = Gradient(
    LowerLimit=0,
    UpperLimit=1,
    Parameter=range,
    stops=[0: RGB(243, 57, 0), 0.1: RGB(236, 27, 60), 0.2: RGB(210, 0, 118), 0.3: RGB(103, 0, 120), 0.4: RGB(39, 72, 161), 0.5: RGB(1, 192, 229), 0.6: RGB(18, 178, 90), 0.7: RGB(79, 186, 8), 0.8: RGB(220, 237, 32), 0.9: RGB(247, 159, 20), 1: RGB(243, 57, 0)])

# ----
custom_preview = CustomPreview(Geometry=group, Material=gradient)
