# Grasshopper definition deform-definition.gh (Grasshopper 1.0.7)
# plug-ins: LunchBox

# Right Click -> Set One Mesh
mesh = Mesh(<mesh referenced from the Rhino model>)

# ---- group: Scale Mesh to Inches
scale_factor = Slider(0.039, range=0..0.1)
scale = Scale(Geometry=mesh, Center=Point(0, 0, 0), Factor=scale_factor)  # -> Geometry, Transform

# ---- group: Simplify Mesh for Our Slow Computers
desired_face_count = Slider(1000, range=0..1000)
mesh_reduce = MeshReduce(Mesh=scale.Geometry, TargetSize=desired_face_count, Distort=True, Accuracy=5, NormalizeSize=False)

# ---- group: Attract/Repulse Controller
construct_point = ConstructPoint(XCoordinate=Slider(8.6, range=-20..20), YCoordinate=Slider(-3.4, range=-20..20), ZCoordinate=Slider(11.6, range=-20..20))

# ---- group: Take Mesh Apart
deconstruct_mesh = DeconstructMesh(Mesh=mesh_reduce)  # -> Vertices, Faces, Colours, Normals

deconstruct_mesh_2 = DeconstructMesh(Mesh=mesh_reduce)  # -> Vertices, Faces, Colours, Normals

# ---- group: Make Controller Easier to See
sphere = Sphere(Base=construct_point, Radius=1)
custom_preview = CustomPreview(
    Geometry=sphere,
    Material={diffuse=RGB(221, 160, 221), emission=RGB(66, 48, 66), shine=0.5, specular=RGB(255, 255, 255), transparency=0})

# ---- group: Build a Mesh Sphere
number_of_longitudinal_sections = Slider(20, range=0..100)
list_length = ListLength(List=deconstruct_mesh.Vertices)
division = Division(A=list_length, B=number_of_longitudinal_sections)
mesh_sphere = MeshSphere(Base=PlaneXY(0, 0, 0), Radius=10, UCount=division, VCount=number_of_longitudinal_sections)

# ---- group: How should near and far vertices move?
construct_domain = ConstructDomain(DomainStart=Slider(-7.2, range=-10..10), DomainEnd=Slider(5, range=-10..10))

# ---- group: Transform Distances into desired movement
distance = Distance(PointA=construct_point, PointB=deconstruct_mesh_2.Vertices)
bounds = Bounds(Numbers=distance)
remap_numbers = RemapNumbers(Value=distance, Source=bounds, Target=construct_domain)  # -> Mapped, Clipped

# ---- group: Generate vector from distance and angle to control point, adapted to our desired movement domain
vector_2pt = Vector2Pt(PointA=construct_point, PointB=deconstruct_mesh_2.Vertices, Unitize=False)  # -> Vector, Length
amplitude = Amplitude(Vector=vector_2pt.Vector, Amplitude=remap_numbers.Mapped)

# ---- group: For Each Point of Mesh…
graft_tree = GraftTree(Tree=deconstruct_mesh.Vertices, IncludeEmptyLists=True, IncludeNullItems=True)

# ---- group: Take Mesh Apart
deconstruct_mesh_3 = DeconstructMesh(Mesh=mesh_sphere)  # -> Vertices, Faces, Colours, Normals

# ---- group: Find Closest Point on Sphere to Each Point of Mesh
closest_point = ClosestPoint(Point=graft_tree, Cloud=deconstruct_mesh_3.Vertices)  # -> ClosestPoint, CPIndex, Distance

# ---- group: Remove Structure
flatten_tree = FlattenTree(Tree=closest_point.ClosestPoint, Path="{0}")

# ---- group: Sample Gradient Based on Distance
bounds_2 = Bounds(Numbers=distance)
remap_numbers_2 = RemapNumbers(Value=distance, Source=bounds_2, Target=Domain(0, 1))  # -> Mapped, Clipped
gradient = Gradient(
    LowerLimit=0,
    UpperLimit=1,
    Parameter=remap_numbers_2.Mapped,
    stops=[0: RGB(0, 128, 0), 0.5: RGB(255, 255, 0), 1: RGB(255, 0, 0)])

# ---- group: Draw Connecting Lines
line = Line(StartPoint=deconstruct_mesh.Vertices, EndPoint=flatten_tree)

# ---- group: Move vertices
move = Move(Geometry=deconstruct_mesh_2.Vertices, Motion=amplitude)  # -> Geometry, Transform

# ----
tween_state = Slider(0, range=0..1)
evaluate_curve = EvaluateCurve(Curve=line, Parameter=tween_state)  # -> Point, Tangent, Angle

# ---- group: Sample Gradient Based on Distance
length = Length(Curve=line)
bounds_3 = Bounds(Numbers=length)
remap_numbers_3 = RemapNumbers(Value=length, Source=bounds_3, Target=Domain(0, 1))  # -> Mapped, Clipped
gradient_2 = Gradient(
    LowerLimit=0,
    UpperLimit=1,
    Parameter=remap_numbers_3.Mapped,
    stops=[0: RGB(0, 128, 0), 0.5: RGB(255, 255, 0), 1: RGB(255, 0, 0)])

# ---- group: Rebuild Mesh
construct_mesh = ConstructMesh(Vertices=move.Geometry, Faces=deconstruct_mesh_2.Faces, Colours=gradient)

construct_mesh_2 = ConstructMesh(Vertices=evaluate_curve.Point, Faces=deconstruct_mesh.Faces, Colours=gradient_2)
