# Grasshopper definition tourism-definition.gh (Grasshopper 0.9.76)

mesh = Mesh(<mesh referenced from the Rhino model>)

# ---- group: Scale MM to Inches
scale = Scale(Geometry=mesh, Center=Point(0, 0, 0), Factor=".0393")  # -> Geometry, Transform

# ---- group: Create Box around Sculpture
bounding_box = BoundingBox(Content=scale.Geometry, Plane=PlaneXY(0, 0, 0))  # -> Box, Box_2

# ---- group: Create 3 Points inside the Sculpture to Serve as the 'Axis' of the Visualization
evaluate_box = EvaluateBox(Box=bounding_box.Box, UParameter=0.5, VParameter=".55", WParameter=".85")  # -> Plane, Point, Include
evaluate_box_2 = EvaluateBox(Box=bounding_box.Box, UParameter=0.5, VParameter=0.5, WParameter="0")  # -> Plane, Point, Include
evaluate_box_3 = EvaluateBox(Box=bounding_box.Box, UParameter=0.5, VParameter=".3", WParameter=".5")  # -> Plane, Point, Include

# ----
data_on_tourism_to_egypt_1995_2017 = Panel("""2871000	
3528000	
3656000	
3213000	
4490000	
5116000	
4357000	
4906000	
5746000	
7795000	
8244000	
8646000	
10610000
12296000
11914000
14051000
9497000	
11196000
9174000	
9628300	
9139000	
5258000	
8157000""")

# ---- group: This is a "Quick Graph" Node to Check Our Work
# This is a more expected visualization of the same dataset. It's certainly more readable... But is it as impactful and memorable?
quick_graph = QuickGraph(data_on_tourism_to_egypt_1995_2017)

# ---- group: Keep Points in Order from Bottom to Top
merge = Merge(Data1=evaluate_box_2.Point, Data2=evaluate_box_3.Point, Data3=evaluate_box.Point)

# ---- group: Take apart Mesh into its Components
deconstruct_mesh = DeconstructMesh(Mesh=scale.Geometry)  # -> Vertices, Faces, Colours, Normals

# ---- group: How Many Data Points?
list_length = ListLength(List=data_on_tourism_to_egypt_1995_2017)

# ---- group: Draw Axis Line!
polyline = PolyLine(Vertices=merge, Closed=False)

# ---- group: Convert Data into Controllable *Shrink* Percentages
construct_domain = ConstructDomain(DomainStart=Slider(0.25, range=0..10), DomainEnd=Slider(0.75, range=0..10))
bounds = Bounds(Numbers=data_on_tourism_to_egypt_1995_2017)
remap_numbers = RemapNumbers(Value=data_on_tourism_to_egypt_1995_2017, Source=bounds, Target=construct_domain)  # -> Mapped, Clipped

# ----
# Divide Curve, like Range, makes n+1 number of items -- so we often need to make this adjustment
subtraction = Subtraction(A=list_length, B="1")

# ---- group: Add Structure to the Mesh to Ensure *Each* Vertex is Handled Separately
graft_tree = GraftTree(Tree=deconstruct_mesh.Vertices, IncludeEmptyLists=True, IncludeNullItems=True)

# ---- group: Split Axis Line into Evenly Spaced Points
divide_curve = DivideCurve(Curve=polyline, Count=subtraction, Kinks=False)  # -> Points, Tangents, Parameters

# ----
# For *each* vertex in the mesh, look at *all* of the axis points, and find the closest one.
closest_point = ClosestPoint(Point=graft_tree, Cloud=divide_curve.Points)  # -> ClosestPoint, CPIndex, Distance

# ---- group: Get the Direction between Each Vertex and its Matching Closest Axis Point
# Get the datapoint (converted into a percentage value) for each vertex *matching the index* of the closest point found on the axis in the previous step. Since each point on the axis share an index with a single datapoint, they will line up. So, fundamentally, we are finding the datapoint in our dataset appropriate for each vertex.
vector_2pt = Vector2Pt(PointA=graft_tree, PointB=closest_point.ClosestPoint, Unitize=False)  # -> Vector, Length

# ----
list_item = ListItem(List=remap_numbers.Mapped, Index=closest_point.CPIndex, Wrap=True)

# ---- group: Determine How Far Each Vertex Should Move
multiplication = Multiplication(A=closest_point.Distance, B=list_item)

# ---- group: Add Together the Direction of Movement with the Desired Distance
amplitude = Amplitude(Vector=vector_2pt.Vector, Amplitude=multiplication)

# ---- group: Move the Axis Points over to the Right
unit_x = UnitX(Factor=Slider(4, range=0..10))
move = Move(Geometry=divide_curve.Points, Motion=unit_x)  # -> Geometry, Transform

# ---- group: Build Sequence of Year Numbers
starting_year_for_key = Panel("1995")
series = Series(Start=starting_year_for_key, Step=1, Count=list_length)

# ---- group: Move Each Vertex
move_2 = Move(Geometry=graft_tree, Motion=amplitude)  # -> Geometry, Transform

# ---- group: Convert to Integer
integer = Integer(series)

# ---- group: Remove the Extra Structure Introduced Earlier
flatten_tree = FlattenTree(Tree=move_2.Geometry, Path="{0}")

# ---- group: Make a Plane Facing Forward for Each Axis Point
xz_plane = XZPlane(Origin=move.Geometry)

# ---- group: Make Axis Labels
text_tag_3d = TextTag3D(
    Location=xz_plane,
    Text=integer,
    Size=Slider(0.25, range=0..1),
    Colour=ColourSwatch(SwatchColor=RGB(255, 255, 255)),
    Justification=7)

# ---- group: Build a Mesh with the New Vertices, and the Same Face Indices
construct_mesh = ConstructMesh(Vertices=flatten_tree, Faces=deconstruct_mesh.Faces)

# ---- group: Show Mesh in Single Color
custom_preview = CustomPreview(Geometry=construct_mesh, Shader=ColourSwatch(SwatchColor=RGB(120, 115, 86)))
