# Grasshopper definition 3dshortestwalk.gh (Grasshopper 1.0.4)
# plug-ins: Shortest Walk in Gh

# ---- group: Random Points For Tree To Branch Through
overall_tree_size_and_proportion = Slider(10, range=0..10)
random_point_count = Slider(258, range=0..1000)
domain_box = DomainBox(
    Base=PlaneXY(0, 0, 0),
    X=overall_tree_size_and_proportion,
    Y=overall_tree_size_and_proportion,
    Z=overall_tree_size_and_proportion)
populate_3d = Populate3D(Region=domain_box, Count=random_point_count, Seed=1)

# ---- group: Alternatively, Make Branches Trend Toward Highest Random Points
deconstruct = Deconstruct(Point=populate_3d)  # -> XComponent, YComponent, ZComponent
sort_list = SortList(Keys=deconstruct.ZComponent, ValuesValuesA=populate_3d)  # -> Keys, ValuesValuesA
number_of_branches = Slider(56, range=0..100)
reverse_list = ReverseList(List=sort_list.ValuesValuesA)
split_list = SplitList(List=reverse_list, Index=number_of_branches)  # -> ListA, ListB
point = Point(split_list.ListA)

# ---- group: Shuffle the List Up and Split the List to Make Random Branch Ends
random_seed = Slider(30, range=0..100)
number_of_branches_2 = Slider(56, range=0..100)
jitter = Jitter(List=populate_3d, Jitter=1, Seed=random_seed)  # -> Values, Indices
split_list_2 = SplitList(List=jitter.Values, Index=number_of_branches_2)  # -> ListA, ListB
point_2 = Point(split_list_2.ListA)

# ---- group: Tree Trunk Base Point
construct_point = ConstructPoint(XCoordinate=Slider(5.5, range=0..10), YCoordinate=Slider(5.5, range=0..10), ZCoordinate=Slider(0, range=0..10))

# ---- group: Create Possible Tree Branches
link_count_per_point = Slider(6, range=0..10)
proximity_3d = Proximity3D(Points=flatten([populate_3d, construct_point]), Group=link_count_per_point)  # -> Links, Topology
flatten_tree = FlattenTree(Tree=proximity_3d.Links, Path="{0}")

# ---- group: Draw Straight Lines for Tree to Traverse
line = Line(StartPoint=construct_point, EndPoint=point_2)

# ---- group: Grow!
shortest_walk = ShortestWalk(Curves=flatten_tree, WantedPath=line)  # -> ShortestWalk, Succession, Direction, Length

# ---- group: Find Bend Points and Draw Curves
discontinuity = Discontinuity(Curve=shortest_walk.ShortestWalk, Level=1)  # -> Points, Parameters
nurbs_curve = NurbsCurve(Vertices=discontinuity.Points, Degree=3, Periodic=False)  # -> Curve, Length, Domain

# ---- group: Create 3D Volume for Branches
panel = Panel("""0
1""")
panel_2 = Panel(""".5
.125""")
pipe_variable = PipeVariable(Curve=reparameterize(nurbs_curve.Curve), Parameters=panel, Radii=panel_2, Caps=0)
cap_holes = CapHoles(Brep=pipe_variable)

# ----
mesh = Mesh(flatten(cap_holes))
mesh_join = MeshJoin(Meshes=mesh)
deconstruct_mesh = DeconstructMesh(Mesh=mesh_join)  # -> Vertices, Faces, Colours, Normals

# ---- group: Generate Growth Colors
deconstruct_2 = Deconstruct(Point=deconstruct_mesh.Vertices)  # -> XComponent, YComponent, ZComponent
bounds = Bounds(Numbers=deconstruct_2.ZComponent)
remap_numbers = RemapNumbers(Value=deconstruct_2.ZComponent, Source=bounds, Target=Domain(0, 1))  # -> Mapped, Clipped
gradient = Gradient(
    LowerLimit=0,
    UpperLimit=1,
    Parameter=remap_numbers.Mapped,
    stops=[0: RGB(0, 128, 0), 0.5: RGB(255, 255, 0), 1: RGB(255, 0, 0)])

# ----
construct_mesh = ConstructMesh(Vertices=deconstruct_mesh.Vertices, Faces=deconstruct_mesh.Faces, Colours=gradient)
