# Grasshopper definition GoL-definition.gh (Grasshopper 1.0.7)

number_slider = Slider(10, range=0..10)
number_slider_2 = Slider(10, range=0..10)
panel = Panel("""0
1
4
5
6
7
8""")
panel_2 = Panel("""2
3""")
panel_3 = Panel("""0
1
2
4
5
6
7
8""")
ghpython_script = GhPythonScript(
    rows=Slider(6, range=0..10),
    columns=number_slider_2,
    population=Slider(47, range=0..100),
    generations=number_slider,
    seed=Slider(8, range=0..10),
    OneToZero=panel,
    OneToOne=panel_2,
    ZeroToOne="3",
    ZeroToZero=panel_3)  # -> out, a; inputs rows: Int32, columns: Int32, population: Int32, generations: Int32, OneToZero: list of Int32, OneToOne: list of Int32, ZeroToOne: list of Int32, ZeroToZero: list of Int32
# ---------- ghpython_script: Python ----------
#imports
import rhinoscriptsyntax as rs
import ghpythonlib.treehelpers as th
import random

#build empty matrix
def generate(matrix):
	for row in range (rowCount):
		matrix.append([])
		for col in range (colCount):
			matrix[row].append(0)

#randomly flip bits
def populate(matrix, living):
	points.append([])
	for i in range (living):
		row = random.randint(0,rowCount - 1)
		col = random.randint(0,colCount - 1)
		matrix[row][col] = 1
		points[0].append(rs.AddPoint(col,row,0))

#create structural matrices
world = []
newWorld = []
points = []

#world settings
random.seed(seed)
colCount = columns
rowCount = rows
pop = population
gen = generations 

#build world
generate(world)
#randomly populate world
populate(world, pop)

#iterate generations
for g in range(1,gen+1):
	#loop for each row
	points.append([])
	for row in range (rowCount):
		newWorld.append([])
		   
		#loop for each column
		for col in range (colCount):
			
			#living/dead checks
			if (row - 1 < 0):
				leftNB = 0
			else:   
				leftNB = world[row - 1][col]

			if (row + 1 == rowCount):
				rightNB = 0
			else:
				rightNB = world[row + 1][col]
			
			if (col - 1 < 0):
				topNB = 0
			else:
				topNB = world[row][col-1] 

			if (col + 1 == colCount):
				bottomNB = 0
			else:
				bottomNB = world[row][col+1]

			if (row - 1 < 0) or (col - 1 < 0):
				tlNB = 0
			else:
				tlNB = world[row-1][col-1]

			if (row + 1 == rowCount) or (col - 1 < 0):
				trNB = 0
			else:
				trNB = world[row+1][col-1]
			
			if (row - 1 < 0) or (col + 1 == colCount):
				blNB = 0
			else:
				blNB = world[row-1][col+1]
		
			if (row + 1 == rowCount) or (col + 1 == colCount):
				brNB = 0
			else:
				brNB = world[row+1][col+1]
			
			#get current state
			currentCell = world[row][col]
			#sum neighborhood
			neighborLife = leftNB + rightNB + topNB + bottomNB + brNB + trNB + tlNB + blNB
 
			# current cell is alive...
			if currentCell == 1 :
				#transitions
				if neighborLife in OneToZero:
					newWorld[row].append(0)
				elif neighborLife in OneToOne:
					newWorld[row].append(1)
					points[g].append(rs.AddPoint(col,row,g))
			
			#current cell is dead...        
			else :  
				#transitions
				if neighborLife in ZeroToZero:
					newWorld[row].append(0)
				elif neighborLife in ZeroToOne:
					newWorld[row].append(1)
					points[g].append(rs.AddPoint(col,row,g))
	#update world
	world = newWorld
	#reset for next gen construction
	newWorld = []

#python list to gh tree
points = th.list_to_tree(points)    

#output points
a = points
# ---------- end ghpython_script ----------
panel_4 = Panel(ghpython_script.out)

# ---- group: Plane for Each Generation
series = Series(Start=0, Step=1, Count=expr("x+1", number_slider))
construct_point = ConstructPoint(XCoordinate=0, YCoordinate=0, ZCoordinate=series)
xy_plane = XYPlane(Origin=construct_point)  # -> graft(Plane)

# ---- group: Spread Out Generations
series_2 = Series(Start=0, Step=expr("x+1", number_slider_2), Count=number_slider)
unit_x = UnitX(Factor=series_2)
group = Group(Objects=ghpython_script.a)
move = Move(Geometry=graft(group), Motion=graft(unit_x))  # -> graft(Geometry), Transform

# ---- group: Box for Each Living Cell
number_slider_3 = Slider(1, range=0..1)
domain_box = DomainBox(Base=ghpython_script.a, X=number_slider_3, Y=number_slider_3, Z=number_slider_3)

# ---- group: Treat Each Point as Charge
metaball_t = MetaBallT(Points=ghpython_script.a, Plane=xy_plane, Threshold=Slider(3, range=0..10), Accuracy=Slider(0.3, range=0..1))

# ----
custom_preview = CustomPreview(Geometry=move.Geometry, Material=ColourSwatch(SwatchColor=RGB(5, 250, 78)))
custom_preview_2 = CustomPreview(Geometry=domain_box, Material=ColourSwatch(SwatchColor=RGB(255, 0, 144)))

# ---- group: Extrude Contours
unit_z = UnitZ(Factor=1)
extrude = Extrude(Base=metaball_t, Direction=unit_z)
cap_holes = CapHoles(Brep=extrude)

# ----
custom_preview_3 = CustomPreview(Geometry=cap_holes, Material=ColourSwatch(SwatchColor=RGB(138, 159, 255)))
