# Grasshopper definition LSys-2D-definition.gh (Grasshopper 1.0.7)

# Allowed Instructions: F Advance `step` distance
# 
# + Turn clockwise `angle` degrees
# 
# - Turn counter-clockwise `angle` degrees
# 
# A Recursive instruction set
# 
# B Recursive instruction set
# 
# C Recursive instruction set
number_slider = Slider(90, range=0..100)
# Koch Curve
number_slider_2 = Slider(3, range=0..10)
# Dragon Curve
number_slider_3 = Slider(6, range=0..10)
radians = Radians(Degrees=number_slider)
radians_2 = Radians(Degrees=Slider(90, range=0..360))
l_system = PythonScript(
    time=number_slider_2,
    step=Slider(0.5, range=0..10),
    angle=radians,
    alphaReplace="F",
    a="FA+A-BAB-A+FA",
    b="F-F+F+F-FC",
    c="A+BCC")  # -> out, axiom, points; inputs time: Int32; disabled
# ---------- l_system: Python ----------
import rhinoscriptsyntax as rs
import random as rv
import math

#class
class Walker : 
	def __init__(self) :	
		self.x = 0
		self.y = 0
		self.z = 0
		self.heading = 0

	def display(self) :
		shape = rs.AddPoint(self.x,self.y,self.z)
		return shape

	def step(self, op) :
			if op == "F" : 
				xCalc = math.cos(self.heading)* step
				yCalc = math.sin(self.heading)* step
				self.x += xCalc 
				self.y += yCalc

			elif op == "+" :
				self.heading = (self.heading + angle)%(math.pi * 2)

			elif op == "-" :
				if self.heading < angle :
					self.heading = ((math.pi * 2) + self.heading) - angle
				else : 
					self.heading = self.heading - angle


# parse axioms
original = a

for i in range(time) : 
	original = original.replace("A", a)
	original = original.replace("B", b)
	original = original.replace("C", c)

instruction = original.replace(" ", "")
instruction = instruction.replace("A", alphaReplace)
instruction = instruction.replace("B", alphaReplace)
instruction = instruction.replace("C", alphaReplace)


# instance
w = Walker()

# list of points
pList = []
firstPoint = rs.AddPoint(0,0,0)
pList.append(firstPoint) 

#walk through generations
move = step
for t in range(len(instruction)) :
	w.step(instruction[t])
	pList.append(w.display())

points = pList

axiom = instruction
# ---------- end l_system ----------
l_system_2 = PythonScript(
    time=number_slider_3,
    step=Slider(10, range=0..10),
    angle=radians_2,
    alphaReplace=" ",
    a="FB",
    b="B+CF+-A+B-C",
    c="−FB−C")  # -> out, axiom, points; inputs time: Int32
# ---------- l_system_2: Python ----------
import rhinoscriptsyntax as rs
import random as rv
import math

#class
class Walker : 
	def __init__(self) :	
		self.x = 0
		self.y = 0
		self.z = 0
		self.heading = 0

	def display(self) :
		shape = rs.AddPoint(self.x,self.y,self.z)
		return shape

	def step(self, op) :
			if op == "F" : 
				xCalc = math.cos(self.heading)* step
				yCalc = math.sin(self.heading)* step
				self.x += xCalc 
				self.y += yCalc

			elif op == "+" :
				self.heading = (self.heading + angle)%(math.pi * 2)

			elif op == "-" :
				if self.heading < angle :
					self.heading = ((math.pi * 2) + self.heading) - angle
				else : 
					self.heading = self.heading - angle


# parse axioms
original = a

for i in range(time) : 
	original = original.replace("A", a)
	original = original.replace("B", b)
	original = original.replace("C", c)

instruction = original
instruction = instruction.replace("A", alphaReplace)
instruction = instruction.replace("B", alphaReplace)
instruction = instruction.replace("C", alphaReplace)
instruction = instruction.replace(" ", "")



# instance
w = Walker()

# list of points
pList = []
firstPoint = rs.AddPoint(0,0,0)
pList.append(firstPoint) 

#walk through generations
move = step
for t in range(len(instruction)) :
	w.step(instruction[t])
	pList.append(w.display())

points = pList

axiom = instruction
# ---------- end l_system_2 ----------
panel = Panel(l_system.axiom)
panel_2 = Panel(l_system_2.axiom)
point = Point(l_system.points)
point_2 = Point(l_system_2.points)
polyline = PolyLine(Vertices=point, Closed=False)
polyline_2 = PolyLine(Vertices=point_2, Closed=False)
