# Grasshopper definition ecg-surface-definition.gh (Grasshopper 1.0.7)

# https://bioelectromagnetism.wordpress.com/2012/11/28/data-from-ecg-recording-in-todays-class/
# 
# Lines 5000-5100
_100_samples = Panel("""1023
1023
1023
1023
1023
1023
1023
1023
1023
1023
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""")

min_height = Slider(0.25, range=0..1)
max_height = Slider(1, range=0..10)
construct_domain = ConstructDomain(DomainStart=min_height, DomainEnd=max_height)

# ---- group: Scale Data to Inches
bounds = Bounds(Numbers=flatten(_100_samples))
remap_numbers = RemapNumbers(Value=_100_samples, Source=bounds, Target=construct_domain)  # -> Mapped, Clipped
flatten_tree = FlattenTree(Tree=remap_numbers.Mapped, Path="{0}")

# ----
width = Slider(10, range=0..10)
list_length = ListLength(List=_100_samples)
range = Range(Domain=width, Steps=list_length)

# ---- group: Draw wave
construct_point = ConstructPoint(XCoordinate=range, YCoordinate=0, ZCoordinate=flatten_tree)
nurbs_curve = NurbsCurve(Vertices=construct_point, Degree=3, Periodic=False)  # -> Curve, Length, Domain

# ----
depth = Slider(5.5, range=0..10)
unit_y = UnitY(Factor=depth)
extrude = Extrude(Base=nurbs_curve.Curve, Direction=unit_y)

# ---- group: Make Other faces of Object
bounding_box = BoundingBox(Content=extrude, Plane=PlaneXY(0, 0, 0))  # -> Box, Box_2
deconstruct_box = DeconstructBox(Box=bounding_box.Box)  # -> Plane, X, Y, Z
deconstruct_domain = DeconstructDomain(Domain=deconstruct_box.Z)  # -> Start, End
domain_box = DomainBox(Base=PlaneXY(0, 0, 0), X=deconstruct_box.X, Y=deconstruct_box.Y, Z=deconstruct_domain.End)

# ---- group: Join Parts Together
split_brep = SplitBrep(Brep=domain_box, Cutter=extrude)
list_item = ListItem(List=split_brep, Index=0, Wrap=True)
brep_join = BrepJoin(Breps=flatten([list_item, extrude]))  # -> Breps, Closed

# ----
colour_picker = ColourPicker(PickedColour=RGB(140, 212, 57))
custom_preview = CustomPreview(Geometry=brep_join.Breps, Material=colour_picker)
