# Grasshopper definition mask-definition.gh (Grasshopper 1.0.7)
# plug-ins: Weaverbird

unit_y = UnitY(Factor=Slider(0.9, range=0..10))
unit_y_2 = UnitY(Factor=Slider(2.5, range=0..10))
construct_point = ConstructPoint(XCoordinate=0, YCoordinate=0, ZCoordinate=0)
construct_point_2 = ConstructPoint(XCoordinate=0, YCoordinate=0, ZCoordinate=Slider(5.5, range=0..10))
negative = Negative(Value=unit_y)
negative_2 = Negative(Value=unit_y_2)
bezier_span = BezierSpan(StartPoint=construct_point, StartTangent=negative, EndPoint=construct_point_2, EndTangent=negative_2)  # -> Curve, Length, Domain

unit_y_3 = UnitY(Factor=Slider(1.1, range=0..10))
construct_point_3 = ConstructPoint(XCoordinate=Slider(2.6, range=0..10), YCoordinate=Slider(1.4, range=0..10), ZCoordinate=Slider(1.7, range=0..10))
unit_x = UnitX(Factor=Slider(1.7, range=0..10))
negative_3 = Negative(Value=unit_y_3)
bezier_span_2 = BezierSpan(StartPoint=construct_point_3, StartTangent=negative_3, EndPoint=construct_point, EndTangent=unit_x)  # -> Curve, Length, Domain

# ---- group: Create Mirrored Curves
mirror = Mirror(Geometry=bezier_span_2.Curve, Plane=PlaneYZ(0, 0, 0))  # -> Geometry, Transform
join_curves = JoinCurves(Curves=flatten([mirror.Geometry, bezier_span_2.Curve]), Preserve=False)

# ----
unit_x_2 = UnitX(Factor=Slider(7.8, range=0..10))

unit_y_4 = UnitY(Factor=Slider(1.3, range=0..10))
construct_point_4 = ConstructPoint(XCoordinate=Slider(2.9, range=0..10), YCoordinate=Slider(1.8, range=0..10), ZCoordinate=Slider(3.6, range=0..10))
negative_4 = Negative(Value=unit_y_4)

# ---- group: Nose Angle
unit_y_5 = UnitY(Factor=Slider(1.2, range=0..10))
radians = Radians(Degrees=Slider(30, range=0..1000))
negative_5 = Negative(Value=radians)
rotate = Rotate(Geometry=unit_y_5, Angle=negative_5, Plane=construct_point_2)  # -> Geometry, Transform

# ----
line = Line(StartPoint=construct_point_3, EndPoint=construct_point_4)

bezier_span_3 = BezierSpan(StartPoint=construct_point_2, StartTangent=rotate.Geometry, EndPoint=construct_point_4, EndTangent=negative_4)  # -> Curve, Length, Domain

# ---- group: Create Mirrored Curves
mirror_2 = Mirror(Geometry=bezier_span_3.Curve, Plane=PlaneYZ(0, 0, 0))  # -> Geometry, Transform
join_curves_2 = JoinCurves(Curves=flatten([bezier_span_3.Curve, mirror_2.Geometry]), Preserve=False)

mirror_3 = Mirror(Geometry=line, Plane=PlaneYZ(0, 0, 0))  # -> Geometry, Transform

# ---- group: Cluster by Direction
merge = Merge(Data1=line, Data2=bezier_span.Curve, Data3=mirror_3.Geometry)
merge_2 = Merge(Data1=join_curves_2, Data2=join_curves)

# ----
network_surface = NetworkSurface(CurvesU=merge, CurvesV=merge_2, Continuity=2)

# ---- group: Include Points along Edges
brep_edges = BrepEdges(Brep=network_surface)  # -> Naked, Interior, NonManifold
join_curves_3 = JoinCurves(Curves=brep_edges.Naked, Preserve=False)
divide_curve = DivideCurve(Curve=join_curves_3, Count=Slider(100, range=0..100), Kinks=False)  # -> Points, Tangents, Parameters

# ----
move = Move(Geometry=network_surface, Motion=unit_x_2)  # -> Geometry, Transform

# ---- group: Random Points on Surface
populate_geometry = PopulateGeometry(Geometry=network_surface, Count=Slider(200, range=0..1000), Seed=1)

# ----
custom_preview = CustomPreview(Geometry=move.Geometry, Material=ColourSwatch(SwatchColor=RGB(150, 247, 255)))

# ---- group: Make Mesh
xz_plane = XZPlane(Origin=Point(0, 0, 0))
delaunay_mesh = DelaunayMesh(Points=flatten([populate_geometry, divide_curve.Points]), Plane=xz_plane)

# ---- group: Generate Random Values for Each Face
deconstruct_mesh = DeconstructMesh(Mesh=delaunay_mesh)  # -> Vertices, Faces, Colours, Normals
list_length = ListLength(List=deconstruct_mesh.Faces)
random = Random(Range=Slider(0.5, range=0..1), Number=list_length, Seed=2)

# ---- group: Spikes!
weaverbird_s_stellate_cumulation = WeaverbirdsStellateCumulation(MeshPolylines=delaunay_mesh, Distance=random)

# ----
custom_preview_2 = CustomPreview(Geometry=weaverbird_s_stellate_cumulation, Material=ColourSwatch(SwatchColor=RGB(86, 148, 255)))
