# Grasshopper definition pleat-definition.gh (Grasshopper 1.0.7)

# ---- group: Random Datapoints
number_of_data_points = Slider(31, range=0..100)
random = Random(Range=Domain(0, 1), Number=number_of_data_points, Seed=2)

# ---- group: Generate Folding Angle
fold_angle = Slider(32, range=0..100)
radians = Radians(Degrees=fold_angle)
unit_z = UnitZ(Factor=1)
negative = Negative(Value=radians)
xz_plane = XZPlane(Origin=Point(0, 0, 0))
rotate = Rotate(Geometry=unit_z, Angle=negative, Plane=xz_plane)  # -> Geometry, Transform

# ---- group: Spread Out Data
length_of_folded_strip = Slider(22, range=0..100)
range = Range(Domain=length_of_folded_strip, Steps=expr("x-1", number_of_data_points))

# ---- group: Draw outwards-facing pleat edges
construct_point = ConstructPoint(XCoordinate=range, YCoordinate=0, ZCoordinate=0)
line_sdl = LineSDL(Start=construct_point, Direction=rotate.Geometry, Length=random)

# ---- group: Draw hidden pleat edges
shift_list = ShiftList(List=line_sdl, Shift=1, Wrap=False)
end_points = EndPoints(Curve=line_sdl)  # -> Start, End
end_points_2 = EndPoints(Curve=shift_list)  # -> Start, End
line = Line(StartPoint=end_points.End, EndPoint=end_points_2.Start)

# ----
strip_width = Slider(6, range=0..10)

# ---- group: Pleated / Extrude Paper
join_curves = JoinCurves(Curves=flatten([line, line_sdl]), Preserve=False)
unit_y = UnitY(Factor=strip_width)
extrude = Extrude(Base=join_curves, Direction=unit_y)

# ---- group: Shift Folded Pattern Back for Visibility
addition = Addition(A=strip_width, B=Slider(2.5, range=0..10))

# ---- group: Plot Fold Lines
length = Length(Curve=line)
weave = Weave(Pattern=[0, 1], Stream0=random, Stream1=length, NullGaps=False)
mass_addition = MassAddition(Input=weave)  # -> Result, PartialResults
insert_items = InsertItems(List=mass_addition.PartialResults, Item=0, Indices=0, Wrap=True)
construct_point_2 = ConstructPoint(XCoordinate=insert_items, YCoordinate=addition, ZCoordinate=0)

# ---- group: Pleated / Color Alternating Fold Edges
brep_edges = BrepEdges(Brep=extrude)  # -> Naked, Interior, NonManifold
shift_list_2 = ShiftList(List=brep_edges.Interior, Shift=1, Wrap=True)
dispatch = Dispatch(List=shift_list_2, DispatchPattern=[True, False])  # -> ListA, ListB
custom_preview = CustomPreview(Geometry=dispatch.ListA, Material=ColourSwatch(SwatchColor=RGB(0, 68, 255)))
custom_preview_2 = CustomPreview(Geometry=dispatch.ListB, Material=ColourSwatch(SwatchColor=RGB(255, 48, 48)))

# ---- group: Color Alternating Fold Lines
unit_y_2 = UnitY(Factor=1)
line_sdl_2 = LineSDL(Start=construct_point_2, Direction=unit_y_2, Length=strip_width)
dispatch_2 = Dispatch(List=line_sdl_2, DispatchPattern=[True, False])  # -> ListA, ListB
custom_preview_3 = CustomPreview(Geometry=dispatch_2.ListA, Material=ColourSwatch(SwatchColor=RGB(0, 68, 255)))
custom_preview_4 = CustomPreview(Geometry=dispatch_2.ListB, Material=ColourSwatch(SwatchColor=RGB(255, 48, 48)))

# ---- group: Pleated
custom_preview_5 = CustomPreview(Geometry=extrude, Material=ColourSwatch(SwatchColor=RGB(217, 217, 217)))

# ----
loft = Loft(Curves=line_sdl_2, Options={Adjust=False, Closed=False, LoftEnds=0, LoftSimp=0, LoftType=0, Rebuild=10, Refit=0.01})
custom_preview_6 = CustomPreview(Geometry=loft, Material=ColourSwatch(SwatchColor=RGB(217, 217, 217)))
