# Grasshopper definition sakura-definition.gh (Grasshopper 1.0.7)

construct_domain = ConstructDomain(DomainStart=Slider(0.7, range=0..1), DomainEnd=Slider(1, range=0..1))

number_slider = Slider(20, range=0..100)
random = Random(Range=construct_domain, Number=number_slider, Seed=222)

construct_point = ConstructPoint(XCoordinate=0, YCoordinate=0, ZCoordinate=0)

# ---- group: Build Section of Circle for Data Manipulation
circle_cnr = CircleCNR(Center=construct_point, Normal=Vector(0, 0, 1), Radius=Slider(0.05, range=0..1))
shatter = Shatter(Curve=reparameterize(circle_cnr), Parameters=[Slider(0.15, range=0..1), Slider(0.35, range=0..1)])
list_item = ListItem(List=shatter, Index=0, Wrap=True)

# ---- group: Draw Data as Radial Lines
divide_curve = DivideCurve(Curve=list_item, Count=number_slider, Kinks=False)  # -> Points, Tangents, Parameters
vector_2pt = Vector2Pt(PointA=construct_point, PointB=divide_curve.Points, Unitize=False)  # -> Vector, Length
line_sdl = LineSDL(Start=construct_point, Direction=vector_2pt.Vector, Length=random)

# ---- group: Build Bottom of Petal
end_points = EndPoints(Curve=list_item)  # -> Start, End
construct_point_2 = ConstructPoint(XCoordinate=0, YCoordinate=Slider(0.034, range=0..1), ZCoordinate=0)
arc_3pt = Arc3Pt(PointA=end_points.End, PointB=construct_point_2, PointC=end_points.Start)  # -> Arc, Plane, Radius

# ---- group: Draw Petal Outline
end_points_2 = EndPoints(Curve=line_sdl)  # -> Start, End
nurbs_curve = NurbsCurve(Vertices=end_points_2.End, Degree=3, Periodic=False)  # -> Curve, Length, Domain

# ----
cull_index = CullIndex(List=line_sdl, Indices=-1, Wrap=True)
shift_list = ShiftList(List=line_sdl, Shift=1, Wrap=False)
end_points_3 = EndPoints(Curve=cull_index)  # -> Start, End
end_points_4 = EndPoints(Curve=shift_list)  # -> Start, End

number_slider_2 = Slider(0.22, range=0..1)
blend_curve = BlendCurve(CurveA=nurbs_curve.Curve, CurveB=arc_3pt.Arc, BulgeA=number_slider_2, BulgeB=number_slider_2, Continuity=1)
blend_curve_2 = BlendCurve(CurveA=arc_3pt.Arc, CurveB=nurbs_curve.Curve, BulgeA=number_slider_2, BulgeB=number_slider_2, Continuity=1)
join_curves = JoinCurves(Curves=flatten([blend_curve, blend_curve_2, nurbs_curve.Curve, arc_3pt.Arc]), Preserve=False)

# ---- group: Draw Small Arcs Connecting Sets of Lines
unit_z = UnitZ(Factor=1)
arc_sed = ArcSED(Start=end_points_3.End, End=end_points_4.End, Direction=unit_z)  # -> Arc, Plane, Radius

# ---- group: Cluster Geometry Together and Create Edge Surfaces
weave = Weave(Pattern=[0, 1, 2], Stream0=cull_index, Stream1=shift_list, Stream2=arc_sed.Arc, NullGaps=False)
partition_list = PartitionList(List=weave, Size=3)
list_item_2 = ListItem(List=partition_list, Index=0, Wrap=True)  # -> Item, Item1, Item2
edge_surface = EdgeSurface(CurveA=list_item_2.Item, CurveB=list_item_2.Item1, CurveC=list_item_2.Item2)

# ---- group: Divide Curve for 3D Projection
divide_curve_2 = DivideCurve(Curve=join_curves, Count=Slider(100, range=0..100), Kinks=False)  # -> Points, Tangents, Parameters

# ---- group: 2D Curve
curve = Curve(join_curves)

# ---- group: Shift Over
unit_x = UnitX(Factor=Slider(1.3, range=0..10))
move = Move(Geometry=curve, Motion=unit_x)  # -> Geometry, Transform

# ----
brep_join = BrepJoin(Breps=flatten(edge_surface))  # -> Breps, Closed
deconstruct = Deconstruct(Point=divide_curve_2.Points)  # -> XComponent, YComponent, ZComponent

# ---- group: Shift over
unit_x_2 = UnitX(Factor=Slider(2.8, range=0..10))
move_2 = Move(Geometry=brep_join.Breps, Motion=unit_x_2)  # -> Geometry, Transform

# ---- group: 3D
graph_mapper = GraphMapper(deconstruct.XComponent, x0=-0.75, x1=0.75, y0=0, y1=2, container_name="Bezier", cpx=[0, 0, 1, 1], cpy=[0, 1, 1, 0])
graph_mapper_2 = GraphMapper(
    deconstruct.YComponent,
    x0=0,
    x1=1,
    y0=0,
    y1=1,
    container_name="Bezier",
    cpx=[0, 0.1292070001, 0.5704292655, 1],
    cpy=[0, 0.448153317, 0.9249873757, 0.899789989])
multiplication = Multiplication(A=graph_mapper, B=graph_mapper_2)
multiplication_2 = Multiplication(A=multiplication, B=Slider(0.52, range=0..1))

# ----
custom_preview = CustomPreview(Geometry=move.Geometry, Material=ColourSwatch(SwatchColor=RGB(179, 95, 255)))
custom_preview_2 = CustomPreview(Geometry=move_2.Geometry, Material=ColourSwatch(SwatchColor=RGB(179, 95, 255)))

# ---- group: 3D Contour
construct_point_3 = ConstructPoint(XCoordinate=deconstruct.XComponent, YCoordinate=deconstruct.YComponent, ZCoordinate=multiplication_2)
interpolate = Interpolate(Vertices=construct_point_3, Degree=3, Periodic=True, KnotStyle=1)  # -> Curve, Length, Domain

# ----
patch = Patch(Curves=interpolate.Curve, Spans=20, Flexibility=1, Trim=True)
custom_preview_3 = CustomPreview(Geometry=patch, Material=ColourSwatch(SwatchColor=RGB(179, 95, 255)))
