# Grasshopper definition spider-definition.gh (Grasshopper 1.0.7)

# ---- group: Random 2d Dataset
number_of_columns = Slider(6, range=0..10)
number_of_rows = Slider(13, range=0..100)
series = Series(Start=0, Step=1, Count=number_of_rows)
random = Random(Range=Domain(0, 1), Number=number_of_columns, Seed=series)  # -> simplify(Random)

# ---- group: Min and Max of Polygon for Plots
construct_domain = ConstructDomain(DomainStart=Slider(0.1, range=0..1), DomainEnd=Slider(1, range=0..1))

# ---- group: 2D Array
number = Number(random)

# ---- group: Build and SubDivide Circle based on Column Count
construct_point = ConstructPoint(XCoordinate=0, YCoordinate=0, ZCoordinate=0)
circle_cnr = CircleCNR(Center=construct_point, Normal=Vector(0, 0, 1), Radius=1)
list_length = ListLength(List=number)
divide_curve = DivideCurve(Curve=circle_cnr, Count=list_length, Kinks=False)  # -> Points, Tangents, Parameters

# ---- group: Find Min and Max of Each Column and Remap Data to Desired Sizes
flip_matrix = FlipMatrix(Data=number)
bounds = Bounds(Numbers=flip_matrix)
remap_numbers = RemapNumbers(Value=flip_matrix, Source=bounds, Target=construct_domain)  # -> Mapped, Clipped
flip_matrix_2 = FlipMatrix(Data=remap_numbers.Mapped)

# ---- group: Create Radial Points Based on Data
vector_2pt = Vector2Pt(PointA=construct_point, PointB=divide_curve.Points, Unitize=False)  # -> Vector, Length
amplitude = Amplitude(Vector=vector_2pt.Vector, Amplitude=flip_matrix_2)
move = Move(Geometry=construct_point, Motion=amplitude)  # -> Geometry, Transform

# ---- group: Draw Outside Polygon
polyline = PolyLine(Vertices=divide_curve.Points, Closed=True)

# ----
polyline_2 = PolyLine(Vertices=move.Geometry, Closed=True)

# ---- group: Generate Spacing Vectors
per_element_spacing = Slider(2.5, range=0..10)
tree_statistics = TreeStatistics(Tree=polyline_2)  # -> Paths, Length, Count
series_2 = Series(Start=0, Step=per_element_spacing, Count=tree_statistics.Count)
unit_x = UnitX(Factor=series_2)
graft_tree = GraftTree(Tree=unit_x, IncludeEmptyLists=True, IncludeNullItems=True)  # -> simplify(Tree)

# ---- group: Draw Internal Lines
line = Line(StartPoint=construct_point, EndPoint=move.Geometry)

# ---- group: Outside Polygons
move_2 = Move(Geometry=polyline, Motion=graft_tree)  # -> Geometry, Transform

# ---- group: Spider Plots
move_3 = Move(Geometry=polyline_2, Motion=graft_tree)  # -> Geometry, Transform
boundary_surfaces = BoundarySurfaces(Edges=move_3.Geometry)

# ---- group: Internal Lines
move_4 = Move(Geometry=line, Motion=graft_tree)  # -> Geometry, Transform

# ----
custom_preview = CustomPreview(Geometry=move_4.Geometry, Material=ColourSwatch(SwatchColor=RGB(69, 55, 122)))
custom_preview_2 = CustomPreview(Geometry=move_2.Geometry, Material=ColourSwatch(SwatchColor=RGB(255, 255, 255)))
custom_preview_3 = CustomPreview(Geometry=boundary_surfaces, Material=ColourSwatch(SwatchColor=RGB(95, 217, 192)))
