# Grasshopper definition stacked-area-definition.gh (Grasshopper 1.0.7)

count = Slider(10, range=0..10)
columns = Slider(5, range=0..10)
series = Series(Start=0, Step=1, Count=count)
random = Random(Range=Domain(0, 1), Number=columns, Seed=series)

# ---- group: Generate Stacked Values
mass_addition = MassAddition(Input=random)  # -> Result, PartialResults

# ---- group: Generate Anchor Points along X-axis
spacing = Slider(1.2, range=0..10)
series_2 = Series(Start=0, Step=spacing, Count=count)
construct_point = ConstructPoint(XCoordinate=series_2, YCoordinate=0, ZCoordinate=0)

# ---- group: Remap to 0->1
bounds = Bounds(Numbers=mass_addition.PartialResults)
remap_numbers = RemapNumbers(Value=mass_addition.PartialResults, Source=bounds, Target=Domain(0, 1))  # -> Mapped, Clipped

# ---- group: Draw Plot Axes
height = Slider(5.5, range=0..10)
unit_y = UnitY(Factor=1)
line_sdl = LineSDL(Start=construct_point, Direction=unit_y, Length=height)

# ---- group: Plot Data Lines
graft_tree = GraftTree(Tree=line_sdl, IncludeEmptyLists=True, IncludeNullItems=True)
evaluate_curve = EvaluateCurve(Curve=graft_tree, Parameter=remap_numbers.Mapped)  # -> Point, Tangent, Angle
flip_matrix = FlipMatrix(Data=evaluate_curve.Point)
polyline = PolyLine(Vertices=flip_matrix, Closed=False)

# ---- group: Generate Bounding Surface
bounding_box = BoundingBox(Content=line_sdl, Plane=PlaneXY(0, 0, 0), UnionBox=True)  # -> Box, Box_2
surface = Surface(bounding_box.Box)

# ---- group: Slice surface with Line Plots
flatten_tree = FlattenTree(Tree=polyline, Path="{0}")
surface_split = SurfaceSplit(Surface=surface, Curves=flatten_tree)

# ---- group: Sample Gradient
area = Area(Geometry=surface_split)  # -> Area, Centroid
bounds_2 = Bounds(Numbers=area.Area)
remap_numbers_2 = RemapNumbers(Value=area.Area, Source=bounds_2, Target=Domain(0, 1))  # -> Mapped, Clipped
gradient = Gradient(
    LowerLimit=0,
    UpperLimit=1,
    Parameter=remap_numbers_2.Mapped,
    stops=[0: RGB(0, 98, 0), 0.25: RGB(81, 175, 17), 0.5: RGB(159, 198, 146), 0.75: RGB(170, 235, 41), 1: RGB(221, 255, 53)])

# ----
custom_preview = CustomPreview(Geometry=surface_split, Material=gradient)
