# Grasshopper definition terrains-definition.gh (Grasshopper 1.0.7)
# plug-ins: Weaverbird

number_slider = Slider(10.8, range=0..20)
construct_point = ConstructPoint(XCoordinate=number_slider, YCoordinate=Slider(4, range=0..10), ZCoordinate=Slider(5.5, range=0..10))
construct_point_2 = ConstructPoint(XCoordinate=number_slider, YCoordinate=0, ZCoordinate=Slider(5.1, range=0..10))
line = Line(StartPoint=construct_point_2, EndPoint=construct_point)

number_slider_2 = Slider(15.7, range=0..20)

construct_point_3 = ConstructPoint(XCoordinate=number_slider_2, YCoordinate=Slider(5, range=0..10), ZCoordinate=Slider(5.5, range=0..10))
construct_point_4 = ConstructPoint(XCoordinate=number_slider_2, YCoordinate=0, ZCoordinate=Slider(2.7, range=0..10))
line_2 = Line(StartPoint=construct_point_4, EndPoint=construct_point_3)

# ---- group: Simple mesh plane
number_slider_3 = Slider(4, range=0..10)
number_slider_4 = Slider(12, range=0..100)
number_slider_5 = Slider(10, range=0..10)
rectangle = Rectangle(Plane=PlaneXY(0, 0, 0), XSize=number_slider_3, YSize=number_slider_3, Radius=0)  # -> Rectangle, Length
mesh_plane = MeshPlane(Boundary=rectangle.Rectangle, WidthCount=number_slider_5, HeightCount=number_slider_4)  # -> Mesh, Area

# ---- group: Random number for each vertex
multiplication = Multiplication(A=number_slider_5, B=number_slider_4)
random = Random(Range=Domain(0, 1), Number=multiplication, Seed=2)

# ---- group: Spiky!
weaverbird_s_stellate_cumulation = WeaverbirdsStellateCumulation(MeshPolylines=mesh_plane.Mesh, Distance=random)

# ---- group: Twisting Surface
ruled_surface = RuledSurface(CurveA=line, CurveB=line_2)

# ---- group: Generate Random Numbers
number_slider_6 = Slider(12, range=0..100)
number_slider_7 = Slider(20, range=0..100)
multiplication_2 = Multiplication(A=number_slider_6, B=number_slider_7)
random_2 = Random(Range=Domain(0, 1), Number=multiplication_2, Seed=2)

# ---- group: Smooth
weaverbird_s_catmull_clark_subdivision = WeaverbirdsCatmullClarkSubdivision(MeshCurves=weaverbird_s_stellate_cumulation, Level=Slider(2, range=0..10), SmoothNakedEdges=1)

# ---- group: Generate Lamination Lines
thickness = Slider(0.06, range=0..1)
unit_z = UnitZ(Factor=1)
contour = Contour(Shape=weaverbird_s_catmull_clark_subdivision, Point=Point(0, 0, 0), Direction=unit_z, Distance=thickness)

# ---- group: Move Over
unit_x = UnitX(Factor=Slider(4.295, range=0..10))
move = Move(Geometry=contour, Motion=unit_x)  # -> Geometry, Transform

# ---- group: Flip 'front' of Surface
direction = Slider(-1, range=-1..1)
multiplication_3 = Multiplication(A=random_2, B=direction)

# ---- group: Partition Surface
divide_domain² = DivideDomain²(Domain=ruled_surface, UCount=number_slider_6, VCount=number_slider_7)
surface_box = SurfaceBox(Surface=ruled_surface, Domain=divide_domain², Height=multiplication_3)

# ---- group: Extrude and Cap
unit_z_2 = UnitZ(Factor=thickness)
extrude = Extrude(Base=move.Geometry, Direction=unit_z_2)
cap_holes = CapHoles(Brep=extrude)

# ----
custom_preview = CustomPreview(Geometry=weaverbird_s_catmull_clark_subdivision, Material=ColourSwatch(SwatchColor=RGB(89, 179, 255)))

# ---- group: Build small Pyramid
md_slider = MDSlider(
    SliderMode=0,
    slider_value=Point(0.8670341678, 0.8009673328, 0.5),
    x_domain=Domain(0, 1),
    y_domain=Domain(0, 1),
    z_domain=Domain(0, 1))
number_slider_8 = Slider(1, range=0..1)
construct_point_5 = ConstructPoint(XCoordinate=0, YCoordinate=0, ZCoordinate=0)
deconstruct = Deconstruct(Point=md_slider)  # -> XComponent, YComponent, ZComponent
rectangle_2 = Rectangle(Plane=construct_point_5, XSize=number_slider_8, YSize=number_slider_8, Radius=0)  # -> Rectangle, Length
construct_point_6 = ConstructPoint(XCoordinate=deconstruct.XComponent, YCoordinate=deconstruct.YComponent, ZCoordinate=1)
extrude_point = ExtrudePoint(Base=rectangle_2.Rectangle, Point=construct_point_6)

# ----
custom_preview_2 = CustomPreview(Geometry=cap_holes, Material=ColourSwatch(SwatchColor=RGB(133, 108, 255)))

# ---- group: Move Over
unit_x_2 = UnitX(Factor=Slider(10, range=0..10))
move_2 = Move(Geometry=extrude_point, Motion=unit_x_2)  # -> Geometry, Transform

# ----
bounding_box = BoundingBox(Content=move_2.Geometry, Plane=PlaneXY(0, 0, 0))  # -> Box, Box_2

# ---- group: Morph Geometry into Surface Boxeds
box_morph = BoxMorph(Geometry=move_2.Geometry, Reference=bounding_box.Box, Target=surface_box)

# ----
custom_preview_3 = CustomPreview(Geometry=box_morph, Material=ColourSwatch(SwatchColor=RGB(171, 105, 255)))
