# Grasshopper definition twistar-definition.gh (Grasshopper 1.0.7)

star_outer_point_count = Slider(8, range=0..10)

# ---- group: Base Polygon
polygon = Polygon(Plane=PlaneXY(0, 0, 0), Radius=3, Segments=star_outer_point_count, FilletRadius=0)  # -> Polygon, Length

# ---- group: Inner Points
inner_point_scale_factor = Slider(0.5, range=0..1)
pi = Pi(Factor=1)
scale = Scale(Geometry=polygon.Polygon, Center=Point(0, 0, 0), Factor=inner_point_scale_factor)  # -> Geometry, Transform
division = Division(A=pi, B=star_outer_point_count)
rotate = Rotate(Geometry=scale.Geometry, Angle=division, Plane=PlaneXY(0, 0, 0))  # -> Geometry, Transform

# ---- group: Build Star
discontinuity = Discontinuity(Curve=polygon.Polygon, Level=1)  # -> Points, Parameters
discontinuity_2 = Discontinuity(Curve=rotate.Geometry, Level=1)  # -> Points, Parameters
weave = Weave(Pattern=[0, 1], Stream0=discontinuity.Points, Stream1=discontinuity_2.Points, NullGaps=False)
polyline = PolyLine(Vertices=weave, Closed=True)

# ----
number_of_stars = Slider(12, range=0..100)

# ---- group: Create Scaled Copies
end_scale_factor = Slider(0.25, range=0..1)
base_scale_factor = Slider(1, range=0..1)
construct_domain = ConstructDomain(DomainStart=base_scale_factor, DomainEnd=end_scale_factor)
range = Range(Domain=construct_domain, Steps=number_of_stars)
scale_2 = Scale(Geometry=polyline, Center=Point(0, 0, 0), Factor=range)  # -> Geometry, Transform

# ---- group: Rotate Copies Incrementally
max_rotation = Slider(60, range=0..100)
radians = Radians(Degrees=max_rotation)
range_2 = Range(Domain=radians, Steps=number_of_stars)
rotate_2 = Rotate(Geometry=scale_2.Geometry, Angle=range_2, Plane=PlaneXY(0, 0, 0))  # -> Geometry, Transform

# ---- group: Move Copies Up Incrementally
overall_height = Slider(2, range=0..10)
range_3 = Range(Domain=overall_height, Steps=number_of_stars)
unit_z = UnitZ(Factor=range_3)
move = Move(Geometry=rotate_2.Geometry, Motion=unit_z)  # -> Geometry, Transform

# ---- group: Generate Smooth Version
loft = Loft(Curves=move.Geometry, Options={Adjust=False, Closed=False, LoftEnds=0, LoftSimp=0, LoftType=0, Rebuild=10, Refit=0.01})
cap_holes = CapHoles(Brep=loft)

# ---- group: Generate Layered Version
list_item = ListItem(List=unit_z, Index=1, Wrap=True)
extrude = Extrude(Base=move.Geometry, Direction=list_item)
cap_holes_2 = CapHoles(Brep=extrude)

# ---- group: Shift Over
unit_x = UnitX(Factor=Slider(8.4, range=0..10))
move_2 = Move(Geometry=cap_holes, Motion=unit_x)  # -> Geometry, Transform

# ---- group: Generate Colors
volume = Volume(Geometry=cap_holes_2)  # -> Volume, Centroid
bounds = Bounds(Numbers=volume.Volume)
remap_numbers = RemapNumbers(Value=volume.Volume, Source=bounds, Target=Domain(0, 1))  # -> Mapped, Clipped
gradient = Gradient(LowerLimit=0, UpperLimit=1, Parameter=remap_numbers.Mapped, stops=[0.15: RGB(255, 130, 160), 0.85: RGB(0, 145, 146)])

# ----
custom_preview = CustomPreview(Geometry=move_2.Geometry, Material=ColourSwatch(SwatchColor=RGB(194, 99, 173)))
custom_preview_2 = CustomPreview(Geometry=cap_holes_2, Material=gradient)
