# Grasshopper definition data-helix-definition.gh (Grasshopper 1.0.7)

samples = Slider(100, range=0..100)

spins = Slider(4.7, range=0..10)
pi = Pi(Factor=2)
multiplication = Multiplication(A=pi, B=spins)
range = Range(Domain=multiplication, Steps=samples)
cosine = Cosine(Value=range)
sine = Sine(Value=range)

# ---- group: Helix Taper
construct_domain = ConstructDomain(DomainStart=Slider(2.6, range=0..10), DomainEnd=Slider(5.4, range=0..10))
range_2 = Range(Domain=construct_domain, Steps=samples)

# ---- group: Increase in Height
height = Slider(16.22, range=0..20)
range_3 = Range(Domain=height, Steps=samples)

# ----
data_count = Slider(45, range=0..100)

# ---- group: Build Helix
multiplication_2 = Multiplication(A=sine, B=range_2)
multiplication_3 = Multiplication(A=cosine, B=range_2)
construct_point = ConstructPoint(XCoordinate=multiplication_3, YCoordinate=multiplication_2, ZCoordinate=range_3)
interpolate = Interpolate(Vertices=construct_point, Degree=3, Periodic=False, KnotStyle=1)  # -> Curve, Length, Domain

# ---- group: Remap Data
random = Random(Range=Domain(0, 1), Number=data_count, Seed=2)
construct_domain_2 = ConstructDomain(DomainStart=Slider(4.4, range=0..10), DomainEnd=Slider(8.5, range=0..10))
bounds = Bounds(Numbers=random)
remap_numbers = RemapNumbers(Value=random, Source=bounds, Target=construct_domain_2)  # -> Mapped, Clipped

random_2 = Random(Range=Domain(0, 1), Number=data_count, Seed=4)
construct_domain_3 = ConstructDomain(DomainStart=Slider(1.2, range=0..10), DomainEnd=Slider(2, range=0..10))
bounds_2 = Bounds(Numbers=random_2)
remap_numbers_2 = RemapNumbers(Value=random_2, Source=bounds_2, Target=construct_domain_3)  # -> Mapped, Clipped

# ---- group: Cut up Helix into Evenly Split Points
divide_curve = DivideCurve(Curve=interpolate.Curve, Count=data_count, Kinks=False)  # -> Points, Tangents, Parameters

# ---- group: Create Vectors Pointing from Center Line to Helix
deconstruct = Deconstruct(Point=divide_curve.Points)  # -> XComponent, YComponent, ZComponent
construct_point_2 = ConstructPoint(XCoordinate=0, YCoordinate=0, ZCoordinate=deconstruct.ZComponent)
vector_2pt = Vector2Pt(PointA=construct_point_2, PointB=divide_curve.Points, Unitize=False)  # -> Vector, Length

# ---- group: Draw Radiating Outwards Lines
line_sdl = LineSDL(Start=divide_curve.Points, Direction=vector_2pt.Vector, Length=remap_numbers.Mapped)

# ---- group: Draw Radiating Inwards Lines
line_sdl_2 = LineSDL(Start=divide_curve.Points, Direction=expr("-x", vector_2pt.Vector), Length=remap_numbers_2.Mapped)

# ---- group: Generate Planes Perpendicular to Helix
unit_z = UnitZ(Factor=1)
construct_plane = ConstructPlane(Origin=divide_curve.Points, XAxis=line_sdl, YAxis=unit_z)

# ----
join_curves = JoinCurves(Curves=[line_sdl_2, line_sdl], Preserve=False)

# ---- group: Rotate and Join Inside and Outside Lines
radians = Radians(Degrees=Slider(-30, range=-180..180))
rotate = Rotate(Geometry=line_sdl, Angle=radians, Plane=construct_plane)  # -> Geometry, Transform
rotate_2 = Rotate(Geometry=line_sdl_2, Angle=radians, Plane=construct_plane)  # -> Geometry, Transform
join_curves_2 = JoinCurves(Curves=[rotate.Geometry, rotate_2.Geometry], Preserve=False)

# ---- group: Draw Inside Helix
end_points = EndPoints(Curve=line_sdl_2)  # -> Start, End
interpolate_2 = Interpolate(Vertices=end_points.End, Degree=3, Periodic=False, KnotStyle=1)  # -> Curve, Length, Domain

# ----
join_curves_3 = JoinCurves(Curves=[rotate.Geometry, rotate_2.Geometry], Preserve=False)

# ---- group: Single Data Point
sweep1 = Sweep1(Rail=interpolate.Curve, Sections=rotate.Geometry, Miter=1)
custom_preview = CustomPreview(Geometry=sweep1, Material=ColourSwatch(SwatchColor=RGB(69, 166, 255)))

# ---- group: Double Data Point
sweep2 = Sweep2(Rail1=interpolate.Curve, Rail2=interpolate_2.Curve, Sections=join_curves_2, SameHeight=False)
custom_preview_2 = CustomPreview(Geometry=sweep2, Material=ColourSwatch(SwatchColor=RGB(162, 207, 255)))
