# Grasshopper definition data-prisms-definition.gh (Grasshopper 1.0.7)

radius = Slider(5.5, range=0..10)

# ---- group: Top Polygon
height = Slider(8.7, range=0..10)
construct_point = ConstructPoint(XCoordinate=0, YCoordinate=0, ZCoordinate=height)
polygon = Polygon(Plane=construct_point, Radius=radius, Segments=6, FilletRadius=0)  # -> Polygon, Length

# ----
nutrition = Panel(""".55
.25
.76
.44
.03
.99""")

# ---- group: Bottom Polygon
polygon_2 = Polygon(Plane=PlaneXY(0, 0, 0), Radius=radius, Segments=6, FilletRadius=0)  # -> Polygon, Length

# ----
multiplication = Multiplication(A=nutrition, B=height)

# ---- group: Create Raised Points at Middle of Form with Data
discontinuity = Discontinuity(Curve=polygon_2.Polygon, Level=1)  # -> Points, Parameters
deconstruct = Deconstruct(Point=discontinuity.Points)  # -> XComponent, YComponent, ZComponent
construct_point_2 = ConstructPoint(XCoordinate=deconstruct.XComponent, YCoordinate=deconstruct.YComponent, ZCoordinate=multiplication)

# ---- group: Find average of nutrition points to be center of Mating Surface
average = Average(Input=multiplication)
construct_point_3 = ConstructPoint(XCoordinate=0, YCoordinate=0, ZCoordinate=average)

# ----
calories = Panel(".65")

# ---- group: Draw Nutrtiion Outline and Scale Based on Data from Center
polyline = PolyLine(Vertices=construct_point_2, Closed=True)
scale = Scale(Geometry=polyline, Center=construct_point_3, Factor=calories)  # -> Geometry, Transform

# ---- group: Create Bottom Walls
ruled_surface = RuledSurface(CurveA=scale.Geometry, CurveB=polygon_2.Polygon)

# ---- group: Create Mating Surface
extrude_point = ExtrudePoint(Base=scale.Geometry, Point=construct_point_3)

# ---- group: Create Top Walls
ruled_surface_2 = RuledSurface(CurveA=scale.Geometry, CurveB=polygon.Polygon)

# ----
unit_x = UnitX(Factor=Slider(20, range=0..100))

# ---- group: Join and Cap
brep_join = BrepJoin(Breps=[extrude_point, ruled_surface])  # -> Breps, Closed
brep_join_2 = BrepJoin(Breps=[ruled_surface_2, extrude_point])  # -> Breps, Closed
cap_holes = CapHoles(Brep=brep_join_2.Breps)
cap_holes_2 = CapHoles(Brep=brep_join.Breps)

# ---- group: Move and Flip
move = Move(Geometry=cap_holes, Motion=expr("x*1.75", unit_x))  # -> Geometry, Transform
volume = Volume(Geometry=move.Geometry)  # -> Volume, Centroid
pi = Pi(Factor=1)
yz_plane = YZPlane(Origin=volume.Centroid)
rotate = Rotate(Geometry=move.Geometry, Angle=pi, Plane=yz_plane)  # -> Geometry, Transform
move_to_plane = MoveToPlane(Geometry=rotate.Geometry, Plane=PlaneXY(0, 0, 0), Above=True, Below=True)  # -> Geometry, Transform

# ---- group: Move over
move_2 = Move(Geometry=cap_holes_2, Motion=unit_x)  # -> Geometry, Transform

# ----
custom_preview = CustomPreview(Geometry=cap_holes_2, Material=ColourSwatch(SwatchColor=RGB(141, 91, 255)))
custom_preview_2 = CustomPreview(Geometry=cap_holes, Material=ColourSwatch(SwatchColor=RGB(61, 226, 255)))
custom_preview_3 = CustomPreview(Geometry=move_2.Geometry, Material=ColourSwatch(SwatchColor=RGB(141, 91, 255)))
custom_preview_4 = CustomPreview(Geometry=move_to_plane.Geometry, Material=ColourSwatch(SwatchColor=RGB(61, 226, 255)))
