# Grasshopper definition dataesthetic-choice-definition.gh (Grasshopper 1.0.7)

# ---- group: Generate Random Data
number_slider = Slider(50, range=0..100)
random = Random(Range=Domain(0, 1), Number=number_slider, Seed=2)

# ---- group: Remap
min_height = Slider(0.25, range=0..1)
max_height = Slider(0.85, range=0..1)
construct_domain = ConstructDomain(DomainStart=min_height, DomainEnd=max_height)
bounds = Bounds(Numbers=random)
remap_numbers = RemapNumbers(Value=random, Source=bounds, Target=construct_domain)  # -> Mapped, Clipped

# ---- group: Spread Out data on Single Axis
width = Slider(20, range=0..100)
range = Range(Domain=width, Steps=number_slider)

# ---- group: Map to Integers
construct_domain_2 = ConstructDomain(DomainStart=Slider(3, range=0..10), DomainEnd=Slider(10, range=0..10))
bounds_2 = Bounds(Numbers=random)
remap_numbers_2 = RemapNumbers(Value=random, Source=bounds_2, Target=construct_domain_2)  # -> Mapped, Clipped
round = Round(Number=remap_numbers_2.Mapped)  # -> Nearest, Floor, Ceiling

# ---- group: Make Point for Data
construct_point = ConstructPoint(XCoordinate=range, YCoordinate=remap_numbers.Mapped, ZCoordinate=0)

# ----
bounding_box = BoundingBox(Content=construct_point, Plane=PlaneXY(0, 0, 0), UnionBox=True)  # -> Box, Box_2

# ---- group: Polygons
deconstruct = Deconstruct(Point=construct_point)  # -> XComponent, YComponent, ZComponent
construct_point_2 = ConstructPoint(XCoordinate=deconstruct.XComponent, YCoordinate=Slider(0.5, range=0..1), ZCoordinate=0)
polygon = Polygon(Plane=construct_point_2, Radius=Slider(0.13, range=0..1), Segments=round.Nearest, FilletRadius=0)  # -> Polygon, Length
group = Group(Objects=polygon.Polygon)

# ---- group: Color Blocks
deconstruct_2 = Deconstruct(Point=construct_point)  # -> XComponent, YComponent, ZComponent
construct_point_3 = ConstructPoint(XCoordinate=deconstruct_2.XComponent, YCoordinate=0, ZCoordinate=0)
rectangle = Rectangle(Plane=construct_point_3, XSize=Slider(0.4, range=0..1), YSize=Slider(0.5, range=0..1), Radius=0)  # -> Rectangle, Length
gradient = Gradient(
    LowerLimit=0,
    UpperLimit=1,
    Parameter=remap_numbers.Mapped,
    stops=[0: RGB(0, 128, 0), 0.5: RGB(255, 255, 0), 1: RGB(255, 0, 0)])
boundary_surfaces = BoundarySurfaces(Edges=rectangle.Rectangle)
custom_preview = CustomPreview(Geometry=boundary_surfaces, Material=gradient)

# ----
circle_cnr = CircleCNR(Center=construct_point, Normal=Vector(0, 0, 1), Radius=Slider(0.1, range=0..1))
group_2 = Group(Objects=circle_cnr)

# ---- group: Triangulated Mesh
brep_edges = BrepEdges(Brep=bounding_box.Box)  # -> Naked, Interior, NonManifold
join_curves = JoinCurves(Curves=brep_edges.Naked, Preserve=False)
discontinuity = Discontinuity(Curve=join_curves, Level=1)  # -> Points, Parameters
delaunay_mesh = DelaunayMesh(Points=flatten([construct_point, discontinuity.Points]), Plane=PlaneXY(0, 0, 0))

# ---- group: Looser Curve
nurbs_curve = NurbsCurve(Vertices=construct_point, Degree=Slider(5, range=0..10), Periodic=False)  # -> Curve, Length, Domain

# ---- group: Polygonal Cells
voronoi = Voronoi(Points=construct_point, Boundary=bounding_box.Box, BruteForceOverride=False)
group_3 = Group(Objects=voronoi)

# ---- group: Tight Curve
interpolate = Interpolate(Vertices=construct_point, Degree=3, Periodic=False, KnotStyle=1)  # -> Curve, Length, Domain

# ---- group: Line Chart
polyline = PolyLine(Vertices=construct_point, Closed=False)

# ---- group: Loose Curve
nurbs_curve_2 = NurbsCurve(Vertices=construct_point, Degree=3, Periodic=False)  # -> Curve, Length, Domain

# ----
merge = Merge(
    Data1=group_2,
    Data2=polyline,
    Data3=interpolate.Curve,
    Data4=nurbs_curve_2.Curve,
    Data5=nurbs_curve.Curve,
    Data6=group_3,
    Data7=delaunay_mesh,
    Data8=group)  # -> flatten(Result)
value_list = ValueList({"Precise": 0, "Imprecise": 1, "Loose": 2, "Wavey": 3, "Subtle": 4, "Quiet": 5, "Geometric": 6, "Structural": 7, "Infrastuctural": 8}, selected="Geometric")
list_item = ListItem(List=merge, Index=value_list, Wrap=True)
