# Grasshopper definition network-links-definition.gh (Grasshopper 1.0.7)

# ---- group: Random Points on Sphere
node_count = Slider(19, range=0..100)
sphere = Sphere(Base=PlaneXY(0, 0, 0), Radius=Slider(10, range=0..10))
populate_geometry = PopulateGeometry(Geometry=sphere, Count=node_count, Seed=1)

# ---- group: Connect All Points to One Another
cross_reference = CrossReference(ListListA=populate_geometry, ListListB=populate_geometry, CrossMode=5)  # -> ListListA, ListListB
line = Line(StartPoint=cross_reference.ListListA, EndPoint=cross_reference.ListListB)

# ---- group: Random Thickness
construct_domain = ConstructDomain(DomainStart=Slider(0.05, range=0..0.1), DomainEnd=Slider(0.3, range=0..1))
list_length = ListLength(List=line)
random = Random(Range=construct_domain, Number=list_length, Seed=2)

# ---- group: Make Pipes
pipe = Pipe(Curve=line, Radius=random, Caps=0)  # -> flatten(Pipe)
cap_holes = CapHoles(Brep=pipe)

# ---- group: Color Based on Volume
volume = Volume(Geometry=cap_holes)  # -> Volume, Centroid
bounds = Bounds(Numbers=volume.Volume)
remap_numbers = RemapNumbers(Value=volume.Volume, Source=bounds, Target=Domain(0, 1))  # -> Mapped, Clipped
gradient = Gradient(
    LowerLimit=0,
    UpperLimit=1,
    Parameter=remap_numbers.Mapped,
    stops=[0: RGB(0, 98, 0), 0.25: RGB(81, 175, 17), 0.5: RGB(159, 198, 146), 0.75: RGB(170, 235, 41), 1: RGB(221, 255, 53)])

# ----
custom_preview = CustomPreview(Geometry=cap_holes, Material=gradient)
