# Grasshopper definition pattern-attractor-definition.gh (Grasshopper 1.0.7)
# plug-ins: LunchBox

# ---- group: Simplified Footprint
construct_point = ConstructPoint(XCoordinate=Slider(5.6, range=0..10), YCoordinate=Slider(0.1, range=0..10), ZCoordinate=0)
construct_point_2 = ConstructPoint(XCoordinate=Slider(2.5, range=0..10), YCoordinate=Slider(0.3, range=0..10), ZCoordinate=0)
construct_point_3 = ConstructPoint(XCoordinate=Slider(5.5, range=0..10), YCoordinate=Slider(6.7, range=0..10), ZCoordinate=0)
construct_point_4 = ConstructPoint(XCoordinate=Slider(1.3, range=0..10), YCoordinate=Slider(9, range=0..10), ZCoordinate=0)
line = Line(StartPoint=construct_point_2, EndPoint=construct_point)
line_2 = Line(StartPoint=construct_point_4, EndPoint=construct_point_3)
ruled_surface = RuledSurface(CurveA=line, CurveB=line_2)

# ---- group: Attractor Curve
unit_x = UnitX(Factor=Slider(5.5, range=-10..10))
construct_point_5 = ConstructPoint(XCoordinate=Slider(3.8, range=0..10), YCoordinate=Slider(9, range=0..10), ZCoordinate=0)
unit_x_2 = UnitX(Factor=Slider(-3.2, range=-10..10))
construct_point_6 = ConstructPoint(XCoordinate=Slider(3.1, range=0..10), YCoordinate=Slider(0, range=0..1), ZCoordinate=0)
bezier_span = BezierSpan(StartPoint=construct_point_6, StartTangent=unit_x, EndPoint=construct_point_5, EndTangent=unit_x_2)  # -> Curve, Length, Domain

# ---- group: Hexagonal Grid
hexagon_cells = HexagonCells(Surface=ruled_surface, UDivisions=Slider(20, range=0..100), VDivisions=Slider(26, range=0..100), TParameter=0.25)  # -> HexagonCells, Centers

# ---- group: Remap Numbers
curve_closest_point = CurveClosestPoint(Point=hexagon_cells.Centers, Curve=bezier_span.Curve)  # -> Point, Parameter, Distance
construct_domain = ConstructDomain(DomainStart=Slider(0.8, range=0..1), DomainEnd=Slider(0.05, range=0..1))
bounds = Bounds(Numbers=curve_closest_point.Distance)
remap_numbers = RemapNumbers(Value=curve_closest_point.Distance, Source=bounds, Target=construct_domain)  # -> Mapped, Clipped

# ---- group: Scale Based on Distance to Curve
scale = Scale(Geometry=hexagon_cells.HexagonCells, Center=hexagon_cells.Centers, Factor=remap_numbers.Mapped)  # -> Geometry, Transform

# ----
ruled_surface_2 = RuledSurface(CurveA=hexagon_cells.HexagonCells, CurveB=scale.Geometry)
brep_join = BrepJoin(Breps=ruled_surface_2)  # -> Breps, Closed
custom_preview = CustomPreview(Geometry=brep_join.Breps, Material=ColourSwatch(SwatchColor=RGB(107, 183, 255)))
