# Grasshopper definition polygonal-helix-definition.gh (Grasshopper 1.0.7)

# ---- group: Create Base Polygon
radius = Slider(3, range=0..10)
sides = Slider(4, range=0..10)
polygon = Polygon(Plane=PlaneXY(0, 0, 0), Radius=radius, Segments=sides, FilletRadius=0)  # -> Polygon, Length

# ---- group: Make Many Polygons
turns = Slider(10, range=0..10)
duplicate_data = DuplicateData(Data=polygon.Polygon, Number=turns, Order=True)

# ----
discontinuity = Discontinuity(Curve=duplicate_data, Level=1)  # -> flatten(Points), Parameters

# ---- group: Create Regularly Spaced Z-Values
height = Slider(20, range=0..100)
list_length = ListLength(List=discontinuity.Points)
range = Range(Domain=height, Steps=expr("x-1", list_length))

# ---- group: Take Apart and Rebuild Points With Incrementing Zs
deconstruct = Deconstruct(Point=discontinuity.Points)  # -> XComponent, YComponent, ZComponent
construct_point = ConstructPoint(XCoordinate=deconstruct.XComponent, YCoordinate=deconstruct.YComponent, ZCoordinate=range)

# ----
polyline = PolyLine(Vertices=construct_point, Closed=False)

# ---- group: Rebuild Curve to Smoothe It
resolution = Slider(90, range=0..300)
divide_curve = DivideCurve(Curve=polyline, Count=resolution, Kinks=False)  # -> Points, Tangents, Parameters
interpolate = Interpolate(Vertices=divide_curve.Points, Degree=3, Periodic=False, KnotStyle=1)  # -> Curve, Length, Domain

# ---- group: Fake Data
number_of_data_points = Slider(52, range=0..100)
random = Random(Range=Domain(0, 1), Number=number_of_data_points, Seed=2)

# ---- group: Remap Data
construct_domain = ConstructDomain(DomainStart=Slider(0.25, range=0..1), DomainEnd=Slider(0.8, range=0..1))
bounds = Bounds(Numbers=random)
remap_numbers = RemapNumbers(Value=random, Source=bounds, Target=construct_domain)  # -> Mapped, Clipped

# ----
list_length_2 = ListLength(List=remap_numbers.Mapped)

# ---- group: Create Planes Evenly Spaced along Helix
perp_frames = PerpFrames(Curve=reparameterize(interpolate.Curve), Count=expr("x-1", list_length_2), Align=True)  # -> Frames, Parameters

# ---- group: Keep Planes Aligned, Otherwise, they’ll twist
deconstruct_plane = DeconstructPlane(Plane=perp_frames.Frames)  # -> Origin, XAxis, YAxis, ZAxis
unit_z = UnitZ(Factor=1)
construct_plane = ConstructPlane(Origin=deconstruct_plane.Origin, XAxis=unit_z, YAxis=deconstruct_plane.YAxis)

# ---- group: Create Data-Driven Cylindrical Cross-Sections and Pipe
range_2 = Range(Domain=Domain(0, 1), Steps=expr("x-1", list_length_2))
pipe_variable = PipeVariable(Curve=reparameterize(interpolate.Curve), Parameters=range_2, Radii=remap_numbers.Mapped, Caps=0)

# ---- group: Create Data-Driven Polygonal Cross-Sections
cross_section_shape = Slider(4, range=0..10)
polygon_2 = Polygon(Plane=construct_plane, Radius=remap_numbers.Mapped, Segments=cross_section_shape, FilletRadius=0)  # -> Polygon, Length

# ---- group: Spin Cross-Sections
radians = Radians(Degrees=Slider(45, range=0..100))
rotate = Rotate(Geometry=polygon_2.Polygon, Angle=radians, Plane=construct_plane)  # -> Geometry, Transform

# ---- group: Shift Over for Visibility
unit_x = UnitX(Factor=Slider(10, range=0..10))
move = Move(Geometry=pipe_variable, Motion=unit_x)  # -> Geometry, Transform

# ---- group: Create Polygonal Pipe
sweep1 = Sweep1(Rail=interpolate.Curve, Sections=rotate.Geometry, Miter=1)

# ----
custom_preview = CustomPreview(Geometry=move.Geometry, Material=ColourSwatch(SwatchColor=RGB(82, 78, 255)))
custom_preview_2 = CustomPreview(Geometry=sweep1, Material=ColourSwatch(SwatchColor=RGB(88, 247, 255)))
