# Grasshopper definition sakura-cu-definition.gh (Grasshopper 1.0.7)

# ---- group: Me sakura data
me_sakura_data = Panel("""AD,Full-flowering date (DOY),Full-flowering date
1988,106,415
1989,93,403
1990,88,329
1991,97,407
1992,94,403
1993,97,407
1994,99,409
1995,99,409
1996,103,412
1997,97,407
1998,91,401
1999,94,404
2000,100,409
2001,96,406
2002,91,401
2003,98,408
2004,92,401
2005,99,409
2006,98,408
2007,97,407
2008,95,404
2009,95,405
2010,95,405
2011,99,409
2012,101,410
2013,93,403
2014,94,404
2015,93,403
2016,94,404
2017,99,409""")
param_viewer = ParamViewer(me_sakura_data)

# ---- group: Segment Data
split_list = SplitList(List=me_sakura_data, Index=1)  # -> ListA, ListB
petal_count = Slider(5, range=0..10)
list_length = ListLength(List=split_list.ListB)
division = Division(A=list_length, B=petal_count)
partition_list = PartitionList(List=split_list.ListB, Size=division)

# ---- group: Mom sakura data
mom_sakura_data = Panel("""AD,Full-flowering date (DOY),Full-flowering date
1959,92,402
1960,95,404
1961,99,409
1962,102,412
1963,101,411
1964,99,408
1965,110,420
1966,97,407
1967,97,407
1968,99,408
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""")
# Mom sakura data: AD,Full-flowering date (DOY),Full-flowering date
# 1936,111,420
# 1937,100,410
# 1938,98,408
# 1939,104,414
# 1940,110,419
# 1941,100,410
# 1942,96,406
# 1943,101,411
# 1944,100,409
# 1945,,
# 1946,97,407
# 1947,107,417
# 1948,102,411
# 1949,107,417
# 1950,99,409
# 1951,98,408
# 1952,105,414
# 1953,101,411
# 1954,98,408
# 1955,97,407
# 1956,99,408
# 1957,103,413
# 1958,99,409
# 1959,92,402
# 1960,95,404
# 1961,99,409
# 1962,102,412
# 1963,101,411
# 1964,99,408
# 1965,110,420
# 1966,97,407
# 1967,97,407
# 1968,99,408
# 1969,101,411
# 1970,107,417
# 1971,98,408
# 1972,99,408
# 1973,97,407
# 1974,99,409
# 1975,100,410
# 1976,99,408
# 1977,93,403
# 1978,104,414
# 1979,97,407
# 1980,102,411
# 1981,99,409
# 1982,93,403
# 1983,99,409
# 1984,109,418
# 1985,99,409
# 1986,102,412
# 1987,95,405
# 1988,106,415
# 1989,93,403
# 1990,88,329
# 1991,97,407
# 1992,94,403
# 1993,97,407
# 1994,99,409
# 1995,99,409
# 1996,103,412
# 1997,97,407
# 1998,91,401
# 1999,94,404
# 2000,100,409
# 2001,96,406
# 2002,91,401
# 2003,98,408
# 2004,92,401
# 2005,99,409
# 2006,98,408
# 2007,97,407
# 2008,95,404
# 2009,95,405
# 2010,95,405
# 2011,99,409
# 2012,101,410
# 2013,93,403
# 2014,94,404
# 2015,93,403
# 2016,94,404
# 2017,99,409
param_viewer_2 = ParamViewer(mom_sakura_data)

# ---- group: Split CSV
text_split = TextSplit(Text=partition_list, Separators=",")

# ----
param_viewer_3 = ParamViewer(text_split)
list_item = ListItem(List=text_split, Index=0, Wrap=True)  # -> Item, Item1, Item2

# ---- group: Partially Flatten
panel = Panel(list_item.Item1)
trim_tree = TrimTree(Tree=panel, Depth=1)
panel_2 = Panel(trim_tree)

# ---- group: Scale Numbers
bounds = Bounds(Numbers=flatten(trim_tree))
construct_domain = ConstructDomain(DomainStart=Slider(5, range=0..10), DomainEnd=Slider(7.5, range=0..10))
remap_numbers = RemapNumbers(Value=panel_2, Source=bounds, Target=construct_domain)  # -> Mapped, Clipped

# ---- group: Partially Flatten Years
panel_3 = Panel(list_item.Item)
trim_tree_2 = TrimTree(Tree=panel_3, Depth=1)
panel_4 = Panel(trim_tree_2)

# ---- group: Base of Petal
construct_point = ConstructPoint(XCoordinate=0, YCoordinate=0, ZCoordinate=0)

# ---- group: Define Spread of Petal
angular_radius_of_petal_arc = Slider(15, range=0..100)
negative = Negative(Value=angular_radius_of_petal_arc)
unit_y = UnitY(Factor=1)
radians = Radians(Degrees=[angular_radius_of_petal_arc, negative])
rotate = Rotate(Geometry=unit_y, Angle=radians, Plane=PlaneXY(0, 0, 0))  # -> Geometry, Transform
line_sdl = LineSDL(Start=construct_point, Direction=rotate.Geometry, Length=1)

# ---- group: Draw Arc
end_points = EndPoints(Curve=line_sdl)  # -> Start, End
unit_y_2 = UnitY(Factor=1)
list_item_2 = ListItem(List=end_points.End, Index=0, Wrap=True)  # -> Item, Item1
arc_sed = ArcSED(Start=list_item_2.Item, End=list_item_2.Item1, Direction=unit_y_2)  # -> Arc, Plane, Radius

# ---- group: Cut Arc Evenly for Data Placement
list_length_2 = ListLength(List=remap_numbers.Mapped)
divide_curve = DivideCurve(Curve=arc_sed.Arc, Count=expr("x-1", list_length_2), Kinks=False)  # -> Points, Tangents, Parameters

# ---- group: Deterrmine placement for Each Data Point
vector_2pt = Vector2Pt(PointA=construct_point, PointB=divide_curve.Points, Unitize=False)  # -> Vector, Length
amplitude = Amplitude(Vector=vector_2pt.Vector, Amplitude=remap_numbers.Mapped)
move = Move(Geometry=construct_point, Motion=amplitude)  # -> Geometry, Transform

# ---- group: Draw Petal Lines From Center Out
number_slider = Slider(1.3, range=0..10)
construct_domain_2 = ConstructDomain(DomainStart=expr("-x", number_slider), DomainEnd=number_slider)
list_length_3 = ListLength(List=move.Geometry)  # -> flatten(Length)
range = Range(Domain=construct_domain_2, Steps=expr("x-1", list_length_3))
unit_x = UnitX(Factor=range)
unit_y_3 = UnitY(Factor=Slider(1.2, range=0..10))
bezier_span = BezierSpan(StartPoint=construct_point, StartTangent=unit_y_3, EndPoint=move.Geometry, EndTangent=unit_x)  # -> simplify(Curve), Length, Domain

# ---- group: Draw Top Edge of Petal
interpolate = Interpolate(Vertices=move.Geometry, Degree=3, Periodic=False, KnotStyle=1)  # -> Curve, Length, Domain

# ---- group: Draw Sides of petals
number_slider_2 = Slider(2.5, range=0..10)
number_slider_3 = Slider(0, range=-5..5)
unit_x_2 = UnitX(Factor=number_slider_3)
unit_x_3 = UnitX(Factor=number_slider_2)
end_points_2 = EndPoints(Curve=interpolate.Curve)  # -> Start, End
unit_x_4 = UnitX(Factor=number_slider_3)
unit_x_5 = UnitX(Factor=number_slider_2)
negative_2 = Negative(Value=unit_x_3)
negative_3 = Negative(Value=unit_x_2)
bezier_span_2 = BezierSpan(StartPoint=construct_point, StartTangent=unit_x_4, EndPoint=end_points_2.End, EndTangent=unit_x_5)  # -> Curve, Length, Domain
bezier_span_3 = BezierSpan(StartPoint=construct_point, StartTangent=negative_3, EndPoint=end_points_2.Start, EndTangent=negative_2)  # -> Curve, Length, Domain

# ---- group: Concentric Placemen
iso_curve_count = Slider(5, range=0..10)
construct_domain_3 = ConstructDomain(DomainStart=Slider(0.25, range=0..1), DomainEnd=Slider(0.65, range=0..1))
range_2 = Range(Domain=construct_domain_3, Steps=iso_curve_count)

# ---- group: Collect all Outwards Curves
merge = Merge(Data1=simplify(bezier_span_3.Curve), Data2=simplify(bezier_span.Curve), Data3=simplify(bezier_span_2.Curve))  # -> flatten(Result)

# ---- group: Annoying data manipulation for concentric rings
evaluate_curve = EvaluateCurve(Curve=reparameterize(graft(merge)), Parameter=range_2)  # -> Point, Tangent, Angle
list_length_4 = ListLength(List=merge)
flip_matrix = FlipMatrix(Data=evaluate_curve.Point)  # -> flatten(Data)
division_2 = Division(A=list_length_4, B=petal_count)
partition_list_2 = PartitionList(List=flip_matrix, Size=division_2)
interpolate_2 = Interpolate(Vertices=partition_list_2, Degree=3, Periodic=False, KnotStyle=1)  # -> simplify(flatten(Curve)), Length, Domain
partition_list_3 = PartitionList(List=interpolate_2.Curve, Size=petal_count)
flip_matrix_2 = FlipMatrix(Data=partition_list_3)

# ---- group: Collect Curves fro Grouping
polyline = PolyLine(Vertices=move.Geometry, Closed=False)  # -> simplify(Polyline)
join_curves = JoinCurves(Curves=[bezier_span_3.Curve, bezier_span_2.Curve, interpolate.Curve], Preserve=False)  # -> simplify(Curves)
merge_2 = Merge(Data1=join_curves, Data2=bezier_span.Curve, Data3=simplify(flip_matrix_2), Data4=polyline)

# ---- group: Group Petals and Spread Out
range_3 = Range(Domain=Domain(0, 6.283185307), Steps=petal_count)
group = Group(Objects=merge_2)
cull_index = CullIndex(List=range_3, Indices=-1, Wrap=True)
reverse_list = ReverseList(List=cull_index)
rotate_2 = Rotate(Geometry=group, Angle=graft(reverse_list), Plane=PlaneXY(0, 0, 0))  # -> Geometry, Transform

# ---- group: Separate Items after Rotation
ungroup = Ungroup(Group=rotate_2.Geometry)
list_length_5 = ListLength(List=ungroup)
split_list_2 = SplitList(List=ungroup, Index=expr("x-1", list_length_5))  # -> ListA, ListB

# ---- group: Text Labels
construct_point_2 = ConstructPoint(XCoordinate=0, YCoordinate=0, ZCoordinate=0)
discontinuity = Discontinuity(Curve=split_list_2.ListB, Level=1)  # -> Points, Parameters
move_away_from = MoveAwayFrom(Geometry=discontinuity.Points, Emitter=construct_point_2, Distance=Slider(0.7, range=0..10))  # -> Geometry, Transform
text_tag_3d = TextTag3D(Location=move_away_from.Geometry, Text=panel_4, Size=Slider(0.245, range=0..1), Justification=5)

# ----
split_list_3 = SplitList(List=split_list_2.ListA, Index=1)  # -> ListA, ListB

# ---- group: Radial Data Lines
curve = Curve(split_list_2.ListA)
custom_preview = CustomPreview(Geometry=curve, Material=ColourSwatch(SwatchColor=RGB(255, 255, 255)))

# ---- group: Make Petal Surface and Cut With Data
boundary_surfaces = BoundarySurfaces(Edges=split_list_3.ListA)  # -> simplify(Surfaces)
surface_split = SurfaceSplit(Surface=boundary_surfaces, Curves=split_list_3.ListB)  # -> simplify(Fragments)

# ---- group: Create Petal Outline
brep_edges = BrepEdges(Brep=surface_split)  # -> Naked, Interior, NonManifold
join_curves_2 = JoinCurves(Curves=brep_edges.Naked, Preserve=False)  # -> simplify(Curves)

# ---- group: Create Cut Holes
trim_tree_3 = TrimTree(Tree=join_curves_2, Depth=1)
area = Area(Geometry=trim_tree_3)  # -> Area, Centroid
scale = Scale(Geometry=trim_tree_3, Center=area.Centroid, Factor=Slider(0.54, range=0..1))  # -> Geometry, Transform

# ---- group: Cut Surface
surface_split_2 = SurfaceSplit(Surface=boundary_surfaces, Curves=scale.Geometry)

# ---- group: Plain Petals
custom_preview_2 = CustomPreview(Geometry=boundary_surfaces, Material=ColourSwatch(SwatchColor=RGB(237, 104, 169)))

# ---- group: Find Biggest Cut Section
bounding_box = BoundingBox(Content=surface_split_2, Plane=PlaneXY(0, 0, 0))  # -> Box, Box_2
area_2 = Area(Geometry=bounding_box.Box)  # -> Area, Centroid
sort_list = SortList(Keys=area_2.Area, ValuesValuesA=surface_split_2)  # -> Keys, ValuesValuesA
list_item_3 = ListItem(List=sort_list.ValuesValuesA, Index=-1, Wrap=True)  # -> flatten(Item)

# ---- group: Cut Petals
custom_preview_3 = CustomPreview(Geometry=list_item_3, Material=ColourSwatch(SwatchColor=RGB(253, 21, 113)))
