# Grasshopper definition voronoi-puzzle-definition.gh (Grasshopper 1.0.7)

# ---- group: Puzzle Bounding Box
number_slider = Slider(4, range=0..10)
number_slider_2 = Slider(9, range=0..10)
domain_box = DomainBox(Base=PlaneXY(0, 0, 0), X=number_slider_2, Y=number_slider, Z=number_slider)

# ---- group: Random Data
data_count = Slider(20, range=0..100)
random = Random(Range=number_slider, Number=data_count, Seed=2)

# ---- group: Remap Data
construct_domain = ConstructDomain(DomainStart=Slider(0.51, range=0..1), DomainEnd=Slider(3.4, range=0..10))
bounds = Bounds(Numbers=random)
remap_numbers = RemapNumbers(Value=random, Source=bounds, Target=construct_domain)  # -> Mapped, Clipped

# ---- group: Spread Out Data on Single Axis
range = Range(Domain=number_slider_2, Steps=data_count)
construct_point = ConstructPoint(XCoordinate=range, YCoordinate=0, ZCoordinate=remap_numbers.Mapped)

# ---- group: 3D Voronoi
voronoi_3d = Voronoi3D(Points=flatten(construct_point), Box=domain_box)  # -> Cells, Boundary

# ---- group: Disassemble
construct_domain_2 = ConstructDomain(DomainStart=Slider(12, range=0..100), DomainEnd=Slider(30, range=0..100))
list_length = ListLength(List=voronoi_3d.Cells)
range_2 = Range(Domain=construct_domain_2, Steps=expr("x-1", list_length))
unit_x = UnitX(Factor=range_2)
move = Move(Geometry=voronoi_3d.Cells, Motion=unit_x)  # -> Geometry, Transform

# ---- group: Color by Volume
volume = Volume(Geometry=voronoi_3d.Cells)  # -> Volume, Centroid
bounds_2 = Bounds(Numbers=volume.Volume)
remap_numbers_2 = RemapNumbers(Value=volume.Volume, Source=bounds_2, Target=Domain(0, 1))  # -> Mapped, Clipped
gradient = Gradient(
    LowerLimit=0,
    UpperLimit=1,
    Parameter=remap_numbers_2.Mapped,
    stops=[0: RGB(0, 128, 0), 0.5: RGB(255, 255, 0), 1: RGB(255, 0, 0)])

# ----
custom_preview = CustomPreview(Geometry=voronoi_3d.Cells, Material=gradient)
custom_preview_2 = CustomPreview(Geometry=move.Geometry, Material=gradient)
