# Grasshopper definition climate-data-helix-definition.gh (Grasshopper 1.0.7)
# plug-ins: jSwan

# Python Code: #need to manipulate csv data
# import csv
# 
# #open file
# with open(filePath) as csvfile:
# 	#parse csv
#     reader = csv.reader(csvfile, delimiter=',', quotechar='"')
# 
#     #skip first 6 lines
#     next(reader)
#     next(reader)
#     next(reader)
#     next(reader)
#     next(reader)
#     next(reader)
# 
#     #create holder for selected data
#     cityData = []
# 
#     #loop through each row
#     for row in reader:
#         #check for desired city
# 		if row[2] == city:
#             #save data to list
# 			cityData.append(row)
# 
# #create data holders
# dates = []
# data = []
# 
# #loop through single city data
# for row in cityData:
# 	try:
# 		#add new data point to existing date
# 		data[dates.index(row[0])][row[3]] = row[7]
# 	except:
# 		#add new date
# 		dates.append(row[0])
# 		data.append({"date":row[0], row[3] : row[7]})
# 
# #output data
# for d in data:
# 	print(d)
panel = Panel("Chicago")
panel_2 = Panel("Users/zap/Desktop/waqi/waqi-covid19-airqualitydata-2020.csv")
ghpython_script = GhPythonScript(filePath=panel_2, city=panel)  # -> out
# ---------- ghpython_script: Python ----------
import csv

#open file
with open(filePath) as csvfile:
	#parse csv
    reader = csv.reader(csvfile, delimiter=',', quotechar='"')
    
    #skip first 6 lines
    next(reader)
    next(reader)
    next(reader)
    next(reader)
    next(reader)
    next(reader)

    #create holder for selected data
    cityData = []

    #loop through each row
    for row in reader:
        #check for desired city
		if row[2] == city:
            #save data to list
			cityData.append(row)

#create data holders
dates = []
data = []

#loop through single city data
for row in cityData:
	try:
		#add new data point to existing date
		data[dates.index(row[0])][row[3]] = row[7]
	except:
		#add new date
		dates.append(row[0])
		data.append({"date":row[0], row[3] : row[7]})

#output data
for d in data:
	print(d)
# ---------- end ghpython_script ----------
deserialize_json = DeserializeJson(JSON=ghpython_script, OutputsLocked=False)  # -> O3, Dew, No2, Pressure, Pm10, Temperature, So2, Pm25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

# ---- group: Replace Empty Cells
replace_nulls = ReplaceNulls(Items=deserialize_json.O3, Replacements="0")  # -> Items, Count

# ----
list_length = ListLength(List=replace_nulls.Items)

# ---- group: Generate Radial Sequence
helix_turns = Slider(2, range=0..10)
pi = Pi(Factor=2)
multiplication = Multiplication(A=pi, B=helix_turns)
range = Range(Domain=multiplication, Steps=expr("x-1", list_length))
ring_neutral_radius = Slider(1.25, range=0..10)
cosine = Cosine(Value=range)
sine = Sine(Value=range)
multiplication_2 = Multiplication(A=sine, B=ring_neutral_radius)
multiplication_3 = Multiplication(A=ring_neutral_radius, B=cosine)

# ---- group: Remap data
maximum_radius_expansion = Slider(1.15, range=0..10)
bounds = Bounds(Numbers=replace_nulls.Items)
remap_numbers = RemapNumbers(Value=replace_nulls.Items, Source=bounds, Target=maximum_radius_expansion)  # -> Mapped, Clipped

# ---- group: Create Rising Values
number_slider = Slider(0.5, range=0..10)
range_2 = Range(Domain=number_slider, Steps=expr("x-1", list_length))

# ---- group: Build Helical Points
construct_point = ConstructPoint(XCoordinate=multiplication_2, YCoordinate=multiplication_3, ZCoordinate=range_2)

# ---- group: Build Rising Cetner Points
construct_point_2 = ConstructPoint(XCoordinate=0, YCoordinate=0, ZCoordinate=range_2)

# ---- group: Simpler Graph for Comparison
quick_graph = QuickGraph(remap_numbers.Mapped, SortOrder=0)

# ---- group: Move Outer Ring Out
ring_width = Slider(0.3, range=0..1)
vector_2pt = Vector2Pt(PointA=construct_point_2, PointB=construct_point, Unitize=False)  # -> Vector, Length
addition = Addition(A=remap_numbers.Mapped, B=ring_width)
amplitude = Amplitude(Vector=vector_2pt.Vector, Amplitude=addition)
move = Move(Geometry=construct_point, Motion=amplitude)  # -> Geometry, Transform

# ---- group: Move Inner Ring Out
vector_2pt_2 = Vector2Pt(PointA=construct_point_2, PointB=construct_point, Unitize=False)  # -> Vector, Length
amplitude_2 = Amplitude(Vector=vector_2pt_2.Vector, Amplitude=remap_numbers.Mapped)
move_2 = Move(Geometry=construct_point, Motion=amplitude_2)  # -> Geometry, Transform

# ---- group: Calculate Pitch
division = Division(A=number_slider, B=helix_turns)

# ---- group: Make Small Gap
spacing = Slider(0.05, range=0..1)
subtraction = Subtraction(A=division, B=spacing)

# ----
nurbs_curve = NurbsCurve(Vertices=move_2.Geometry, Degree=3, Periodic=False)  # -> Curve, Length, Domain
nurbs_curve_2 = NurbsCurve(Vertices=move.Geometry, Degree=3, Periodic=False)  # -> Curve, Length, Domain

unit_z = UnitZ(Factor=subtraction)
move_3 = Move(Geometry=nurbs_curve.Curve, Motion=unit_z)  # -> Geometry, Transform
move_4 = Move(Geometry=nurbs_curve_2.Curve, Motion=unit_z)  # -> Geometry, Transform

# ---- group: Build Surfaces
ruled_surface = RuledSurface(CurveA=move_3.Geometry, CurveB=move_4.Geometry)
ruled_surface_2 = RuledSurface(CurveA=nurbs_curve.Curve, CurveB=nurbs_curve_2.Curve)
ruled_surface_3 = RuledSurface(CurveA=nurbs_curve.Curve, CurveB=move_3.Geometry)
ruled_surface_4 = RuledSurface(CurveA=nurbs_curve_2.Curve, CurveB=move_4.Geometry)

# ---- group: Join and Cap
brep_join = BrepJoin(Breps=[ruled_surface_2, ruled_surface, ruled_surface_3, ruled_surface_4])  # -> Breps, Closed
cap_holes = CapHoles(Brep=brep_join.Breps)

# ----
custom_preview = CustomPreview(Geometry=cap_holes, Material=ColourSwatch(SwatchColor=RGB(68, 88, 178)))
