# Grasshopper definition contour-lines-definition.gh (Grasshopper 1.0.7)

# ---- group: Build Structured Grid of Points
width = Slider(30, range=0..100)
x_samples = Slider(20, range=0..100)
height = Slider(30, range=0..100)
y_samples = Slider(20, range=0..100)
range = Range(Domain=width, Steps=expr("x-1", x_samples))
range_2 = Range(Domain=height, Steps=expr("x-1", y_samples))

# ---- group: Random 2D Data
series = Series(Start=0, Step=1, Count=y_samples)
random = Random(Range=Domain(0, 1), Number=x_samples, Seed=series)

# ---- group: Build Structured Grid of Points (continued)
construct_point = ConstructPoint(XCoordinate=graft(range), YCoordinate=range_2, ZCoordinate=random)

# ----
simple_2d_dataset = Panel(random)

# ---- group: Lofted Surface
interpolate = Interpolate(Vertices=construct_point, Degree=3, Periodic=False, KnotStyle=1)  # -> Curve, Length, Domain
loft = Loft(
    Curves=flatten(interpolate.Curve),
    Options={Adjust=False, Closed=False, LoftEnds=0, LoftSimp=0, LoftType=0, Rebuild=10, Refit=0.01})

# ---- group: Generate Bottom Perimeter
thickness = Slider(5.5, range=0..10)
brep_edges = BrepEdges(Brep=loft)  # -> Naked, Interior, NonManifold
negative = Negative(Value=thickness)
join_curves = JoinCurves(Curves=brep_edges.Naked, Preserve=False)
construct_point_2 = ConstructPoint(XCoordinate=0, YCoordinate=0, ZCoordinate=negative)
project = Project(Geometry=join_curves, Plane=construct_point_2)  # -> Geometry, Transform

# ---- group: Create Solid
ruled_surface = RuledSurface(CurveA=join_curves, CurveB=project.Geometry)
brep_join = BrepJoin(Breps=flatten([ruled_surface, loft]))  # -> Breps, Closed
cap_holes = CapHoles(Brep=brep_join.Breps)

# ---- group: Bottom Front Left Point
evaluate_box = EvaluateBox(Box=cap_holes, UParameter="0", VParameter="0", WParameter="0")  # -> Plane, Point, Include

# ----
custom_preview = CustomPreview(Geometry=cap_holes, Material=ColourSwatch(SwatchColor=RGBA(22, 94, 59, 76)))

# ---- group: Generate Contour Lines
material_thickness = Slider(1.2, range=0..10)
unit_x = UnitX(Factor=1)
contour = Contour(Shape=cap_holes, Point=evaluate_box.Point, Direction=unit_x, Distance=material_thickness)

# ----
custom_preview_2 = CustomPreview(Geometry=contour, Material=ColourSwatch(SwatchColor=RGB(255, 255, 255)))
