# Grasshopper definition data-clip-definition.gh (Grasshopper 1.0.7)
# plug-ins: LunchBox

clothespin_cross_section = Curve(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)

# ---- group: Create Solid
thickness = Slider(0.5, range=0..1)
unit_y = UnitY(Factor=thickness)
extrude = Extrude(Base=clothespin_cross_section, Direction=unit_y)
cap_holes = CapHoles(Brep=extrude)

# ----
composition_food_organic_waster_percent = Panel("""14.9
61.2
36
30
32
16.7
34.5
51.4
34.4
24
28.41
49
48.44
30
52.4
64
53.8
35
45.5
29""")

# ---- group: Remap Data
maximum_spike_columns = Slider(12, range=0..20)
minimum_spike_columns = Slider(2, range=0..20)
construct_domain = ConstructDomain(DomainStart=minimum_spike_columns, DomainEnd=maximum_spike_columns)
bounds = Bounds(Numbers=composition_food_organic_waster_percent)
remap_numbers = RemapNumbers(Value=composition_food_organic_waster_percent, Source=bounds, Target=construct_domain)  # -> Mapped, Clipped

# ---- group: Find Face to Replace
number_slider = Slider(10, range=0..100)
deconstruct_brep = DeconstructBrep(Brep=cap_holes)  # -> Faces, Edges, Vertices
cull_index = CullIndex(List=deconstruct_brep.Faces, Indices=number_slider, Wrap=True)
list_item = ListItem(List=deconstruct_brep.Faces, Index=number_slider, Wrap=True)

# ----
brep_join = BrepJoin(Breps=cull_index)  # -> Breps, Closed

# ---- group: Create Grid of Panels
spike_rows = Slider(1, range=0..1)
quad_panels = QuadPanels(Surface=list_item, UDivisions=spike_rows, VDivisions=remap_numbers.Mapped)

# ---- group: Move Center Point of Panels Up
spike_height = Slider(0.125, range=0..1)
area = Area(Geometry=quad_panels)  # -> Area, Centroid
unit_z = UnitZ(Factor=spike_height)
move = Move(Geometry=area.Centroid, Motion=unit_z)  # -> simplify(Geometry), Transform

# ---- group: Collect and Join Outline
brep_edges = BrepEdges(Brep=quad_panels)  # -> Naked, Interior, NonManifold
join_curves = JoinCurves(Curves=brep_edges.Naked, Preserve=False)  # -> simplify(Curves)
trim_tree = TrimTree(Tree=join_curves, Depth=1)

# ---- group: Extrude and Join Spikes
extrude_point = ExtrudePoint(Base=trim_tree, Point=move.Geometry)
brep_join_2 = BrepJoin(Breps=extrude_point)  # -> Breps, Closed

# ---- group: Make Clothespin Copies for Each Country
list_length = ListLength(List=brep_join_2.Breps)
duplicate_data = DuplicateData(Data=brep_join.Breps, Number=list_length, Order=True)  # -> simplify(graft(Data))

# ---- group: Join Spikes to Clothespin
brep_join_3 = BrepJoin(Breps=[duplicate_data, brep_join_2.Breps])  # -> flatten(Breps), Closed

# ---- group: Spread Out Clips
list_length_2 = ListLength(List=brep_join_3.Breps)
range = Range(Domain=Slider(20, range=0..100), Steps=expr("x-1", list_length_2))
unit_y_2 = UnitY(Factor=range)
move_2 = Move(Geometry=flatten(brep_join_3.Breps), Motion=unit_y_2)  # -> Geometry, Transform

# ----
population = Panel("""318563456
1.37E+09
1.27E+08
81686611
66624068
65128861
1071477855
205962108
60730582
35544564
143201676
46447697
23789338
50746659
125890949
78271472
261115456
16939923
31557144
8372098""")
country = Panel("""United States
China
Japan
Germany
France
United Kingdom
India
Brazil
Italy
Canada
Russian Federation
Spain
Australia
Korea, Rep.
Mexico
Turkey
Indonesia
Netherlands
Saudi Arabia
Switzerland""")

# ---- group: Make Bottom of Clip
xy_plane = XYPlane(Origin=Point(0, 0, 0))
mirror = Mirror(Geometry=move_2.Geometry, Plane=xy_plane)  # -> Geometry, Transform

# ----
construct_point = ConstructPoint(XCoordinate=0, YCoordinate=0, ZCoordinate=0)
move_3 = Move(Geometry=construct_point, Motion=unit_y_2)  # -> Geometry, Transform
text_tag_3d = TextTag3D(Location=move_3.Geometry, Text=country, Size=Slider(0.3, range=0..1), Justification=9)

# ---- group: Remap Data to Hues
bounds_2 = Bounds(Numbers=population)
remap_numbers_2 = RemapNumbers(Value=population, Source=bounds_2, Target=Domain(0, 1))  # -> Mapped, Clipped
colour_hsv = ColourHSV(Alpha=1, Hue=remap_numbers_2.Mapped, Saturation=1, Value=1)

# ----
merge = Merge(Data1=graft(move_2.Geometry), Data2=graft(mirror.Geometry))
custom_preview = CustomPreview(Geometry=merge, Material=graft(colour_hsv))
