# Grasshopper definition data-helix-mesh-definition.gh (Grasshopper 1.0.7)
# plug-ins: Weaverbird, Kangaroo2 Components

smoothness_of_helix = Slider(100, range=0..100)
range = Range(Domain=Domain(0, 1), Steps=smoothness_of_helix)
max_radius = Slider(5.5, range=0..10)
graph_mapper = GraphMapper(range, x0=0, x1=1, y0=0, y1=1, container_name="Bezier", cpx=[0, 0, 1, 1], cpy=[0, 0.7579938173, 0.8043478131, 0])
multiplication = Multiplication(A=graph_mapper, B=max_radius)

# ---- group: Create Circular-Place Numbers
spins = Slider(3.5, range=0..10)
pi = Pi(Factor=2)
multiplication_2 = Multiplication(A=pi, B=spins)
range_2 = Range(Domain=multiplication_2, Steps=smoothness_of_helix)
cosine = Cosine(Value=range_2)
sine = Sine(Value=range_2)

# ---- group: Increase in Height
height = Slider(16.22, range=0..20)
range_3 = Range(Domain=height, Steps=smoothness_of_helix)

# ---- group: Build Helix
multiplication_3 = Multiplication(A=cosine, B=multiplication)
multiplication_4 = Multiplication(A=sine, B=multiplication)
construct_point = ConstructPoint(XCoordinate=multiplication_3, YCoordinate=multiplication_4, ZCoordinate=range_3)
interpolate = Interpolate(Vertices=construct_point, Degree=3, Periodic=False, KnotStyle=1)  # -> Curve, Length, Domain

# ---- group: Fake Data
random = Random(Range=Domain(0, 1), Number=Slider(31, range=0..100), Seed=2)

random_2 = Random(Range=Domain(0, 1), Number=Slider(31, range=0..100), Seed=343)

# ---- group: Remap Data
construct_domain = ConstructDomain(DomainStart=Slider(0, range=0..1), DomainEnd=Slider(0.42, range=0..10))
bounds = Bounds(Numbers=random)
remap_numbers = RemapNumbers(Value=random, Source=bounds, Target=construct_domain)  # -> Mapped, Clipped

construct_domain_2 = ConstructDomain(DomainStart=Slider(0.23, range=0..1), DomainEnd=Slider(0.65, range=0..10))
bounds_2 = Bounds(Numbers=random_2)
remap_numbers_2 = RemapNumbers(Value=random_2, Source=bounds_2, Target=construct_domain_2)  # -> Mapped, Clipped

# ---- group: Create Additional Helices
polar_array = PolarArray(Geometry=interpolate.Curve, Plane=PlaneXY(0, 0, 0), Count=Slider(4, range=0..10), Angle=6.283185307)  # -> Geometry, Transform
list_item = ListItem(List=polar_array.Geometry, Index=1, Wrap=True)
list_item_2 = ListItem(List=polar_array.Geometry, Index=3, Wrap=True)

# ---- group: Put a Zero at the Start and End of Dataset So Helix End Points Stay Aligned
number_slider = Slider(0, range=0..100)
merge = Merge(Data1=graft(number_slider), Data2=remap_numbers_2.Mapped, Data3=graft(number_slider))  # -> flatten(Result)

number_slider_2 = Slider(0, range=0..100)
merge_2 = Merge(Data1=graft(number_slider_2), Data2=remap_numbers.Mapped, Data3=graft(number_slider_2))  # -> flatten(Result)

# ---- group: Get Specific Helix
list_item_3 = ListItem(List=polar_array.Geometry, Index="0", Wrap=True)

list_item_4 = ListItem(List=polar_array.Geometry, Index="2", Wrap=True)

# ---- group: Evenly Divide Helix
list_length = ListLength(List=merge)
perp_frames = PerpFrames(Curve=list_item_4, Count=expr("x-1", list_length), Align=True)  # -> Frames, Parameters
deconstruct_plane = DeconstructPlane(Plane=perp_frames.Frames)  # -> Origin, XAxis, YAxis, ZAxis

list_length_2 = ListLength(List=merge_2)
perp_frames_2 = PerpFrames(Curve=list_item_3, Count=expr("x-1", list_length_2), Align=True)  # -> Frames, Parameters
deconstruct_plane_2 = DeconstructPlane(Plane=perp_frames_2.Frames)  # -> Origin, XAxis, YAxis, ZAxis

# ---- group: Move Up with Data
unit_z = UnitZ(Factor=merge_2)
move = Move(Geometry=deconstruct_plane_2.Origin, Motion=unit_z)  # -> Geometry, Transform

# ---- group: Move Down with Data
unit_z_2 = UnitZ(Factor=merge)
negative = Negative(Value=unit_z_2)
move_2 = Move(Geometry=deconstruct_plane.Origin, Motion=negative)  # -> Geometry, Transform

# ---- group: Draw Data Helices and Merge with Other Original Helices
interpolate_2 = Interpolate(Vertices=move.Geometry, Degree=3, Periodic=False, KnotStyle=1)  # -> flatten(Curve), Length, Domain
interpolate_3 = Interpolate(Vertices=move_2.Geometry, Degree=3, Periodic=False, KnotStyle=1)  # -> flatten(Curve), Length, Domain
merge_3 = Merge(
    Data1=flatten(interpolate_2.Curve),
    Data2=flatten(list_item),
    Data3=flatten(interpolate_3.Curve),
    Data4=flatten(list_item_2))

# ---- group: Create Surfaces Between Sequential Surfaces
shift_list = ShiftList(List=merge_3, Shift=1, Wrap=True)
ruled_surface = RuledSurface(CurveA=merge_3, CurveB=shift_list)

# ---- group: Convert to Mesh
mesh_hole_count_between_helices = Slider(50, range=0..100)
mesh_hole_count_along_helices = Slider(200, range=0..1000)
mesh_surface = MeshSurface(
    Surface=ruled_surface,
    UCount=mesh_hole_count_along_helices,
    VCount=mesh_hole_count_between_helices,
    Overhang=True,
    Equalize=False)

# ---- group: Clean Up Mesh
combine_clean = CombineClean(Meshes=mesh_surface)

# ---- group: Count Faces
deconstruct_mesh = DeconstructMesh(Mesh=combine_clean)  # -> Vertices, Faces, Colours, Normals
list_length_3 = ListLength(List=deconstruct_mesh.Faces)

# ---- group: Fake Data
max_openness_as_a_percentage_smaller_is = Slider(34, range=0..100)  # "Max Openness as a Percentage - Smaller is More Open"
random_3 = Random(Range=max_openness_as_a_percentage_smaller_is, Number=list_length_3, Seed=2)

# ---- group: Create Holes in Mesh
weaverbird_s_picture_frame = WeaverbirdsPictureFrame(MeshPolylines=combine_clean, Distance=random_3, InsetType=0)

# ----
custom_preview = CustomPreview(Geometry=weaverbird_s_picture_frame, Material=ColourSwatch(SwatchColor=RGB(98, 98, 102)))
