# Grasshopper definition data-prisms-molding-definition.gh (Grasshopper 1.0.7)

nutrition = Panel(""".55
.25
.76
.44
.8""")
radius = Slider(5.5, range=0..10)
list_length = ListLength(List=nutrition)

# ---- group: Top Polygon
height = Slider(10, range=0..10)
construct_point = ConstructPoint(XCoordinate=0, YCoordinate=0, ZCoordinate=height)
polygon = Polygon(Plane=construct_point, Radius=radius, Segments=list_length, FilletRadius=0)  # -> Polygon, Length

# ---- group: Bottom Polygon
polygon_2 = Polygon(Plane=PlaneXY(0, 0, 0), Radius=radius, Segments=list_length, FilletRadius=0)  # -> Polygon, Length

# ----
multiplication = Multiplication(A=nutrition, B=height)

# ---- group: Create Raised Points at Middle of Form with Data
discontinuity = Discontinuity(Curve=polygon_2.Polygon, Level=1)  # -> Points, Parameters
deconstruct = Deconstruct(Point=discontinuity.Points)  # -> XComponent, YComponent, ZComponent
construct_point_2 = ConstructPoint(XCoordinate=deconstruct.XComponent, YCoordinate=deconstruct.YComponent, ZCoordinate=multiplication)

# ---- group: Find average of nutrition points to be center of Mating Surface
average = Average(Input=multiplication)
construct_point_3 = ConstructPoint(XCoordinate=0, YCoordinate=0, ZCoordinate=average)

# ----
calories = Panel(".6")

# ---- group: Draw Nutrtiion Outline and Scale Based on Data from Center
polyline = PolyLine(Vertices=construct_point_2, Closed=True)
scale = Scale(Geometry=polyline, Center=construct_point_3, Factor=calories)  # -> Geometry, Transform

# ---- group: Create Top Walls
ruled_surface = RuledSurface(CurveA=scale.Geometry, CurveB=polygon.Polygon)

# ---- group: Create Bottom Walls
ruled_surface_2 = RuledSurface(CurveA=scale.Geometry, CurveB=polygon_2.Polygon)

# ---- group: Create Mating Surface
extrude_point = ExtrudePoint(Base=scale.Geometry, Point=construct_point_3)

# ----
unit_x = UnitX(Factor=Slider(23, range=0..100))

# ---- group: Join and Cap
brep_join = BrepJoin(Breps=[extrude_point, ruled_surface_2])  # -> Breps, Closed
brep_join_2 = BrepJoin(Breps=[ruled_surface, extrude_point])  # -> Breps, Closed
cap_holes = CapHoles(Brep=brep_join_2.Breps)
cap_holes_2 = CapHoles(Brep=brep_join.Breps)

# ---- group: Move and Flip
move = Move(Geometry=cap_holes, Motion=expr("x*1.75", unit_x))  # -> Geometry, Transform
volume = Volume(Geometry=move.Geometry)  # -> Volume, Centroid
pi = Pi(Factor=1)
yz_plane = YZPlane(Origin=volume.Centroid)
rotate = Rotate(Geometry=move.Geometry, Angle=pi, Plane=yz_plane)  # -> Geometry, Transform
move_to_plane = MoveToPlane(Geometry=rotate.Geometry, Plane=PlaneXY(0, 0, 0), Above=True, Below=True)  # -> Geometry, Transform

# ----
macro_nutrients = Panel("""0.2
.99
.7
.24""")

# ---- group: Create Color
list_item = ListItem(List=macro_nutrients, Index=0, Wrap=True)  # -> Item, Item1, Item2, Item3
colour_rgb_f = ColourRGBF(Alpha=list_item.Item3, Red=list_item.Item, Green=list_item.Item1, Blue=list_item.Item2)

# ---- group: Create "Opposite" Color
subtraction = Subtraction(A=1, B=macro_nutrients)
list_item_2 = ListItem(List=subtraction, Index=0, Wrap=True)  # -> Item, Item1, Item2, Item3
colour_rgb_f_2 = ColourRGBF(Alpha=list_item_2.Item3, Red=list_item_2.Item, Green=list_item_2.Item1, Blue=list_item_2.Item2)

# ---- group: Move over
move_2 = Move(Geometry=cap_holes_2, Motion=unit_x)  # -> Geometry, Transform

# ----
custom_preview = CustomPreview(Geometry=cap_holes_2, Material=colour_rgb_f)
custom_preview_2 = CustomPreview(Geometry=cap_holes, Material=colour_rgb_f_2)
custom_preview_3 = CustomPreview(Geometry=move_2.Geometry, Material=colour_rgb_f)
custom_preview_4 = CustomPreview(Geometry=move_to_plane.Geometry, Material=colour_rgb_f_2)
mold_offset_as_percentage = Slider(1.123, range=0..10)

# ---- group: Make Bounding Box and Scale up for Mold
bounding_box = BoundingBox(Content=move_to_plane.Geometry, Plane=PlaneXY(0, 0, 0))  # -> Box, Box_2
evaluate_box = EvaluateBox(Box=bounding_box.Box, UParameter=0.5, VParameter=0.5, WParameter=0)  # -> Plane, Point, Include
scale_nu = ScaleNU(
    Geometry=bounding_box.Box,
    Plane=evaluate_box.Plane,
    ScaleX=mold_offset_as_percentage,
    ScaleY=mold_offset_as_percentage,
    ScaleZ=mold_offset_as_percentage)  # -> Geometry, Transform

bounding_box_2 = BoundingBox(Content=move_2.Geometry, Plane=PlaneXY(0, 0, 0))  # -> Box, Box_2
evaluate_box_2 = EvaluateBox(Box=bounding_box_2.Box, UParameter=0.5, VParameter=0.5, WParameter=0)  # -> Plane, Point, Include
scale_nu_2 = ScaleNU(
    Geometry=bounding_box_2.Box,
    Plane=evaluate_box_2.Plane,
    ScaleX=mold_offset_as_percentage,
    ScaleY=mold_offset_as_percentage,
    ScaleZ=mold_offset_as_percentage)  # -> Geometry, Transform

# ---- group: Cut Mold
solid_difference = SolidDifference(BrepsA=scale_nu.Geometry, BrepsB=move_to_plane.Geometry)

solid_difference_2 = SolidDifference(BrepsA=scale_nu_2.Geometry, BrepsB=move_2.Geometry)

# ---- group: Flip Upside-Down
yz_plane_2 = YZPlane(Origin=evaluate_box.Point)
rotate_2 = Rotate(Geometry=solid_difference, Angle=3.141592654, Plane=yz_plane_2)  # -> Geometry, Transform

yz_plane_3 = YZPlane(Origin=evaluate_box_2.Point)
rotate_3 = Rotate(Geometry=solid_difference_2, Angle=3.141592654, Plane=yz_plane_3)  # -> Geometry, Transform

# ---- group: Create Split Mold for Undercut Models
xz_plane = XZPlane(Origin=evaluate_box.Point)
move_to_plane_2 = MoveToPlane(Geometry=rotate_2.Geometry, Plane=PlaneXY(0, 0, 0), Above=True, Below=True)  # -> Geometry, Transform
plane_surface = PlaneSurface(Plane=xz_plane, XSize=Domain(-100, 100), YSize=Domain(-100, 100))
split_brep = SplitBrep(Brep=move_to_plane_2.Geometry, Cutter=plane_surface)
group = Group(Objects=split_brep)

xz_plane_2 = XZPlane(Origin=evaluate_box_2.Point)
move_to_plane_3 = MoveToPlane(Geometry=rotate_3.Geometry, Plane=PlaneXY(0, 0, 0), Above=True, Below=True)  # -> Geometry, Transform
plane_surface_2 = PlaneSurface(Plane=xz_plane_2, XSize=Domain(-100, 100), YSize=Domain(-100, 100))
split_brep_2 = SplitBrep(Brep=move_to_plane_3.Geometry, Cutter=plane_surface_2)
group_2 = Group(Objects=split_brep_2)

# ----
y_position = Slider(18.7, range=0..100)

# ---- group: Shift Back for Visibilitiy
unit_y = UnitY(Factor=y_position)
move_3 = Move(Geometry=[move_to_plane_3.Geometry, group_2], Motion=unit_y)  # -> flatten(Geometry), Transform

unit_y_2 = UnitY(Factor=y_position)
move_4 = Move(Geometry=[move_to_plane_2.Geometry, group], Motion=unit_y_2)  # -> flatten(Geometry), Transform

# ---- group: Check which mold to choose
larger_than = LargerThan(FirstNumber=calories, SecondNumber=1)  # -> LargerThan, OrEqualTo

# ---- group: Get Correct Mold
list_item_3 = ListItem(List=move_3.Geometry, Index=larger_than.LargerThan, Wrap=True)
ungroup = Ungroup(Group=list_item_3)

list_item_4 = ListItem(List=move_4.Geometry, Index=larger_than.LargerThan, Wrap=True)
ungroup_2 = Ungroup(Group=list_item_4)

# ----
colour_swatch = ColourSwatch(SwatchColor=RGB(71, 167, 191))
custom_preview_5 = CustomPreview(Geometry=ungroup, Material=colour_swatch)
custom_preview_6 = CustomPreview(Geometry=ungroup_2, Material=colour_swatch)

# ----
# Bake This for Everything
# |
# |
# V
geometry = Geometry([move_2.Geometry, move_to_plane.Geometry, cap_holes, cap_holes_2, ungroup, ungroup_2])
