# Grasshopper definition image-utilities-definition.gh (Grasshopper 1.0.7)

# ---- group: Build Grid of Samples
width_and_height_for_sampling = Slider(1, range=0..1)
y_samples = Slider(50, range=0..100)
x_samples = Slider(50, range=0..100)
division = Division(A=width_and_height_for_sampling, B=x_samples)
square = Square(Plane=PlaneXY(0, 0, 0), Size=division, ExtentX=x_samples, ExtentY=y_samples)  # -> Cells, flatten(Points)

# ----
image_sampler = ImageSampler(
    square.Points,
    FilePath="/Users/zap/Desktop/7A715AD8-449D-4B5A-ABA2C5D92D9B5A21_source.png",
    Filter="Value",
    Interpolate=False,
    Umax=1,
    Umin=0,
    Vmax=1,
    Vmin=0,
    Wrap=1)
image_sampler_2 = ImageSampler(
    square.Points,
    FilePath="/Users/zap/Desktop/7A715AD8-449D-4B5A-ABA2C5D92D9B5A21_source.png",
    Filter="Colour",
    Interpolate=False,
    Umax=1,
    Umin=0,
    Vmax=1,
    Vmin=0,
    Wrap=1)

# ---- group: Shuffle Positions
shuffle_amount = Slider(0, range=0..1)
jitter = Jitter(List=image_sampler, Jitter=shuffle_amount, Seed=2)  # -> Values, Indices

# ---- group: Scale to Desired Size
height = Slider(5.5, range=0..10)
width = Slider(5.5, range=0..10)
scale_nu = ScaleNU(Geometry=square.Points, Plane=PlaneXY(0, 0, 0), ScaleX=width, ScaleY=height, ScaleZ=1)  # -> Geometry, Transform

# ---- group: Rebuild Points with Data
deconstruct = Deconstruct(Point=square.Points)  # -> XComponent, YComponent, ZComponent
construct_point = ConstructPoint(XCoordinate=deconstruct.XComponent, YCoordinate=deconstruct.YComponent, ZCoordinate=jitter.Values)

# ---- group: Draw Polygons at Each Grid Point
polygon_type = Slider(5, range=3..10)
radius = Slider(0.046, range=0..1)
polygon = Polygon(Plane=scale_nu.Geometry, Radius=radius, Segments=polygon_type, FilletRadius=0)  # -> Polygon, Length

# ---- group: Create Mesh
delaunay_mesh = DelaunayMesh(Points=flatten(construct_point), Plane=PlaneXY(0, 0, 0))

# ---- group: Scale to Desired Size
height_2 = Slider(4.6, range=0..10)
width_2 = Slider(5.5, range=0..10)
max_height = Slider(2.9, range=0..10)
scale_nu_2 = ScaleNU(Geometry=delaunay_mesh, Plane=PlaneXY(0, 0, 0), ScaleX=width_2, ScaleY=height_2, ScaleZ=max_height)  # -> Geometry, Transform

# ---- group: Generate Random Scatter Vectors
scatter_amount = Slider(0, range=0..10)
negative = Negative(Value=scatter_amount)
construct_domain = ConstructDomain(DomainStart=negative, DomainEnd=scatter_amount)
list_length = ListLength(List=polygon.Polygon)
random = Random(Range=construct_domain, Number=list_length, Seed=2)
random_2 = Random(Range=construct_domain, Number=list_length, Seed=245)
vector_xyz = VectorXYZ(XComponent=random, YComponent=random_2, ZComponent=0)  # -> Vector, Length

# ---- group: Take Apart and Rebuild Mesh
deconstruct_mesh = DeconstructMesh(Mesh=scale_nu_2.Geometry)  # -> Vertices, Faces, Colours, Normals
construct_mesh = ConstructMesh(Vertices=deconstruct_mesh.Vertices, Faces=deconstruct_mesh.Faces, Colours=image_sampler_2)

# ---- group: Smooth Mesh
smoothness = Slider(5, range=0..10)
smooth_mesh = SmoothMesh(Mesh=construct_mesh, Strength=0.5, SkipNaked=True, Iterations=smoothness)

# ---- group: Scatter Polygons
move = Move(Geometry=polygon.Polygon, Motion=vector_xyz.Vector)  # -> Geometry, Transform

# ---- group: Shift Over
unit_x = UnitX(Factor=Slider(6, range=0..100))
move_2 = Move(Geometry=smooth_mesh, Motion=unit_x)  # -> Geometry, Transform

# ----
custom_preview = CustomPreview(Geometry=move.Geometry, Material=image_sampler_2)
