# Grasshopper definition minesweeper-definition.gh (Grasshopper 1.0.7)
# plug-ins: LunchBox

# ---- group: Board Size
width = Slider(25, range=0..100)
height = Slider(14, range=0..100)
rectangle = Rectangle(Plane=PlaneXY(0, 0, 0), XSize=width, YSize=height, Radius=0)  # -> Rectangle, Length

# ---- group: Tile Plane
x_count = Slider(33, range=0..100)
y_count = Slider(20, range=0..100)
quad_panels = QuadPanels(Surface=rectangle.Rectangle, UDivisions=x_count, VDivisions=y_count)
brep_edges = BrepEdges(Brep=quad_panels)  # -> Naked, Interior, NonManifold
join_curves = JoinCurves(Curves=brep_edges.Naked, Preserve=False)

# ----
y_samples = Slider(50, range=0..100)
x_samples = Slider(100, range=0..100)
mesh_plane = MeshPlane(Boundary=rectangle.Rectangle, WidthCount=x_samples, HeightCount=y_samples)  # -> Mesh, Area

# ---- group: Place Random Mines
populate_2d = Populate2D(Region=rectangle.Rectangle, Count=Slider(12, range=0..100), Seed=1)
populate_2d_2 = Populate2D(Region=rectangle.Rectangle, Count=Slider(21, range=0..100), Seed=11)

# ----
deconstruct_mesh = DeconstructMesh(Mesh=mesh_plane.Mesh)  # -> Vertices, Faces, Colours, Normals

# ---- group: Draw Spherical Mines
sphere = Sphere(Base=populate_2d, Radius=Slider(1.45, range=0..10))
sphere_2 = Sphere(Base=populate_2d_2, Radius=Slider(0.75, range=0..10))

# ---- group: Check if Cell is Mined
point_in_curve = PointInCurve(Point=populate_2d, Curve=join_curves)  # -> Relationship, Point
point_in_curve_2 = PointInCurve(Point=populate_2d_2, Curve=join_curves)  # -> Relationship, Point
larger_than = LargerThan(FirstNumber=point_in_curve.Relationship, SecondNumber=0)  # -> simplify(LargerThan), OrEqualTo
larger_than_2 = LargerThan(FirstNumber=point_in_curve_2.Relationship, SecondNumber=0)  # -> simplify(LargerThan), OrEqualTo
mass_addition = MassAddition(Input=[larger_than_2.LargerThan, larger_than.LargerThan])  # -> Result, PartialResults

# ---- group: Union Mines Together if Possible
solid_union = SolidUnion(Breps=[sphere, sphere_2])

# ---- group: Check if Each Point is in any Mine
point_in_brep = PointInBrep(Brep=solid_union, Point=graft(deconstruct_mesh.Vertices), Strict=True)
mass_addition_2 = MassAddition(Input=point_in_brep)  # -> flatten(Result), PartialResults

# ---- group: Shift Board Back
unit_y = UnitY(Factor=Slider(18, range=0..100))
move = Move(Geometry=quad_panels, Motion=unit_y)  # -> Geometry, Transform

# ---- group: Convert Mine Count Per Tile to Color
bounds = Bounds(Numbers=flatten(mass_addition.Result))
remap_numbers = RemapNumbers(Value=mass_addition.Result, Source=bounds, Target=Domain(0, 1))  # -> Mapped, Clipped
gradient = Gradient(LowerLimit=0, UpperLimit=1, Parameter=remap_numbers.Mapped, stops=[0: RGB(255, 255, 255), 1: RGB(0, 0, 0)])

# ---- group: Separate Points Inside Mines from Those Outside
sift_pattern = SiftPattern(List=deconstruct_mesh.Vertices, SiftPattern=mass_addition_2.Result)  # -> Output0, Output1

# ---- group: Pull Inside Points to Nearest Mine
pull_point = PullPoint(Point=sift_pattern.Output1, Geometry=solid_union, ClosestOnly=True)  # -> ClosestPoint, Distance

# ---- group: Push Exploded Points Down Rather than Out
unit_z = UnitZ(Factor=pull_point.Distance)
negative = Negative(Value=unit_z)
move_2 = Move(Geometry=sift_pattern.Output1, Motion=negative)  # -> Geometry, Transform

# ----
custom_preview = CustomPreview(Geometry=simplify(graft(move.Geometry)), Material=gradient)

# ---- group: Put List of Points Back Together
combine_data = CombineData(Input0=sift_pattern.Output0, Input1=move_2.Geometry)  # -> Result, Index

# ---- group: Remap Explosion Distance to Gradient Color
deconstruct = Deconstruct(Point=combine_data.Result)  # -> XComponent, YComponent, ZComponent
flipped_parameterized_domain_to_flip_gra = Panel("1 to 0")  # "Flipped Parameterized Domain to Flip Gradient"
bounds_2 = Bounds(Numbers=deconstruct.ZComponent)
remap_numbers_2 = RemapNumbers(Value=deconstruct.ZComponent, Source=bounds_2, Target=flipped_parameterized_domain_to_flip_gra)  # -> Mapped, Clipped
gradient_2 = Gradient(LowerLimit=0, UpperLimit=1, Parameter=remap_numbers_2.Mapped, stops=[0: RGB(255, 255, 255), 1: RGB(0, 0, 0)])

# ----
construct_mesh = ConstructMesh(Vertices=combine_data.Result, Faces=deconstruct_mesh.Faces, Colours=gradient_2)
