# Grasshopper definition patent-topography-definition.gh (Grasshopper 1.0.7)
# plug-ins: Weaverbird

# ---- group: Read File and Parse Data
# Disconnect "State Fips Code" Slider to see all US
state_fips_code = Slider(17, range=0..100)
year = Slider(2010, range=0..10000)
# Python Code: import rhinoscriptsyntax as rs
# import ghpythonlib.treehelpers as th
# import csv
# 
# data = []
# 
# with open(patentPath, 'r') as csvfile:
# 	csvReader = csv.reader(csvfile, delimiter=',', quotechar='"')
# 	#fields = next(csvReader)
# 	next(csvReader)
# 	for row in csvReader :
#  		if stateCode:
# 			if (int(row[5]) == int(year)) and (int(row[1][0:2]) == stateCode):
# 				data.append(row)
# 		else:
# 			if (int(row[5]) == int(year)):
# 				data.append(row)
# 
# layerTree = th.list_to_tree(data, source=[0,0])
# 
# a = layerTree
boolean_toggle = BooleanToggle(True)
ghpython_script = GhPythonScript(patentPath="/Users/zap/Desktop/catherine-patents/data.csv", year=year, contiguous=boolean_toggle)  # -> out, simplify(a); inputs year: Int32, stateCode: Int32
# ---------- ghpython_script: Python ----------
__author__ = "zap"

import rhinoscriptsyntax as rs
import ghpythonlib.treehelpers as th
import csv

data = []

with open(patentPath, 'r') as csvfile:
	csvReader = csv.reader(csvfile, delimiter=',', quotechar='"')
	#fields = next(csvReader)
	next(csvReader)
	for row in csvReader :
		if stateCode:
			if (int(row[5]) == int(year)) and (int(row[1][0:2]) == stateCode): 
				if contiguous == True:
 					if (row[2] != "hi") and (row[2] != "ak"):
						data.append(row)
				else:
					data.append(row)		
		else: 
			if (int(row[5]) == int(year)): 
				if contiguous == True:
					if (row[2] != "hi") and (row[2] != "ak"):
						data.append(row)
				else:
					data.append(row)

layerTree = th.list_to_tree(data, source=[0,0])

a = layerTree
# ---------- end ghpython_script ----------
errors = Panel(ghpython_script.out)

# ----
panel = Panel("Update Path")

# ---- group: Break Out Columns
list_item = ListItem(List=ghpython_script.a, Index=0, Wrap=True)  # -> CountyName, FIPSCode, State2LetterCode, Item3, Coordinate, Item5, TotalPatents, ClassAShare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

# ---- group: Strip Structure and Unnecessary Characters
flatten_tree = FlattenTree(Tree=list_item.Coordinate, Path="{0}")
replace_text = ReplaceText(Text=flatten_tree, Find="[", RecursiveReplace=False)
replace_text_2 = ReplaceText(Text=replace_text, Find="]", RecursiveReplace=False)
replace_text_3 = ReplaceText(Text=replace_text_2, Find="'", RecursiveReplace=False)

# ---- group: Remap Data
multiplication = Multiplication(A=list_item.ClassBShare, B=list_item.TotalPatents)
desired_height = Slider(2.5, range=0..10)
bounds = Bounds(Numbers=flatten(multiplication))
remap_numbers = RemapNumbers(Value=multiplication, Source=bounds, Target=desired_height)  # -> flatten(Mapped), Clipped

# ---- group: Split Coordinates and Make Points
text_split = TextSplit(Text=replace_text_3, Separators=",")
numbers_to_points = NumbersToPoints(Numbers=text_split, Mask=2)  # -> flatten(Points)

# ---- group: Move to Origin
bounding_box = BoundingBox(Content=numbers_to_points, Plane=PlaneXY(0, 0, 0), UnionBox=True)  # -> Box, Box_2
volume = Volume(Geometry=bounding_box.Box)  # -> Volume, Centroid
construct_point = ConstructPoint(XCoordinate=0, YCoordinate=0, ZCoordinate=0)
vector_2pt = Vector2Pt(PointA=volume.Centroid, PointB=construct_point, Unitize=False)  # -> Vector, Length
move = Move(Geometry=numbers_to_points, Motion=vector_2pt.Vector)  # -> Geometry, Transform

# ---- group: Scale to 1 Width
bounding_box_2 = BoundingBox(Content=move.Geometry, Plane=PlaneXY(0, 0, 0), UnionBox=True)  # -> Box, Box_2
deconstruct_box = DeconstructBox(Box=bounding_box_2.Box)  # -> Plane, X, Y, Z
scale = Scale(Geometry=move.Geometry, Center=Point(0, 0, 0), Factor=expr("1/x", deconstruct_box.X))  # -> Geometry, Transform

# ---- group: Scale to Desireed Size
desired_width = Slider(12.4, range=0..100)
scale_2 = Scale(Geometry=scale.Geometry, Center=Point(0, 0, 0), Factor=desired_width)  # -> Geometry, Transform

# ---- group: Rebuild Points with Data
deconstruct = Deconstruct(Point=simplify(scale_2.Geometry))  # -> XComponent, YComponent, ZComponent
construct_point_2 = ConstructPoint(XCoordinate=deconstruct.XComponent, YCoordinate=deconstruct.YComponent, ZCoordinate=remap_numbers.Mapped)

# ---- group: Make Mesh
delaunay_mesh = DelaunayMesh(Points=flatten(construct_point_2), Plane=PlaneXY(0, 0, 0))

# ----
face_circles = FaceCircles(Mesh=delaunay_mesh)  # -> Centers, Ratio
project = Project(Geometry=face_circles.Centers, Plane=PlaneXY(0, 0, 0))  # -> Geometry, Transform
area = Area(Geometry=project.Geometry)  # -> Area, Centroid

# ---- group: Kill Big Faces
larger_than = LargerThan(FirstNumber=area.Area, SecondNumber=Slider(1.87, range=0..10))  # -> flatten(LargerThan), OrEqualTo
cull_faces = CullFaces(Mesh=delaunay_mesh, Pattern=larger_than.LargerThan)

# ---- group: Make Smooth Mesh
smoothness = Slider(2, range=0..3)
weaverbird_s_catmull_clark_subdivision = WeaverbirdsCatmullClarkSubdivision(MeshCurves=cull_faces, Level=smoothness, SmoothNakedEdges=0)

# ----
custom_preview = CustomPreview(Geometry=weaverbird_s_catmull_clark_subdivision, Material=ColourSwatch(SwatchColor=RGB(109, 57, 230)))
