# Grasshopper definition soundwave-harp-definition.gh (Grasshopper 1.0.7)

# ---- group: Create Box and Extract Edges
box_size = Slider(10, range=0..10)
domain_box = DomainBox(Base=PlaneXY(0, 0, 0), X=box_size, Y=box_size, Z=box_size)
brep_edges = BrepEdges(Brep=domain_box)  # -> Naked, Interior, NonManifold

# ---- group: Find Box Edges
list_item = ListItem(List=brep_edges.Interior, Index=0, Wrap=True)
list_item_2 = ListItem(List=brep_edges.Interior, Index=Slider(3, range=0..10), Wrap=True)
list_item_3 = ListItem(List=brep_edges.Interior, Index=Slider(8, range=0..10), Wrap=True)
list_item_4 = ListItem(List=brep_edges.Interior, Index=Slider(7, range=0..10), Wrap=True)

# ---- group: Frame
frame_radius = Slider(0.25, range=0..1)
pipe = Pipe(Curve=[list_item_4, list_item_3, list_item_2, list_item], Radius=frame_radius, Caps=2)

# ---- group: Get Points along Edges
string_count = Slider(30, range=0..100)
range = Range(Domain=Domain(0, 1), Steps=expr("x-1", string_count))
evaluate_curve = EvaluateCurve(Curve=reparameterize(list_item), Parameter=range)  # -> Point, Tangent, Angle
evaluate_curve_2 = EvaluateCurve(Curve=reparameterize(list_item_4), Parameter=range)  # -> Point, Tangent, Angle

# ----
custom_preview = CustomPreview(Geometry=pipe, Material=ColourSwatch(SwatchColor=RGB(84, 84, 84)))

# ---- group: Draw Lines
line = Line(StartPoint=evaluate_curve.Point, EndPoint=evaluate_curve_2.Point)

# ---- group: Random Data
samples_per_string = Slider(107, range=0..200)
list_length = ListLength(List=line)
series = Series(Start=0, Step=1, Count=list_length)
random = Random(Range=Domain(0, 1), Number=samples_per_string, Seed=series)  # -> simplify(Random)

# ---- group: Prevent Twisting of Beginning and End of Wire
start_percentage = Slider(0.15, range=0..1)
end_percentage = Slider(0.85, range=0..1)
construct_domain = ConstructDomain(DomainStart=start_percentage, DomainEnd=end_percentage)

# ----
point_movement = Slider(0.7, range=0..10)
negative = Negative(Value=point_movement)
construct_domain_2 = ConstructDomain(DomainStart=negative, DomainEnd=point_movement)
remap_numbers = RemapNumbers(Value=random, Source=Domain(0, 1), Target=construct_domain_2)  # -> Mapped, Clipped

# ---- group: Place Planes Evenly on STring
list_length_2 = ListLength(List=random)  # -> flatten(Length)
range_2 = Range(Domain=construct_domain, Steps=expr("x-1", list_length_2))
perp_frame = PerpFrame(Curve=reparameterize(graft(line)), Parameter=range_2)

# ---- group: Align Planes to Prevent Weird Twisting
list_item_5 = ListItem(List=flatten(perp_frame), Index=0, Wrap=True)
align_planes = AlignPlanes(Planes=perp_frame, Master=list_item_5)  # -> simplify(Planes)

# ---- group: Move Points
deconstruct_plane = DeconstructPlane(Plane=align_planes)  # -> Origin, XAxis, YAxis, ZAxis
amplitude = Amplitude(Vector=deconstruct_plane.YAxis, Amplitude=remap_numbers.Mapped)
move = Move(Geometry=deconstruct_plane.Origin, Motion=amplitude)  # -> Geometry, Transform

# ---- group: Insert Original Beginning and End Point Back In
end_points = EndPoints(Curve=line)  # -> Start, End
insert_items = InsertItems(List=move.Geometry, Item=simplify(graft(end_points.Start)), Indices=0, Wrap=True)  # -> simplify(List)
insert_items_2 = InsertItems(List=insert_items, Item=simplify(graft(end_points.End)), Indices=-1, Wrap=True)  # -> simplify(List)

# ---- group: Draw String
nurbs_curve = NurbsCurve(Vertices=insert_items_2, Degree=3, Periodic=False)  # -> Curve, Length, Domain

# ----
custom_preview_2 = CustomPreview(Geometry=nurbs_curve.Curve, Material=ColourSwatch(SwatchColor=RGB(255, 255, 255)))
