# Grasshopper definition story-attractor-definition.gh (Grasshopper 1.0.7)

text = Panel("""A Hare was making fun of the Tortoise one day for being so slow.
"Do you ever get anywhere?" he asked with a mocking laugh."Yes," replied the Tortoise, "and I get there sooner than you think. I'll run you a race and prove it." The Hare was much amused at the idea of running a race with the Tortoise, but for the fun of the thing he agreed. So the Fox, who had consented to act as judge, marked the distance and started the runners off. The Hare was soon far out of sight, and to make the Tortoise feel very deeply how ridiculous it was for him to try a race with a Hare, he lay down beside the course to take a nap until the Tortoise should catch up. The Tortoise meanwhile kept going slowly but steadily, and, after a time, passed the place where the Hare was sleeping. But the Hare slept on very peacefully; and when at last he did wake up, the Tortoise was near the goal. The Hare now ran his swiftest, but he could not overtake the Tortoise in time.""")

# ---- group: Extract Characters
characters = Characters(Text=text)  # -> Result, Unicode

# ---- group: Make Grid for Letters
column_count = Slider(30, range=0..100)
list_length = ListLength(List=characters.Result)
division = Division(A=list_length, B=column_count)
square = Square(Plane=PlaneXY(0, 0, 0), Size=1, ExtentX=column_count, ExtentY=division)  # -> Cells, Points

# ---- group: Shuffle Characters
jitter = Jitter(List=characters.Result, Jitter=Slider(0, range=0..1), Seed=2)  # -> Values, Indices

# ---- group: Make Top->Bottom and Left->Right
reverse_list = ReverseList(List=square.Cells)
flip_matrix = FlipMatrix(Data=reverse_list)  # -> flatten(Data)

# ---- group: Find Middle of Grid Cells
area = Area(Geometry=flip_matrix)  # -> Area, Centroid

# ---- group: Find Center of Entire Grid
bounding_box = BoundingBox(Content=area.Centroid, Plane=PlaneXY(0, 0, 0), UnionBox=True)  # -> Box, Box_2
volume = Volume(Geometry=bounding_box.Box_2)  # -> Volume, Centroid

# ---- group: Use Unicode Codes to Determine Color
bounds = Bounds(Numbers=characters.Unicode)
remap_numbers = RemapNumbers(Value=characters.Unicode, Source=bounds, Target=Domain(0, 1))  # -> Mapped, Clipped
gradient = Gradient(
    LowerLimit=0,
    UpperLimit=1,
    Parameter=remap_numbers.Mapped,
    stops=[0: RGB(0, 128, 0), 0.5: RGB(255, 255, 0), 1: RGB(255, 0, 0)])

# ---- group: Attract Grid Points to Center of Grid
attraction = Slider(5, range=0..100)
vector_2pt = Vector2Pt(PointA=area.Centroid, PointB=volume.Centroid, Unitize=False)  # -> Vector, Length
amplitude = Amplitude(Vector=vector_2pt.Vector, Amplitude=attraction)
move = Move(Geometry=area.Centroid, Motion=amplitude)  # -> Geometry, Transform

# ----
text_tag_3d = TextTag3D(Location=move.Geometry, Text=jitter.Values, Size=1, Colour=gradient, Justification=5)
