# Grasshopper definition textured-block-puzzle-definition.gh (Grasshopper 1.0.7)
# plug-ins: Weaverbird, Kangaroo2 Components

# ---- group: Calculate Day Percentage
panel = Panel("""0
94
105
139
273
358
365""")
division = Division(A=panel, B="365")

# ---- group: Assembled Size
domain_box = DomainBox(Base=PlaneXY(0, 0, 0), X=Slider(12, range=0..100), Y=Slider(4, range=0..100), Z=Slider(4, range=0..100))

# ---- group: Find the Middle of Each Datra Span
consecutive_domains = ConsecutiveDomains(Numbers=division, Additive=False)
deconstruct_domain = DeconstructDomain(Domain=consecutive_domains)  # -> graft(Start), graft(End)
average = Average(Input=[deconstruct_domain.Start, deconstruct_domain.End])  # -> flatten(ArithmeticMean)

# ---- group: How Near and Deep can points be on Y-Axis?
construct_domain = ConstructDomain(DomainStart=Slider(0.3, range=0..1), DomainEnd=Slider(0.7, range=0..1))

# ---- group: Data per Time Span
panel_2 = Panel("""5.5
2.5
9.2
1.8
.7
7.8""")
bounds = Bounds(Numbers=panel_2)
remap_numbers = RemapNumbers(Value=panel_2, Source=bounds, Target=construct_domain)  # -> Mapped, Clipped

# ---- group: Data Per Time span
panel_3 = Panel("""1.6
9.2
4.6
.6
2.5
7.2""")
bounds_2 = Bounds(Numbers=panel_3)
remap_numbers_2 = RemapNumbers(Value=panel_3, Source=bounds_2, Target=Domain(0, 1))  # -> Mapped, Clipped

# ---- group: Place Points in Box
evaluate_box = EvaluateBox(Box=domain_box, UParameter=average, VParameter=remap_numbers_2.Mapped, WParameter=remap_numbers.Mapped)  # -> Plane, Point, Include

# ---- group: Make Voronoi Cells
voronoi_3d = Voronoi3D(Points=evaluate_box.Point, Box=domain_box)  # -> Cells, Boundary

# ----
deconstruct_brep = DeconstructBrep(Brep=voronoi_3d.Cells)  # -> Faces, Edges, Vertices

# ---- group: Identify Outside Faces of Voronoi Cells
volume = Volume(Geometry=domain_box)  # -> Volume, Centroid
area = Area(Geometry=deconstruct_brep.Faces)  # -> Area, Centroid
scale = Scale(Geometry=domain_box, Center=volume.Centroid, Factor=Slider(0.99, range=0..1))  # -> Geometry, Transform
point_in_brep = PointInBrep(Brep=scale.Geometry, Point=area.Centroid, Strict=False)

# ---- group: Split Internal and External Faces
dispatch = Dispatch(List=deconstruct_brep.Faces, DispatchPattern=point_in_brep)  # -> ListA, ListB

# ---- group: Shift Center of Outside Faces Away from Center of Cell
volume_2 = Volume(Geometry=voronoi_3d.Cells)  # -> Volume, Centroid
area_2 = Area(Geometry=dispatch.ListB)  # -> Area, Centroid
move_away_from = MoveAwayFrom(Geometry=area_2.Centroid, Emitter=graft(volume_2.Centroid), Distance=Slider(1.06, range=0..10))  # -> simplify(graft(Geometry)), Transform

# ---- group: Collect Edges
brep_edges = BrepEdges(Brep=dispatch.ListB)  # -> Naked, Interior, NonManifold
join_curves = JoinCurves(Curves=brep_edges.Naked, Preserve=False)  # -> simplify(Curves)

# ---- group: Create Outer Face Pyramids
extrude_point = ExtrudePoint(Base=join_curves, Point=move_away_from.Geometry)

# ---- group: How Many Spikes?
construct_domain_2 = ConstructDomain(DomainStart=Slider(13, range=0..100), DomainEnd=Slider(100, range=0..100))

# ---- group: Remap Data
panel_4 = Panel("""9.2
3.6
0.5
2.6
.1
3.2""")
bounds_3 = Bounds(Numbers=panel_4)
remap_numbers_3 = RemapNumbers(Value=panel_4, Source=bounds_3, Target=construct_domain_2)  # -> Mapped, Clipped

# ---- group: Reconnect Cells
trim_tree = TrimTree(Tree=extrude_point, Depth=1)
merge = Merge(Data1=simplify(dispatch.ListA), Data2=trim_tree)
brep_join = BrepJoin(Breps=merge)  # -> flatten(Breps), Closed

# ---- group: How tall are the spikes?
construct_domain_3 = ConstructDomain(DomainStart=Slider(0, range=0..1), DomainEnd=Slider(0.2, range=0..1))

# ---- group: Remap Data
panel_5 = Panel("""5.5
2.1
.8
0.1
7.5""")
bounds_4 = Bounds(Numbers=panel_5)
remap_numbers_4 = RemapNumbers(Value=panel_5, Source=bounds_4, Target=construct_domain_3)  # -> Mapped, Clipped

# ---- group: Color Based on Volume
volume_3 = Volume(Geometry=brep_join.Breps)  # -> Volume, Centroid
bounds_5 = Bounds(Numbers=volume_3.Volume)
remap_numbers_5 = RemapNumbers(Value=volume_3.Volume, Source=bounds_5, Target=Domain(0, 1))  # -> Mapped, Clipped
gradient = Gradient(LowerLimit=0, UpperLimit=1, Parameter=remap_numbers_5.Mapped, stops=[0: RGB(234, 38, 0), 1: RGB(75, 107, 169)])

# ---- group: Create Mesh
settings_custom = SettingsCustom(
    StitchSeams=True,
    SimplePlanes=False,
    Refine=True,
    MinCount=remap_numbers_3.Mapped,
    MaxCount=remap_numbers_3.Mapped,
    AspectRatio=20,
    MaxDistance=0,
    MaxAngle=20,
    MinEdge=0,
    MaxEdge=0)
mesh_brep = MeshBrep(Brep=brep_join.Breps, Settings=settings_custom)

# ---- group: Spread Out
construct_domain_4 = ConstructDomain(DomainStart=Slider(17, range=0..100), DomainEnd=Slider(33, range=0..100))
list_length = ListLength(List=brep_join.Breps)
range = Range(Domain=construct_domain_4, Steps=expr("x-1", list_length))
unit_x = UnitX(Factor=range)
move = Move(Geometry=brep_join.Breps, Motion=unit_x)  # -> Geometry, Transform

# ---- group: Create Textured Meshes
negative = Negative(Value=remap_numbers_4.Mapped)
weaverbird_s_stellate_cumulation = WeaverbirdsStellateCumulation(MeshPolylines=graft(mesh_brep), Distance=graft(negative))

# ---- group: Shift Back
unit_y = UnitY(Factor=Slider(8, range=0..100))
move_2 = Move(Geometry=weaverbird_s_stellate_cumulation, Motion=unit_y)  # -> Geometry, Transform

# ----
custom_preview = CustomPreview(Geometry=brep_join.Breps, Material=gradient)

# ---- group: Clean Up Messy Meshes
combine_clean = CombineClean(Meshes=move_2.Geometry)
weaverbird_s_unify_face_windings = WeaverbirdsUnifyFaceWindings(MeshCurves=combine_clean)

# ----
custom_preview_2 = CustomPreview(Geometry=move.Geometry, Material=gradient)

# ---- group: Smooth
weaverbird_s_catmull_clark_subdivision = WeaverbirdsCatmullClarkSubdivision(MeshCurves=weaverbird_s_unify_face_windings, Level=1, SmoothNakedEdges=1)  # -> flatten(OutputMeshCurves)

# ---- group: Spread Out
construct_domain_5 = ConstructDomain(DomainStart=Slider(17, range=0..100), DomainEnd=Slider(33, range=0..100))
list_length_2 = ListLength(List=weaverbird_s_catmull_clark_subdivision)
range_2 = Range(Domain=construct_domain_5, Steps=expr("x-1", list_length_2))
unit_x_2 = UnitX(Factor=range_2)
move_3 = Move(Geometry=weaverbird_s_catmull_clark_subdivision, Motion=unit_x_2)  # -> Geometry, Transform

# ----
custom_preview_3 = CustomPreview(Geometry=weaverbird_s_catmull_clark_subdivision, Material=gradient)
custom_preview_4 = CustomPreview(Geometry=move_3.Geometry, Material=gradient)
