# Grasshopper definition data-helix-lamp-definition.gh (Grasshopper 1.0.7)
# plug-ins: Weaverbird, Kangaroo2 Components

smoothness_of_helix = Slider(100, range=0..100)
range = Range(Domain=Domain(0, 1), Steps=smoothness_of_helix)
max_radius = Slider(5.6, range=0..10)
graph_mapper = GraphMapper(
    range,
    x0=0,
    x1=1,
    y0=0,
    y1=1,
    container_name="Bezier",
    cpx=[0, 0, 1, 1],
    cpy=[0.5385946035, 0.8001815081, 0.7028525472, 0])
multiplication = Multiplication(A=graph_mapper, B=max_radius)

# ---- group: Create Circular-Place Numbers
spins = Slider(1, range=0..10)
pi = Pi(Factor=2)
multiplication_2 = Multiplication(A=pi, B=spins)
range_2 = Range(Domain=multiplication_2, Steps=smoothness_of_helix)
cosine = Cosine(Value=range_2)
sine = Sine(Value=range_2)

# ---- group: Increase in Height
height = Slider(16.22, range=0..20)
range_3 = Range(Domain=height, Steps=smoothness_of_helix)

# ---- group: Build Helix
multiplication_3 = Multiplication(A=cosine, B=multiplication)
multiplication_4 = Multiplication(A=sine, B=multiplication)
construct_point = ConstructPoint(XCoordinate=multiplication_3, YCoordinate=multiplication_4, ZCoordinate=range_3)
interpolate = Interpolate(Vertices=construct_point, Degree=3, Periodic=False, KnotStyle=1)  # -> Curve, Length, Domain

# ----
wake_up_minute = Panel("""65
100
124
156
25
14
177""")
fall_asleep_minute = Panel("""09
17
07
44
06
21
20""")

# ---- group: Remap Data
construct_domain = ConstructDomain(DomainStart=Slider(0.06, range=0..1), DomainEnd=Slider(2.05, range=0..10))
bounds = Bounds(Numbers=wake_up_minute)
remap_numbers = RemapNumbers(Value=wake_up_minute, Source=bounds, Target=construct_domain)  # -> Mapped, Clipped

construct_domain_2 = ConstructDomain(DomainStart=Slider(0.1, range=0..1), DomainEnd=Slider(2, range=0..10))
bounds_2 = Bounds(Numbers=fall_asleep_minute)
remap_numbers_2 = RemapNumbers(Value=fall_asleep_minute, Source=bounds_2, Target=construct_domain_2)  # -> Mapped, Clipped

# ---- group: Create Additional Helices
polar_array = PolarArray(Geometry=interpolate.Curve, Plane=PlaneXY(0, 0, 0), Count=Slider(4, range=0..10), Angle=6.283185307)  # -> Geometry, Transform
list_item = ListItem(List=polar_array.Geometry, Index=1, Wrap=True)
list_item_2 = ListItem(List=polar_array.Geometry, Index=3, Wrap=True)

# ---- group: Put a Zero at the Start and End of Dataset So Helix End Points Stay Aligned
panel = Panel("""0
-1""")
insert_items = InsertItems(List=remap_numbers.Mapped, Item=0, Indices=panel, Wrap=True)

panel_2 = Panel("""0
-1""")
insert_items_2 = InsertItems(List=remap_numbers_2.Mapped, Item=0, Indices=panel_2, Wrap=True)

# ---- group: Get Specific Helix
list_item_3 = ListItem(List=polar_array.Geometry, Index="0", Wrap=True)

list_item_4 = ListItem(List=polar_array.Geometry, Index="2", Wrap=True)

# ---- group: Evenly Divide Helix
list_length = ListLength(List=insert_items_2)
perp_frames = PerpFrames(Curve=list_item_4, Count=expr("x-1", list_length), Align=True)  # -> Frames, Parameters
deconstruct_plane = DeconstructPlane(Plane=perp_frames.Frames)  # -> Origin, XAxis, YAxis, ZAxis

list_length_2 = ListLength(List=insert_items)
perp_frames_2 = PerpFrames(Curve=list_item_3, Count=expr("x-1", list_length_2), Align=True)  # -> Frames, Parameters
deconstruct_plane_2 = DeconstructPlane(Plane=perp_frames_2.Frames)  # -> Origin, XAxis, YAxis, ZAxis

# ---- group: Move Up with Data
unit_z = UnitZ(Factor=insert_items)
move = Move(Geometry=deconstruct_plane_2.Origin, Motion=unit_z)  # -> Geometry, Transform

# ---- group: Move Down with Data
unit_z_2 = UnitZ(Factor=insert_items_2)
negative = Negative(Value=unit_z_2)
move_2 = Move(Geometry=deconstruct_plane.Origin, Motion=negative)  # -> Geometry, Transform

# ----
wake_ups = Panel("""5
3
6
5
2
4
3""")

# ---- group: Draw Data Helices and Merge with Other Original Helices
interpolate_2 = Interpolate(Vertices=move.Geometry, Degree=3, Periodic=False, KnotStyle=1)  # -> flatten(Curve), Length, Domain
interpolate_3 = Interpolate(Vertices=move_2.Geometry, Degree=3, Periodic=False, KnotStyle=1)  # -> flatten(Curve), Length, Domain
merge = Merge(
    Data1=flatten(interpolate_2.Curve),
    Data2=flatten(list_item),
    Data3=flatten(interpolate_3.Curve),
    Data4=flatten(list_item_2))

# ---- group: Create Surfaces Between Sequential Helices
shift_list = ShiftList(List=merge, Shift=1, Wrap=True)
ruled_surface = RuledSurface(CurveA=merge, CurveB=shift_list)  # -> reparameterize(Surface)

# ---- group: How many holes in netting between helices
construct_domain_3 = ConstructDomain(DomainStart=Slider(37, range=0..100), DomainEnd=Slider(72, range=0..100))
bounds_3 = Bounds(Numbers=wake_ups)
remap_numbers_3 = RemapNumbers(Value=wake_ups, Source=bounds_3, Target=construct_domain_3)  # -> Mapped, Clipped

# ---- group: How Many Holes in Netting Along Helix
bounds_4 = Bounds(Numbers=wake_ups)
construct_domain_4 = ConstructDomain(DomainStart=Slider(9, range=0..100), DomainEnd=Slider(41, range=0..100))
remap_numbers_4 = RemapNumbers(Value=wake_ups, Source=bounds_4, Target=construct_domain_4)  # -> Mapped, Clipped

# ---- group: Slice up Surfaces Into Horizontal Strips
list_length_3 = ListLength(List=wake_ups)
divide_domain² = DivideDomain²(Domain=ruled_surface, UCount=list_length_3, VCount=1)
isotrim = Isotrim(Surface=graft(ruled_surface), Domain=divide_domain²)

# ---- group: Convert to Structured Mesh
mesh_surface = MeshSurface(Surface=simplify(isotrim), UCount=remap_numbers_4.Mapped, VCount=remap_numbers_3.Mapped, Overhang=True, Equalize=False)

# ---- group: Min and Max Percentage of Openings
construct_domain_5 = ConstructDomain(DomainStart=Slider(5, range=0..100), DomainEnd=Slider(12, range=0..100))

# ---- group: Clean Up Mesh
combine_clean = CombineClean(Meshes=flatten(mesh_surface))

# ---- group: Generate Random Numbers Per Each Face
face_boundaries = FaceBoundaries(Mesh=combine_clean)
list_length_4 = ListLength(List=face_boundaries)
random = Random(Range=construct_domain_5, Number=list_length_4, Seed=2)

# ---- group: Create Holes in Mesh
weaverbird_s_picture_frame = WeaverbirdsPictureFrame(MeshPolylines=combine_clean, Distance=random, InsetType=0)

# ----
custom_preview = CustomPreview(Geometry=weaverbird_s_picture_frame, Material=ColourSwatch(SwatchColor=RGB(84, 73, 2)))
