# Grasshopper definition sakura-v4-definition.gh (Grasshopper 1.0.7)
# plug-ins: Human, LunchBox

# ---- group: Me sakura data
me_sakura_data = Panel("""AD,Full-flowering date (DOY),Full-flowering date
1988,106,415
1989,93,403
1990,88,329
1991,97,407
1992,94,403
1993,97,407
1994,99,409
1995,99,409
1996,103,412
1997,97,407
1998,91,401
1999,94,404
2000,100,409
2001,96,406
2002,91,401
2003,98,408
2004,92,401
2005,99,409
2006,98,408
2007,97,407
2008,95,404
2009,95,405
2010,95,405
2011,99,409
2012,101,410
2013,93,403
2014,94,404
2015,93,403
2016,94,404
2017,99,409""")
param_viewer = ParamViewer(me_sakura_data)

# ---- group: Mom sakura data
mom_sakura_data = Panel("""AD,Full-flowering date (DOY),Full-flowering date
1959,92,402
1960,95,404
1961,99,409
1962,102,412
1963,101,411
1964,99,408
1965,110,420
1966,97,407
1967,97,407
1968,99,408
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""")
# Mom sakura data: AD,Full-flowering date (DOY),Full-flowering date
# 1936,111,420
# 1937,100,410
# 1938,98,408
# 1939,104,414
# 1940,110,419
# 1941,100,410
# 1942,96,406
# 1943,101,411
# 1944,100,409
# 1945,,
# 1946,97,407
# 1947,107,417
# 1948,102,411
# 1949,107,417
# 1950,99,409
# 1951,98,408
# 1952,105,414
# 1953,101,411
# 1954,98,408
# 1955,97,407
# 1956,99,408
# 1957,103,413
# 1958,99,409
# 1959,92,402
# 1960,95,404
# 1961,99,409
# 1962,102,412
# 1963,101,411
# 1964,99,408
# 1965,110,420
# 1966,97,407
# 1967,97,407
# 1968,99,408
# 1969,101,411
# 1970,107,417
# 1971,98,408
# 1972,99,408
# 1973,97,407
# 1974,99,409
# 1975,100,410
# 1976,99,408
# 1977,93,403
# 1978,104,414
# 1979,97,407
# 1980,102,411
# 1981,99,409
# 1982,93,403
# 1983,99,409
# 1984,109,418
# 1985,99,409
# 1986,102,412
# 1987,95,405
# 1988,106,415
# 1989,93,403
# 1990,88,329
# 1991,97,407
# 1992,94,403
# 1993,97,407
# 1994,99,409
# 1995,99,409
# 1996,103,412
# 1997,97,407
# 1998,91,401
# 1999,94,404
# 2000,100,409
# 2001,96,406
# 2002,91,401
# 2003,98,408
# 2004,92,401
# 2005,99,409
# 2006,98,408
# 2007,97,407
# 2008,95,404
# 2009,95,405
# 2010,95,405
# 2011,99,409
# 2012,101,410
# 2013,93,403
# 2014,94,404
# 2015,93,403
# 2016,94,404
# 2017,99,409
param_viewer_2 = ParamViewer(mom_sakura_data)

# ---- group: Segment Data
split_list = SplitList(List=mom_sakura_data, Index=1)  # -> ListA, ListB
petal_count = Slider(5, range=0..10)
list_length = ListLength(List=split_list.ListB)
division = Division(A=list_length, B=petal_count)
partition_list = PartitionList(List=split_list.ListB, Size=division)

# ---- group: Split CSV
text_split = TextSplit(Text=partition_list, Separators=",")

# ----
list_item = ListItem(List=text_split, Index=0, Wrap=True)  # -> Item, Item1, Item2

# ---- group: Partially Flatten
trim_tree = TrimTree(Tree=list_item.Item1, Depth=1)

# ---- group: Scale Numbers
bounds = Bounds(Numbers=flatten(trim_tree))
construct_domain = ConstructDomain(DomainStart=Slider(5, range=0..10), DomainEnd=Slider(7.5, range=0..10))
remap_numbers = RemapNumbers(Value=trim_tree, Source=bounds, Target=construct_domain)  # -> Mapped, Clipped

# ---- group: Base of Petal
construct_point = ConstructPoint(XCoordinate=0, YCoordinate=0, ZCoordinate=0)

# ---- group: Define Spread of Petal
angular_radius_of_petal_arc = Slider(30, range=0..100)
negative = Negative(Value=angular_radius_of_petal_arc)
unit_y = UnitY(Factor=1)
radians = Radians(Degrees=[angular_radius_of_petal_arc, negative])
rotate = Rotate(Geometry=unit_y, Angle=radians, Plane=PlaneXY(0, 0, 0))  # -> Geometry, Transform
line_sdl = LineSDL(Start=construct_point, Direction=rotate.Geometry, Length=1)

# ---- group: Partially Flatten Years
trim_tree_2 = TrimTree(Tree=list_item.Item, Depth=1)

# ---- group: Draw Arc
end_points = EndPoints(Curve=line_sdl)  # -> Start, End
unit_y_2 = UnitY(Factor=1)
list_item_2 = ListItem(List=end_points.End, Index=0, Wrap=True)  # -> Item, Item1
arc_sed = ArcSED(Start=list_item_2.Item, End=list_item_2.Item1, Direction=unit_y_2)  # -> Arc, Plane, Radius

# ---- group: Cut Arc Evenly for Data Placement
list_length_2 = ListLength(List=remap_numbers.Mapped)
divide_curve = DivideCurve(Curve=arc_sed.Arc, Count=expr("x-1", list_length_2), Kinks=False)  # -> Points, Tangents, Parameters

# ---- group: Deterrmine placement for Each Data Point
vector_2pt = Vector2Pt(PointA=construct_point, PointB=divide_curve.Points, Unitize=False)  # -> Vector, Length
amplitude = Amplitude(Vector=vector_2pt.Vector, Amplitude=remap_numbers.Mapped)
move = Move(Geometry=construct_point, Motion=amplitude)  # -> Geometry, Transform

# ---- group: Draw Petal Lines From Center Out
number_slider = Slider(1.3, range=0..10)
construct_domain_2 = ConstructDomain(DomainStart=expr("-x", number_slider), DomainEnd=number_slider)
list_length_3 = ListLength(List=move.Geometry)  # -> flatten(Length)
range = Range(Domain=construct_domain_2, Steps=expr("x-1", list_length_3))
unit_x = UnitX(Factor=range)
unit_y_3 = UnitY(Factor=Slider(1.2, range=0..10))
bezier_span = BezierSpan(StartPoint=construct_point, StartTangent=unit_y_3, EndPoint=move.Geometry, EndTangent=unit_x)  # -> simplify(Curve), Length, Domain

# ---- group: Draw Top Edge of Petal
interpolate = Interpolate(Vertices=move.Geometry, Degree=3, Periodic=False, KnotStyle=1)  # -> Curve, Length, Domain

# ---- group: Draw Sides of petals
number_slider_2 = Slider(2.5, range=0..10)
number_slider_3 = Slider(0, range=-5..5)
unit_x_2 = UnitX(Factor=number_slider_3)
unit_x_3 = UnitX(Factor=number_slider_2)
end_points_2 = EndPoints(Curve=interpolate.Curve)  # -> Start, End
unit_x_4 = UnitX(Factor=number_slider_3)
unit_x_5 = UnitX(Factor=number_slider_2)
negative_2 = Negative(Value=unit_x_3)
negative_3 = Negative(Value=unit_x_2)
bezier_span_2 = BezierSpan(StartPoint=construct_point, StartTangent=unit_x_4, EndPoint=end_points_2.End, EndTangent=unit_x_5)  # -> Curve, Length, Domain
bezier_span_3 = BezierSpan(StartPoint=construct_point, StartTangent=negative_3, EndPoint=end_points_2.Start, EndTangent=negative_2)  # -> Curve, Length, Domain

# ---- group: Concentric Placemen
iso_curve_count = Slider(1, range=0..10)
construct_domain_3 = ConstructDomain(DomainStart=Slider(0.25, range=0..1), DomainEnd=Slider(0.65, range=0..1))
range_2 = Range(Domain=construct_domain_3, Steps=iso_curve_count)

# ---- group: Collect all Outwards Curves
merge = Merge(Data1=simplify(bezier_span_3.Curve), Data2=simplify(bezier_span.Curve), Data3=simplify(bezier_span_2.Curve))  # -> flatten(Result)

# ---- group: Annoying data manipulation for concentric rings
evaluate_curve = EvaluateCurve(Curve=reparameterize(graft(merge)), Parameter=range_2)  # -> Point, Tangent, Angle
list_length_4 = ListLength(List=merge)
merge_2 = Merge(Data1=simplify(bezier_span_3.Curve), Data2=simplify(bezier_span.Curve), Data3=simplify(bezier_span_2.Curve))
division_2 = Division(A=list_length_4, B=petal_count)
flip_matrix = FlipMatrix(Data=evaluate_curve.Point)  # -> flatten(Data)

# ----
list_length_5 = ListLength(List=merge_2)  # -> flatten(Length)
round = Round(Number=division_2)  # -> Nearest, Floor, Ceiling

# ---- group: Annoying data manipulation for concentric rings (continued)
partition_list_2 = PartitionList(List=flip_matrix, Size=list_length_5)
interpolate_2 = Interpolate(Vertices=partition_list_2, Degree=3, Periodic=False, KnotStyle=1)  # -> simplify(flatten(Curve)), Length, Domain
partition_list_3 = PartitionList(List=interpolate_2.Curve, Size=petal_count)
flip_matrix_2 = FlipMatrix(Data=partition_list_3)

# ---- group: Collect Curves fro Grouping
polyline = PolyLine(Vertices=move.Geometry, Closed=False)  # -> simplify(Polyline)
join_curves = JoinCurves(Curves=[bezier_span_3.Curve, bezier_span_2.Curve, interpolate.Curve], Preserve=False)  # -> simplify(Curves)
merge_3 = Merge(Data1=join_curves, Data2=bezier_span.Curve, Data3=simplify(flip_matrix_2), Data4=polyline)

# ---- group: Group Petals and Spread Out
group = Group(Objects=merge_3)
list_length_6 = ListLength(List=flatten(group))
range_3 = Range(Domain=Domain(0, 6.283185307), Steps=list_length_6)
cull_index = CullIndex(List=range_3, Indices=-1, Wrap=True)
reverse_list = ReverseList(List=cull_index)
rotate_2 = Rotate(Geometry=group, Angle=graft(reverse_list), Plane=PlaneXY(0, 0, 0))  # -> Geometry, Transform

# ---- group: Separate Items after Rotation
ungroup = Ungroup(Group=rotate_2.Geometry)
list_length_7 = ListLength(List=ungroup)
split_list_2 = SplitList(List=ungroup, Index=expr("x-1", list_length_7))  # -> ListA, ListB

# ----
split_list_3 = SplitList(List=split_list_2.ListA, Index=1)  # -> ListA, ListB

# ---- group: Radial Data Lines
curve = Curve(split_list_2.ListA)
custom_preview = CustomPreview(Geometry=curve, Material=ColourSwatch(SwatchColor=RGB(255, 255, 255)))

# ---- group: Make Petal Surface and Cut With Data
boundary_surfaces = BoundarySurfaces(Edges=split_list_3.ListA)  # -> simplify(Surfaces)
surface_split = SurfaceSplit(Surface=boundary_surfaces, Curves=split_list_3.ListB)  # -> simplify(Fragments)

# ---- group: Create Petal Outline
brep_edges = BrepEdges(Brep=surface_split)  # -> Naked, Interior, NonManifold
join_curves_2 = JoinCurves(Curves=brep_edges.Naked, Preserve=False)  # -> simplify(Curves)

# ---- group: 2D Visualization / Uncut Petals
colour_swatch = ColourSwatch(SwatchColor=RGB(237, 104, 169))
surface = Surface(boundary_surfaces)
custom_preview_2 = CustomPreview(Geometry=surface, Material=colour_swatch)

# ---- group: 2D Visualization
object_bake = ObjectBake(
    BakeToggle=Button(),
    GeometryObjects=surface,
    Layer="PETAL CONTOURS",
    ObjectName="GH_Obj",
    ObjectColor=colour_swatch,
    LayerColor=colour_swatch)

# ---- group: Create Cut Holes
trim_tree_3 = TrimTree(Tree=join_curves_2, Depth=1)
area = Area(Geometry=trim_tree_3)  # -> Area, Centroid
scale = Scale(Geometry=trim_tree_3, Center=area.Centroid, Factor=Slider(0.85, range=0..1))  # -> Geometry, Transform

# ----
resampling_count = Slider(50, range=0..100)
divide_curve_2 = DivideCurve(Curve=scale.Geometry, Count=resampling_count, Kinks=False)  # -> Points, Tangents, Parameters
smoothing_steps = Slider(3, range=0..10)
polyline_2 = PolyLine(Vertices=divide_curve_2.Points, Closed=True)
smooth_polyline = SmoothPolyline(Polyline=polyline_2, Strength=1, Times=smoothing_steps)
trim_tree_4 = TrimTree(Tree=smooth_polyline, Depth=1)

# ---- group: 2D Visualization / Text Labels
label_margin = Slider(1.5, range=0..10)
discontinuity = Discontinuity(Curve=split_list_2.ListB, Level=1)  # -> Points, Parameters
construct_point_2 = ConstructPoint(XCoordinate=0, YCoordinate=0, ZCoordinate=0)
move_away_from = MoveAwayFrom(Geometry=discontinuity.Points, Emitter=construct_point_2, Distance=label_margin)  # -> Geometry, Transform

# ----
circle_cnr = CircleCNR(Center=construct_point_2, Normal=Vector(0, 0, 1), Radius=Slider(8.2, range=0..10))
curve_closest_point = CurveClosestPoint(Point=discontinuity.Points, Curve=circle_cnr)  # -> Point, Parameter, Distance

curve_2 = Curve(simplify(split_list_3.ListA))

# ---- group: Create Circles for Center Alignment
center_circle_radius = Slider(0.38, range=0..1)
construct_point_3 = ConstructPoint(XCoordinate=0, YCoordinate=0, ZCoordinate=0)
circle_cnr_2 = CircleCNR(Center=construct_point_3, Normal=Vector(0, 0, 1), Radius=center_circle_radius)
list_length_8 = ListLength(List=flatten(curve_2))
duplicate_data = DuplicateData(Data=circle_cnr_2, Number=list_length_8, Order=True)  # -> simplify(graft(Data))

# ---- group: Concentric Axis Lines
interpolate_3 = Interpolate(Vertices=flatten(move_away_from.Geometry), Degree=3, Periodic=True, KnotStyle=1)  # -> Curve, Length, Domain
nurbs_curve = NurbsCurve(Vertices=flatten(move_away_from.Geometry), Degree=3, Periodic=False)  # -> Curve, Length, Domain
polyline_3 = PolyLine(Vertices=flatten(move_away_from.Geometry), Closed=True)
merge_4 = Merge(Data1=polyline_3, Data2=interpolate_3.Curve, Data3=nurbs_curve.Curve)
style = ValueList({"Polygonal": 0, "Smooth": 1, "Super Smooth": 2}, selected="Polygonal")
list_item_3 = ListItem(List=merge_4, Index=style, Wrap=True)
object_bake_2 = ObjectBake(
    BakeToggle=Button(),
    GeometryObjects=list_item_3,
    Layer="AXIS",
    ObjectName="GH_Obj",
    ObjectColor=RGB(255, 255, 255),
    LayerColor=RGB(255, 255, 255))

# ---- group: Cut Petals
region_difference = RegionDifference(CurvesA=boundary_surfaces, CurvesB=trim_tree_4)
boundary_surfaces_2 = BoundarySurfaces(Edges=region_difference)

# ---- group: 2D Visualization / Irregualr Labels
text_size = Slider(0.209, range=0..1)
justifiedtext3d = JustifiedText3d(
    Location=move_away_from.Geometry,
    Text=trim_tree_2,
    Size=text_size,
    Color=ColourSwatch(SwatchColor=RGB(255, 255, 255)),
    HorizontalAlignment=1,
    VerticalAlginment=1,
    Font="Futura Medium",
    UseMeshes=False,
    Bake=Button())

# ---- group: Circular Labels
text_size_2 = Slider(0.209, range=0..1)
justifiedtext3d_2 = JustifiedText3d(
    Location=curve_closest_point.Point,
    Text=trim_tree_2,
    Size=text_size_2,
    Color=ColourSwatch(SwatchColor=RGB(255, 255, 255)),
    HorizontalAlignment=1,
    VerticalAlginment=1,
    Font="Futura Medium",
    UseMeshes=False,
    Bake=Button())

# ---- group: Join Circles to Petals
region_union = RegionUnion(Curves=[duplicate_data, curve_2])  # -> simplify(Result)

# ---- group: Find Biggest Surface
area_2 = Area(Geometry=boundary_surfaces_2)  # -> Area, Centroid
sort_list = SortList(Keys=area_2.Area, ValuesValuesA=boundary_surfaces_2)  # -> Keys, ValuesValuesA
list_item_4 = ListItem(List=sort_list.ValuesValuesA, Index=-1, Wrap=True)  # -> flatten(Item)

# ----
curve_3 = Curve(trim_tree_4)

# ---- group: Hold Petals and Cuts Together
merge_5 = Merge(Data1=region_union, Data2=curve_3)
group_2 = Group(Objects=merge_5)

# ---- group: Move Petals Away from Center
construct_point_4 = ConstructPoint(XCoordinate=0, YCoordinate=0, ZCoordinate=0)
move_away_from_2 = MoveAwayFrom(Geometry=group_2, Emitter=construct_point_4, Distance=Slider(1, range=0..10))  # -> Geometry, Transform
ungroup_2 = Ungroup(Group=move_away_from_2.Geometry)

# ---- group: For Illustrator Graphics
merge_6 = Merge(Data1=simplify(split_list_3.ListA), Data2=trim_tree_4)
createhatch = CreateHatch(Bake=Button(), Curves=merge_6, HatchPatternName="Solid", HatchScale=1, HatchRotation=0)  # -> HatchGeometry, HatchObjects

# ---- group: Boudning Box for Each Petal
xy_plane = XYPlane(Origin=Point(0, 0, 0))
list_length_9 = ListLength(List=list_item_4)
polar_array = PolarArray(Geometry=xy_plane, Plane=PlaneXY(0, 0, 0), Count=list_length_9, Angle=6.283185307)  # -> Geometry, Transform
reverse_list_2 = ReverseList(List=polar_array.Geometry)
bounding_box = BoundingBox(Content=graft(list_item_4), Plane=graft(reverse_list_2))  # -> Box, Box_2

# ---- group: 2D Visualization / Cut Petals
colour_swatch_2 = ColourSwatch(SwatchColor=RGB(253, 21, 113))
surface_2 = Surface(list_item_4)
custom_preview_3 = CustomPreview(Geometry=surface_2, Material=colour_swatch_2)

# ---- group: 2D Visualization
brep_edges_2 = BrepEdges(Brep=surface_2)  # -> Naked, Interior, NonManifold
colour_swatch_3 = ColourSwatch(SwatchColor=RGB(207, 118, 153))
object_bake_3 = ObjectBake(
    BakeToggle=Button(),
    GeometryObjects=brep_edges_2.Naked,
    Layer="2D CONTOUR VISUALIZATION",
    ObjectName="GH_Obj",
    ObjectColor=colour_swatch_3,
    LayerColor=colour_swatch_3)

object_bake_4 = ObjectBake(
    BakeToggle=Button(),
    GeometryObjects=surface_2,
    Layer="2D SURFACE VISUALIZATION",
    ObjectName="GH_Obj",
    ObjectColor=colour_swatch_2,
    LayerColor=colour_swatch_2)

# ---- group: Move to the Left
negative_4 = Negative(Value=Slider(17, range=0..100))
unit_x_6 = UnitX(Factor=negative_4)
move_2 = Move(Geometry=ungroup_2, Motion=unit_x_6)  # -> Geometry, Transform

# ---- group: Get Center Point Furthest from Center of Flower
deconstruct_brep = DeconstructBrep(Brep=bounding_box.Box)  # -> Faces, Edges, Vertices
list_item_5 = ListItem(List=deconstruct_brep.Edges, Index=2, Wrap=True)
evaluate_curve_2 = EvaluateCurve(Curve=reparameterize(list_item_5), Parameter=0.5)  # -> flatten(Point), Tangent, Angle

# ---- group: Create Start of Bent Petal at Origin
construct_point_5 = ConstructPoint(XCoordinate=0, YCoordinate=0, ZCoordinate=0)
list_length_10 = ListLength(List=evaluate_curve_2.Point)
duplicate_data_2 = DuplicateData(Data=construct_point_5, Number=list_length_10, Order=True)  # -> simplify(graft(Data))

# ---- group: Petal Bend Inflection
position_for_petal_bend_inflection = Slider(0.58, range=0..1)
line = Line(StartPoint=construct_point_5, EndPoint=evaluate_curve_2.Point)
evaluate_curve_3 = EvaluateCurve(Curve=reparameterize(line), Parameter=position_for_petal_bend_inflection)  # -> Point, Tangent, Angle
height_of_petal_bend_inflection = Slider(0.67, range=-10..10)
deconstruct = Deconstruct(Point=evaluate_curve_3.Point)  # -> XComponent, YComponent, ZComponent
construct_point_6 = ConstructPoint(XCoordinate=deconstruct.XComponent, YCoordinate=deconstruct.YComponent, ZCoordinate=height_of_petal_bend_inflection)  # -> simplify(graft(Point))

# ---- group: Create End of Bent Petal
deconstruct_2 = Deconstruct(Point=evaluate_curve_2.Point)  # -> XComponent, YComponent, ZComponent
construct_point_7 = ConstructPoint(XCoordinate=deconstruct_2.XComponent, YCoordinate=deconstruct_2.YComponent, ZCoordinate=Slider(-1.24, range=-10..10))  # -> simplify(graft(Point))

# ---- group: LaserCut
colour_swatch_4 = ColourSwatch(SwatchColor=RGB(206, 54, 247))
custom_preview_4 = CustomPreview(Geometry=move_2.Geometry, Material=colour_swatch_4)

object_bake_5 = ObjectBake(
    BakeToggle=Button(),
    GeometryObjects=move_2.Geometry,
    Layer="LASER CUT LINES",
    ObjectName="GH_Obj",
    ObjectColor=colour_swatch_4,
    LayerColor=colour_swatch_4)

# ---- group: Draw Bend Spine
merge_7 = Merge(Data1=duplicate_data_2, Data2=construct_point_6, Data3=construct_point_7)
interpolate_4 = Interpolate(Vertices=merge_7, Degree=3, Periodic=False, KnotStyle=1)  # -> flatten(Curve), Length, Domain

# ---- group: Flow Petal along Bend Spine
flow = Flow(
    Geometry=list_item_4,
    Base=line,
    Target=interpolate_4.Curve,
    ReverseBase=False,
    ReverseTarget=False,
    Stretch=True,
    Rigid=False)

# ---- group: Build Rotation Planes for Blossoming Rotation
deconstruct_plane = DeconstructPlane(Plane=bounding_box.Box)  # -> Origin, XAxis, YAxis, ZAxis
construct_plane = ConstructPlane(Origin=Point(0, 0, 0), XAxis=deconstruct_plane.YAxis, YAxis=deconstruct_plane.ZAxis)  # -> flatten(Plane)
list_length_11 = ListLength(List=construct_plane)

# ---- group: Possible Blossoming Rotation Angles
negative_5 = Negative(Value=Slider(8, range=0..100))
construct_domain_4 = ConstructDomain(DomainStart=negative_5, DomainEnd=Slider(21, range=0..100))
random = Random(Range=construct_domain_4, Number=list_length_11, Seed=2)
radians_2 = Radians(Degrees=random)

# ---- group: Shift Over
unit_x_7 = UnitX(Factor=Slider(17, range=0..100))
move_3 = Move(Geometry=flow, Motion=unit_x_7)  # -> Geometry, Transform
surface_3 = Surface(move_3.Geometry)

# ---- group: Rotate Randomly
rotate_3 = Rotate(Geometry=flow, Angle=radians_2, Plane=construct_plane)  # -> Geometry, Transform

# ---- group: Rendering / Bent Petals
colour_swatch_5 = ColourSwatch(SwatchColor=RGB(230, 177, 198))
surface_4 = Surface(surface_3)
custom_preview_5 = CustomPreview(Geometry=surface_4, Material=colour_swatch_5)

# ---- group: Rendering
object_bake_6 = ObjectBake(
    BakeToggle=Button(),
    GeometryObjects=surface_4,
    Layer="3D BENT VISUALIZATION",
    ObjectName="GH_Obj",
    ObjectColor=colour_swatch_5,
    LayerColor=colour_swatch_5)

# ---- group: Shift Over
unit_x_8 = UnitX(Factor=Slider(33, range=0..100))
move_4 = Move(Geometry=rotate_3.Geometry, Motion=unit_x_8)  # -> Geometry, Transform
surface_5 = Surface(move_4.Geometry)

# ---- group: Rendering / Bent Petals
colour_swatch_6 = ColourSwatch(SwatchColor=RGB(212, 78, 132))
surface_6 = Surface(surface_5)
custom_preview_6 = CustomPreview(Geometry=surface_6, Material=colour_swatch_6)

# ---- group: Rendering
object_bake_7 = ObjectBake(
    BakeToggle=Button(),
    GeometryObjects=surface_6,
    Layer="3D BENT BLOSSOMING VISUALIZATION",
    ObjectName="GH_Obj",
    ObjectColor=colour_swatch_6,
    LayerColor=colour_swatch_6)
