# Grasshopper definition delaunay.gh (Grasshopper 1.0.7)

populate_2d = Populate2D(Region={Plane=PlaneXY(0, 0, 0), Size=Domain2(u=0..20, v=0..10)}, Count=Slider(10, range=0..100), Seed=1)
cross_reference = CrossReference(ListListA=populate_2d, ListListB=populate_2d, ListA=populate_2d, CrossMode=5)  # -> ListListA, ListListB, ListA
circle_3pt = Circle3Pt(PointA=cross_reference.ListListA, PointB=cross_reference.ListListB, PointC=cross_reference.ListA)  # -> Circle, Plane, Radius
weave = Weave(
    Pattern=[0, 1, 2],
    Stream0=cross_reference.ListListA,
    Stream1=cross_reference.ListListB,
    Stream2=cross_reference.ListA,
    NullGaps=False)
graft_tree = GraftTree(Tree=circle_3pt.Circle, IncludeEmptyLists=True, IncludeNullItems=True)
point_in_curve = PointInCurve(Point=populate_2d, Curve=graft_tree)  # -> Relationship, Point
partition_list = PartitionList(List=weave, Size=3)
mass_addition = MassAddition(Input=point_in_curve.Relationship)  # -> Result, PartialResults
larger_than = LargerThan(FirstNumber=mass_addition.Result, SecondNumber="3")  # -> LargerThan, OrEqualTo
dispatch = Dispatch(List=partition_list, DispatchPattern=larger_than.LargerThan)  # -> ListA, ListB
polyline = PolyLine(Vertices=dispatch.ListB, Closed=True)
delaunay_mesh = DelaunayMesh(Points=populate_2d, Plane=PlaneXY(0, 0, 0))
